# Grasshopper definition HU1.ghx (Grasshopper 1.0.8)
# Copyright: 2024
# plug-ins: RhinoCodePluginGH

number_slider = Slider(7, range=0..100)
number_slider_2 = Slider(0.48, range=0..1)

galapagos = Galapagos(fitness=volume, gene=number_slider_2)
# HU1
pt = ConstructPoint(XCoordinate=0, YCoordinate=0, ZCoordinate=0)
Y = UnitY(Factor=Slider(7.117, range=0..100))
range = Range(Domain=Domain(0, 1), Steps=number_slider)
graph = GraphMapper(range, x0=0, x1=1, y0=0, y1=1, container_name="Bezier", cpx=[0, 0.282954812, 0.6886360645, 1], cpy=[0, 0, 1, 1])

crv = Curve(<curve referenced from the Rhino model>)
end = EndPoints(Curve=crv)  # -> Start, End
item = ListItem(List=end.End, Index=0, Wrap=True)
pdecon = Deconstruct(Point=item)  # -> XComponent, YComponent, ZComponent

X = UnitX(Factor=1)

length_start = Slider(85, range=0..100)
length_width_end = Slider(15, range=0..100)
width_start = Slider(25, range=0..100)
dom = ConstructDomain(DomainStart=length_start, DomainEnd=length_width_end)
dom_2 = ConstructDomain(DomainStart=width_start, DomainEnd=length_width_end)
range_2 = Range(Domain=Domain(1, 0), Steps=number_slider)
range_3 = Range(Domain=Domain(1, 0), Steps=number_slider)
graph_2 = GraphMapper(range_2, x0=0, x1=1, y0=0, y1=1, container_name="Bezier", cpx=[0, 0.25, 0.75, 1], cpy=[0, 0.25, 0.75, 1])
graph_3 = GraphMapper(range_3, x0=0, x1=1, y0=0, y1=1, container_name="Bezier", cpx=[0, 0.25, 0.75, 1], cpy=[0, 0.25, 0.75, 1])
remap = RemapNumbers(Value=graph_2, Source=Domain(1, 0), Target=dom)  # -> expr("x/2", Mapped), Clipped
remap_2 = RemapNumbers(Value=graph_3, Source=Domain(1, 0), Target=dom_2)  # -> Mapped, Clipped

chamfer_start = Slider(5.04, range=0..100)
chamfer_end = Slider(4, range=0..100)
dom_3 = ConstructDomain(DomainStart=chamfer_start, DomainEnd=chamfer_end)
range_4 = Range(Domain=dom_3, Steps=number_slider)  # -> graft(Range)

inner_convexity = Slider(7.41, range=0..100)
range_5 = Range(Domain=Domain(1, 0), Steps=number_slider)
graph_4 = GraphMapper(range_5, x0=0, x1=1, y0=0, y1=1, container_name="Gaussian", factor=0.3271082044, mean=0.542044878, sdev=0.1327042878)
dom_4 = ConstructDomain(DomainStart=inner_convexity, DomainEnd=0)
remap_3 = RemapNumbers(Value=graph_4, Source=Domain(1, 0), Target=dom_4)  # -> Mapped, Clipped

toggle = BooleanToggle(True)

bend = Slider(7.53, range=0..100)
y_segements = Slider(2, range=1..10)
x_segements = Slider(9, range=1..100)

parabola = Python3Script(N=x_segements, D="1", Inv="1")  # -> R; inputs N: Int32, D: Int32, Inv: Boolean; same code as parabola
range_6 = Range(Domain=Domain(0, 1), Steps=x_segements)
graph_5 = GraphMapper(range_6, x0=0, x1=1, y0=0, y1=1, container_name="Gaussian", factor=0.5744156837, mean=0.5025906563, sdev=0.2324495912)

# ---- group: HU1
data = Data(Tree({0;0}: [Plane(origin=(0, 0, 0), x=(1, 0, 0), y=(0, 0.9966294872, 0.08203453653)), Plane(origin=(0, -0.339914296, 5.902904158), x=(1, 0, 0), y=(0, 0.9994583627, 0.03290868094)), Plane(origin=(0, -0.02858052688, 19.36073806), x=(1, 0, 0), y=(0, 0.9968673435, -0.07909171537)), Plane(origin=(0, 2.495487357, 36.09883), x=(1, 0, 0), y=(0, 0.9758612436, -0.2183914678)), Plane(origin=(0, 7.629634038, 53.05795904), x=(1, 0, 0), y=(0, 0.9331332335, -0.3595307615)), Plane(origin=(0, 14.48353381, 67.79082178), x=(1, 0, 0), y=(0, 0.8760928884, -0.4821423554)), Plane(origin=(0, 20.98189549, 78.28412372), x=(1, 0, 0), y=(0, 0.8220114449, -0.5694709689)), Plane(origin=(0, 24, 82.44743776), x=(1, 0, 0), y=(0, 0.7968938143, -0.6041193994))], {0;1}: [30.4853217, 37.54921365, 43.54331852, 41.83526203, 34.28185864, 24.44632601, 15.97808264, 12.3239629], {0;2}: [25, 23.57142857, 22.14285714, 20.71428571, 19.28571429, 17.85714286, 16.42857143, 15], {0;3}: [9], {0;4}: [2], {0;5}: [7.53], {0;6}: ["1", "0.857143", "0.714286", "0.571429", "0.428571", "0.285714", "0.142857", "0"], {0;7}: [5.04, 4.891428571, 4.742857143, 4.594285714, 4.445714286, 4.297142857, 4.148571429, 4], {0;8}: [0.01890272777, 0.4347796142, 3.138512364, 7.110309296, 5.055488418, 1.128100326, 0.07900276796, 0.00173638837], {0;9}: [0.09520690597, 0.2387266587, 0.4763253312, 0.7562697464, 0.955476626, 0.9605803491, 0.7684535464, 0.4891835352, 0.2477971653, 0.09988289636]))

# ----
# Inside surface
panel = Panel("1")
subtraction = Subtraction(A=1, B=Slider(0.24, range=0..1))
height = Slider(3, range=0..10)
radius = Slider(5, range=0..10)
gap = Slider(2.1, range=0..10)

remap_4 = RemapNumbers(Value=Slider(0, range=0..1), Source=Domain(0, 1), Target=number_slider)  # -> Mapped, Clipped

py3 = Python3Script(steps=number_slider, max_position=remap_4.Mapped)  # -> a; inputs steps: Int32, max_position: Int32
# ---------- py3: Python ----------
import numpy as np

def generate_float_range(steps, max_position):
    if not (0 <= max_position < steps):
        raise ValueError("max_position should be between 0 and steps-1")

    # Create a range of numbers from 0 to 1 with the defined number of steps
    range_before_max = np.linspace(0, 1, max_position + 1)  # From 0 to 1 (for max_position)
    range_after_max = np.linspace(1, 0, steps - max_position)  # From 1 down to 0
    
    # Combine them to create the full sequence
    float_range = np.concatenate([range_before_max[:-1], range_after_max])
    
    return float_range

# Example usage:
steps +=1
float_range = generate_float_range(steps, max_position)
a = [i for i in float_range]
# ---------- end py3 ----------
c_script = CSharpScript(steps=number_slider, maxPosition=remap_4.Mapped)  # -> a; inputs steps: Int32, maxPosition: Int32
# ---------- c_script: C# ----------
// Grasshopper Script Instance
#region Usings
using System;
using System.Linq;
using System.Collections;
using System.Collections.Generic;
using System.Drawing;

using Rhino;
using Rhino.Geometry;

using Grasshopper;
using Grasshopper.Kernel;
using Grasshopper.Kernel.Data;
using Grasshopper.Kernel.Types;
#endregion

public class Script_Instance : GH_ScriptInstance
{
    #region Notes
    /* 
      Members:
        RhinoDoc RhinoDocument
        GH_Document GrasshopperDocument
        IGH_Component Component
        int Iteration

      Methods (Virtual & overridable):
        Print(string text)
        Print(string format, params object[] args)
        Reflect(object obj)
        Reflect(object obj, string method_name)
    */
    #endregion

    private void RunScript(int steps, int maxPosition, ref object a)
    {
            
        float[] floatRange = GenerateFloatRange(steps, maxPosition);
        
        // Print the resulting array
        a = floatRange;


        static float[] GenerateFloatRange(int steps, int maxPosition)
        {
            steps++;
            
            if (maxPosition < 0 || maxPosition >= steps)
            {
                throw new ArgumentException("maxPosition should be between 0 and steps - 1");
            }

            // Create arrays for the two parts: before and after the maximum
            float[] rangeBeforeMax = Linspace(0, 1, maxPosition + 1);
            float[] rangeAfterMax = Linspace(1, 0, steps - maxPosition);

            // Concatenate them into a single array
            float[] result = new float[steps];
            Array.Copy(rangeBeforeMax, 0, result, 0, maxPosition);
            Array.Copy(rangeAfterMax, 0, result, maxPosition, steps - maxPosition);

            return result;
        }

        static float[] Linspace(float start, float end, int num)
        {
            float[] result = new float[num];
            float step = (end - start) / (num - 1);

            for (int i = 0; i < num; i++)
            {
                result[i] = start + step * i;
            }

            return result;
        }
    }
}
# ---------- end c_script ----------

graph_6 = GraphMapper(py3, x0=0, x1=1, y0=0, y1=1, container_name="Bezier", cpx=[0, 0.25, 0.75, 1], cpy=[0, 0.25, 0.75, 1])

panel_2 = Panel(graph_6)

# ---- group: Switch input type
dispatch = Dispatch(List=Slider(113, range=0..1000), DispatchPattern=invert(toggle))  # -> ListA, ListB
dispatch_2 = Dispatch(List=remap.Mapped, DispatchPattern=invert(toggle))  # -> ListA, ListB
dispatch_3 = Dispatch(List=pdecon.ZComponent, DispatchPattern=toggle)  # -> ListA, ListB
merge = Merge(Data1=dispatch_3.ListA, Data2=dispatch.ListA)

# ----
vec = VectorXYZ(XComponent=0, YComponent=Slider(24, range=0..100), ZComponent=merge)  # -> Vector, Length
move = Move(Geometry=pt, Motion=vec.Vector)  # -> Geometry, Transform
ln = Line(StartPoint=pt, EndPoint=move.Geometry)
eval = EvaluateCurve(Curve=reparameterize(ln), Parameter=Slider(0.712, range=0..1))  # -> Point, Tangent, Angle
move_2 = Move(Geometry=eval.Point, Motion=expr("-x", Y))  # -> Geometry, Transform
arc = Arc3Pt(PointA=pt, PointB=move_2.Geometry, PointC=move.Geometry)  # -> Arc, Plane, Radius
pframe = PerpFrame(Curve=reparameterize(arc.Arc), Parameter=graph)
pframe_2 = PerpFrame(Curve=reparameterize(arc.Arc), Parameter=number_slider_2)
align = AlignPlane(Plane=pframe, Direction=X)  # -> Plane, Angle
cluster = Cluster_2(C=crv, P=align.Plane)

# ---- group: Switch input type (continued)
dispatch_4 = Dispatch(List=cluster, DispatchPattern=toggle)  # -> ListA, ListB
entwine = Entwine(Branch00=dispatch_4.ListA, Branch01=dispatch_2.ListA, FlattenInputs=True)
clean = CleanTree(RemoveNulls=True, RemoveInvalid=True, RemoveEmpty=True, Tree=entwine)

# ----
entwine_2 = Entwine(
    Branch00=align.Plane,
    Branch01=clean,
    Branch02=remap_2.Mapped,
    Branch03=x_segements,
    Branch04=y_segements,
    Branch05=bend,
    Branch06=panel_2,
    Branch07=range_4,
    Branch08=remap_3.Mapped,
    Branch09=graph_5,
    FlattenInputs=True)
data_2 = Data(entwine_2)
bang = ExplodeTree(Data=entwine_2)  # -> Branch0, Branch1, Branch2, Branch3, Branch4, Branch5, Branch6, graft(Branch7), Branch8, Branch9
cluster_2 = Cluster(
    plane=bang.Branch0,
    length_range=bang.Branch1,
    width_range=bang.Branch2,
    x_segements=bang.Branch3,
    y_segements=bang.Branch4,
    bend=bang.Branch5,
    bend_graph=bang.Branch6,
    chamfer=bang.Branch7,
    inner_convexity=bang.Branch8,
    convexity_graph=bang.Branch9)  # -> simplify(segment_pt_group), simplify(segment_points), middle_polyline
deplane = DeconstructPlane(Plane=bang.Branch0)  # -> Origin, XAxis, YAxis, ZAxis
points = PointList(Points=cluster_2.segment_points, Size=2.35)
pline = PolyLine(Vertices=cluster_2.segment_points, Closed=True)  # -> flatten(Polyline)
tstat = TreeStatistics(Tree=cluster_2.segment_pt_group)  # -> Paths, Length, Count
loft_mesh = Python3Script(S=pline)  # -> M; inputs S: list of Curve; same code as loft_mesh
item_2 = ListItem(List=tstat.Paths, Index=0, Wrap=True)  # -> Item1, Item
branch = TreeBranch(Tree=cluster_2.segment_pt_group, Path=item_2.Item, MaintainPaths=True)
branch_2 = TreeBranch(Tree=cluster_2.segment_pt_group, Path=item_2.Item1, MaintainPaths=True)
item_3 = ListItem(List=deplane.ZAxis, Index=0, Wrap=True)  # -> Item1, Item
ungroup = Ungroup(Group=branch_2)
ungroup_2 = Ungroup(Group=branch)
cluster_3 = Cluster_3(D=ungroup_2, V=item_3.Item, A=expr("-x", Slider(5.88, range=0..10)))
cluster_4 = Cluster_3(D=ungroup, V=item_3.Item1, A=Slider(3.8, range=0..10))
mjoin = MeshJoin(Meshes=flatten([loft_mesh, cluster_4, cluster_3]))
weld = WeldMesh(Mesh=mjoin, Angle=3.141592654)
unim = UnifyMesh(Mesh=weld)  # -> Result, Count
subdmesh = SubDFromMesh(Mesh=unim.Result, Creases=1, Corners=1, Interpolate=False)

subdedges = SubDEdges(SubD=subdmesh, NewFormatting=False)  # -> Line, Edge, Tag, Id
midpt = CurveMiddle(Curve=subdedges.Edge)
c_script_2 = CSharpScript(C=subdedges.Edge)  # -> G; inputs C: list of Curve
# ---------- c_script_2: C# ----------
// Grasshopper Script Instance
#region Usings
using System;
using System.Linq;
using System.Collections;
using System.Collections.Generic;
using System.Drawing;

using Rhino;
using Rhino.Geometry;

using Grasshopper;
using Grasshopper.Kernel;
using Grasshopper.Kernel.Data;
using Grasshopper.Kernel.Types;
#endregion

public class Script_Instance : GH_ScriptInstance
{
    #region Notes
    /* 
      Members:
        RhinoDoc RhinoDocument
        GH_Document GrasshopperDocument
        IGH_Component Component
        int Iteration

      Methods (Virtual & overridable):
        Print(string text)
        Print(string format, params object[] args)
        Reflect(object obj)
        Reflect(object obj, string method_name)
    */
    #endregion

    private void RunScript(List<Curve> C, ref object G)
    {
        // Write your logic here
        double t = this.RhinoDocument.ModelAbsoluteTolerance;
    int n = C.Count;
    Point3d[] PS = new Point3d[n];
    Point3d[] PE = new Point3d[n];
    Vector3d[] TS = new Vector3d[n];
    Vector3d[] TE = new Vector3d[n];
    bool[] uS = new bool[n];
    bool[] uE = new bool[n];
    int[] iS = new int[n];
    int[] iE = new int[n];
    bool[] used = new bool[n];
    for(int i = 0;i < n;i++){
      PS[i] = C[i].PointAtStart;
      PE[i] = C[i].PointAtEnd;
      TS[i] = C[i].TangentAtStart;
      TE[i] = C[i].TangentAtEnd;
      iS[i] = -1;
      iE[i] = -1;
      if(C[i].IsPeriodic){
        iS[i] = i;
        iE[i] = i;
      }
    }
    for(int i = 0;i < n;i++){
      for(int j = 0;j < n;j++){if(i != j){
          if(!uS[i] && !uS[j] && (PS[i].DistanceTo(PS[j]) < t) && (Math.Sin(Rhino.Geometry.Vector3d.VectorAngle(TS[i], TS[j])) < 0.001)){
            uS[i] = true; uS[j] = true; iS[i] = j; iS[j] = i;
          }
          if(!uS[i] && !uE[j] && (PS[i].DistanceTo(PE[j]) < t) && (Math.Sin(Rhino.Geometry.Vector3d.VectorAngle(TS[i], TE[j])) < 0.001)){
            uS[i] = true; uE[j] = true; iS[i] = j; iE[j] = i;
          }
          if(!uE[i] && !uS[j] && (PE[i].DistanceTo(PS[j]) < t) && (Math.Sin(Rhino.Geometry.Vector3d.VectorAngle(TE[i], TS[j])) < 0.001)){
            uE[i] = true; uS[j] = true; iE[i] = j; iS[j] = i;
          }
          if(!uE[i] && !uE[j] && (PE[i].DistanceTo(PE[j]) < t) && (Math.Sin(Rhino.Geometry.Vector3d.VectorAngle(TE[i], TE[j])) < 0.001)){
            uE[i] = true; uE[j] = true; iE[i] = j; iE[j] = i;
          }
        }}
    }
    Grasshopper.DataTree<int> tree = new Grasshopper.DataTree<int>();
    int loop = 0;
    int curr = 0;
    int old = -1;
    for(int i = 0;i < n;i++){
      curr = i;
      if(!used[curr]){
        tree.Add(curr, new GH_Path(loop));
        used[curr] = true;

        if(!uS[curr] && !uE[curr]){
          loop++;
          continue;
        }
        if(uE[curr]){
          for(int k = 0;k < 100;k++){
            if(uE[curr] && (iE[curr] != old) && (iE[curr] != i) && !used[iE[curr]]){
              old = curr;
              curr = iE[curr];
              tree.Add(curr, new GH_Path(loop));
              used[curr] = true;
            }else if(uS[curr] && (iS[curr] != old) && (iS[curr] != i) && !used[iS[curr]]){
              old = curr;
              curr = iS[curr];
              tree.Add(curr, new GH_Path(loop));
              used[curr] = true;
            }else{break;}
          }
        }
        old = -1;
        curr = i;
        if(uS[curr]){
          for(int k = 0;k < 100;k++){
            if(uE[curr] && (iE[curr] != old) && (iE[curr] != i) && !used[iE[curr]]){
              old = curr;
              curr = iE[curr];
              tree.Add(curr, new GH_Path(loop));
              used[curr] = true;
            }else if(uS[curr] && (iS[curr] != old) && (iS[curr] != i) && !used[iS[curr]]){
              old = curr;
              curr = iS[curr];
              tree.Add(curr, new GH_Path(loop));
              used[curr] = true;
            }else{break;}
          }
        }
        loop++;
      }
    }
    G = tree;
    }
}
# ---------- end c_script_2 ----------
points_2 = PointList(Points=midpt)
c_script_3 = CSharpScript(T=c_script_2, i="266")  # -> B; inputs T: tree of Int32, i: Int32
# ---------- c_script_3: C# ----------
// Grasshopper Script Instance
#region Usings
using System;
using System.Linq;
using System.Collections;
using System.Collections.Generic;
using System.Drawing;

using Rhino;
using Rhino.Geometry;

using Grasshopper;
using Grasshopper.Kernel;
using Grasshopper.Kernel.Data;
using Grasshopper.Kernel.Types;
#endregion

public class Script_Instance : GH_ScriptInstance
{
    #region Notes
    /* 
      Members:
        RhinoDoc RhinoDocument
        GH_Document GrasshopperDocument
        IGH_Component Component
        int Iteration

      Methods (Virtual & overridable):
        Print(string text)
        Print(string format, params object[] args)
        Reflect(object obj)
        Reflect(object obj, string method_name)
    */
    #endregion

    private void RunScript(DataTree<int> T, int i, ref object B)
    {
        // Write your logic here
      for(int p = 0; p < T.BranchCount; p++){
      List<int> list = T.Branch(p);
      foreach(int a in list){
        if(a == i){B = list;break;}
      }
    }
    }
}
# ---------- end c_script_3 ----------
item_4 = ListItem(List=subdedges.Edge, Index=c_script_3, Wrap=True)

subdpoly = SubDControlPolygon(SubD=subdmesh)
medges = MeshEdges(Mesh=subdpoly)  # -> NakedEdges, InteriorEdges, NonManifoldEdges

cluster_5 = Cluster_4(L=cluster_2.segment_points, S=Slider(1, range=0..10), D=Slider(11, range=0..30), ex=Slider(4, range=0..10))
c_script_4 = CSharpScript(B=cluster_5)  # -> S; inputs B: Brep
# ---------- c_script_4: C# ----------
// Grasshopper Script Instance
#region Usings
using System;
using System.Linq;
using System.Collections;
using System.Collections.Generic;
using System.Drawing;

using Rhino;
using Rhino.Geometry;

using Grasshopper;
using Grasshopper.Kernel;
using Grasshopper.Kernel.Data;
using Grasshopper.Kernel.Types;
#endregion

public class Script_Instance : GH_ScriptInstance
{
    #region Notes
    /* 
      Members:
        RhinoDoc RhinoDocument
        GH_Document GrasshopperDocument
        IGH_Component Component
        int Iteration

      Methods (Virtual & overridable):
        Print(string text)
        Print(string format, params object[] args)
        Reflect(object obj)
        Reflect(object obj, string method_name)
    */
    #endregion

    private void RunScript(Brep B, ref object S)
    {
        for (int i = 0; i < B.Surfaces.Count; i++) {
            bool a = B.Faces[i].ShrinkSurfaceToEdge();
            Console.WriteLine(a);
        }

        S = B;
      
    }
}
# ---------- end c_script_4 ----------

number_slider_3 = Slider(0.29, range=0..1)
subtraction_2 = Subtraction(A=1, B=number_slider_3)
dom_5 = ConstructDomain(DomainStart=number_slider_3, DomainEnd=subtraction_2)
dom_6 = ConstructDomain(DomainStart=Slider(0.35, range=0..1), DomainEnd=subtraction)
dom² = ConstructDomain²(DomainU=dom_5, DomainV=dom_6)
subsrf = Isotrim(Surface=reparameterize(c_script_4), Domain=dom²)

# ----
# Inside surface
offset_mesh = Python3Script(M=unim.Result, D=panel)  # -> M; inputs M: Mesh, D: Double, C: Boolean
# ---------- offset_mesh: Python ----------
"""Grasshopper Script Instance"""
import System
import Rhino
import Grasshopper

import rhinoscriptsyntax as rs
import Rhino.Geometry as rg

class MyComponent(Grasshopper.Kernel.GH_ScriptInstance):
    def RunScript(self, M: Rhino.Geometry.Mesh, D: float, C: bool):
        
        if not C:
            C = False
        
        mesh = M.Offset(D, C)

        return mesh
# ---------- end offset_mesh ----------

# ---- group: Calculate Dimensions
bbox = BoundingBox(Content=subdmesh, Plane=pframe_2)  # -> Box, Box_2
edges = BrepEdges(Brep=bbox.Box)  # -> Naked, Interior, NonManifold
py3_2 = Python3Script(B=bbox.Box)  # -> pts, U, V, W; inputs B: Box
# ---------- py3_2: Python ----------
import Rhino.Geometry as rg
pts = B.GetCorners()
U = B.X[1] - B.X[0]
V = B.Y[1] - B.Y[0]
W = B.Z[1] - B.Z[0]
# ---------- end py3_2 ----------
item_5 = ListItem(List=py3_2.pts, Index=0, Wrap=True)  # -> Item, Item1, Item2, Item3, Item4
ln_2 = Line(StartPoint=item_5.Item, EndPoint=item_5.Item1)
ln_3 = Line(StartPoint=item_5.Item, EndPoint=item_5.Item4)
ln_4 = Line(StartPoint=item_5.Item1, EndPoint=item_5.Item2)

# ----
subdmesh_2 = SubDFromMesh(Mesh=offset_mesh, Creases=1, Corners=1, Interpolate=False)
volume = Volume(Geometry=bbox.Box)  # -> Volume, Centroid
panel_3 = Panel(volume.Volume)
dim = Dimensions(Surface=subsrf)  # -> UDimension, VDimension
panel_4 = Panel(dim.VDimension)
panel_5 = Panel(dim.UDimension)
cluster_6 = Cluster_5(S=subsrf, U=Slider(3, range=0..100), V=Slider(4, range=0..100), R=radius, H=height, G=gap)

preview = CustomPreview(Geometry=flatten([subdmesh, subdmesh_2, cluster_6]), Material=ColourSwatch(SwatchColor=RGB(186, 52, 139)))
preview_2 = CustomPreview(Geometry=edges.Interior, Material="white")
curve_preview = CustomCurvePreview(Curve=medges.InteriorEdges, Colour=RGB(0, 0, 0))
linedim = LineDimension(Line=[ln_2, ln_4, ln_3], Text="{0:0.00}", Size=Slider(2.25, range=0..10))

# ==== cluster Cluster
inner_convexity = ClusterInput()
length_range = ClusterInput()
width_range = ClusterInput()
x_segements = ClusterInput()
y_segements = ClusterInput()
convexity_graph = ClusterInput()
bend_graph = ClusterInput()
chamfer = ClusterInput()
plane = ClusterInput()
bend = ClusterInput()
multiplication = Multiplication(A=convexity_graph, B=graft(inner_convexity))
dom = ConstructDomain(DomainStart=bend, DomainEnd=0)
deplane = DeconstructPlane(Plane=plane)  # -> Origin, XAxis, YAxis, ZAxis
X = UnitX(Factor=length_range)
remap = RemapNumbers(Value=bend_graph, Source=Domain(1, 0), Target=dom)  # -> Mapped, Clipped
parabola = Python3Script(N=x_segements, D="1", Inv="1")  # -> R; inputs N: Int32, D: Int32, Inv: Boolean
#   port N: Number of steps
#   port D: 0 = (0 To 1) 1 = (-1 To 1)
# ---------- parabola: Python ----------
if not N:
    N = 10

types = [(0, 1),
         (-1, 1)]
R = []
start, end = types[D]
diff = end - start
step = diff / N
N += 1
for i in range(N):
    f = (start + i * step) ** 2
    if Inv:
        R.append(end - f)
    else:
        R.append(f)
# ---------- end parabola ----------
multiplication_2 = Multiplication(A=parabola, B=graft(remap.Mapped))
move = Move(Geometry=plane, Motion=expr("-x", X))  # -> Geometry, Transform
move_2 = Move(Geometry=plane, Motion=X)  # -> Geometry, Transform
multiplication_3 = Multiplication(A=graft(deplane.YAxis), B=multiplication_2)
ln = Line(StartPoint=move.Geometry, EndPoint=move_2.Geometry)
neg = Negative(Value=multiplication_3)
divide = DivideCurve(Curve=ln, Count=x_segements, Kinks=False)  # -> Points, Tangents, Parameters
move_3 = Move(Geometry=divide.Points, Motion=neg)  # -> Geometry, Transform
pline = PolyLine(Vertices=move_3.Geometry, Closed=False)
multiplication_4 = Multiplication(A=graft(deplane.YAxis), B=multiplication)
middle_polyline = ClusterOutput(pline)
offset = OffsetCurve(Curve=pline, Distance=expr("x/2", graft(width_range)), Plane=graft(plane), Corners=1)
offset_2 = OffsetCurve(Curve=pline, Distance=expr("-x/2", graft(width_range)), Plane=graft(plane), Corners=1)
end = EndPoints(Curve=offset)  # -> Start, End
end_2 = EndPoints(Curve=offset_2)  # -> Start, End
ln_2 = Line(StartPoint=end.Start, EndPoint=end_2.Start)
ln_3 = Line(StartPoint=end.End, EndPoint=end_2.End)
trim_curve = TrimCurve(C=offset, D=chamfer)  # -> Crv; inputs C: Curve, D: Double, E: Int32
#   port E: None = 0 Start = 1 End = 2 Both = 3
# ---------- trim_curve: Python ----------
import Rhino.Geometry as rg
if not E:
    E = 3
if not D:
    D = 0
try:
    if D:
        Crv = C.Trim(rg.CurveEnd(E), D)
    else:
        Crv = C
except:
    pass
# ---------- end trim_curve ----------
trim_curve_2 = TrimCurve(C=offset_2, D=chamfer)  # -> Crv; inputs C: Curve, D: Double, E: Int32; same code as trim_curve
trim_curve_3 = TrimCurve(C=ln_2, D=chamfer)  # -> Crv; inputs C: Curve, D: Double, E: Int32; same code as trim_curve
trim_curve_4 = TrimCurve(C=ln_3, D=chamfer)  # -> Crv; inputs C: Curve, D: Double, E: Int32; same code as trim_curve
divide_2 = DivideCurve(Curve=trim_curve_2, Count=x_segements, Kinks=False)  # -> reverse(Points), Tangents, Parameters
divide_3 = DivideCurve(Curve=trim_curve, Count=x_segements, Kinks=False)  # -> Points, Tangents, Parameters
divide_4 = DivideCurve(Curve=trim_curve_4, Count=y_segements, Kinks=False)  # -> Points, Tangents, Parameters
divide_5 = DivideCurve(Curve=trim_curve_3, Count=y_segements, Kinks=False)  # -> reverse(Points), Tangents, Parameters

# ---- group: Inner Convexity
move_4 = Move(Geometry=divide_2.Points, Motion=multiplication_4)  # -> Geometry, Transform

# ----
group = Group(Objects=divide_5.Points)
group_2 = Group(Objects=divide_3.Points)
group_3 = Group(Objects=move_4.Geometry)
group_4 = Group(Objects=divide_4.Points)
weave = Weave(Pattern=[0, 1, 2, 3], Stream0=group, Stream1=group_2, Stream2=group_4, Stream3=group_3, NullGaps=False)
ungroup = Ungroup(Group=weave)
pshift = ShiftPaths(Data=ungroup, Offset=-1)  # -> simplify(Data)
segment_pt_group = ClusterOutput(weave)
segment_points = ClusterOutput(pshift)

# ==== cluster Cluster_2
P = ClusterInput()
pdecon = Deconstruct(Point=P)  # -> XComponent, YComponent, ZComponent
C = ClusterInput()
pt = ConstructPoint(XCoordinate=pdecon.XComponent, YCoordinate=0, ZCoordinate=pdecon.ZComponent)
pcx = CurvePlane(Curve=C, Plane=pt)  # -> Points, ParamsC, ParamsP
pdecon_2 = Deconstruct(Point=pcx.ParamsP)  # -> flatten(XComponent), YComponent, ZComponent
X = ClusterOutput(pdecon_2.XComponent)

# ==== cluster Cluster_3
D = ClusterInput()
V = ClusterInput()
A = ClusterInput()
bang = ExplodeTree(Data=D)  # -> Branch0, reverse(Branch1), Branch2, Branch3
amp = Amplitude(Vector=V, Amplitude=A)
ln = Line(StartPoint=bang.Branch1, EndPoint=bang.Branch3)
subset = SubList(List=reverse(bang.Branch0), Domain=Domain(0, 1), Wrap=True)  # -> reverse(List), Index
subset_2 = SubList(List=reverse(bang.Branch2), Domain=Domain(0, 1), Wrap=True)  # -> reverse(List), Index
subset_3 = SubList(List=bang.Branch0, Domain=Domain(0, 1), Wrap=True)  # -> List, Index
subset_4 = SubList(List=bang.Branch2, Domain=Domain(0, 1), Wrap=True)  # -> List, Index
midpt = CurveMiddle(Curve=ln)
move = Move(Geometry=midpt, Motion=amp)  # -> Geometry, Transform
entwine = Entwine(
    Branch00=subset_3.List,
    Branch01=reverse(move.Geometry),
    Branch02=subset_2.List,
    Branch03=bang.Branch3,
    FlattenInputs=True)  # -> flatten(Result)
entwine_2 = Entwine(Branch00=subset.List, Branch01=reverse(bang.Branch1), Branch02=subset_4.List, Branch03=move.Geometry, FlattenInputs=True)  # -> flatten(Result)
shift = ShiftList(List=entwine, Shift=1, Wrap=True)
shift_2 = ShiftList(List=entwine_2, Shift=1, Wrap=True)
construct_mesh = Python3Script(V=shift)  # -> M; inputs V: list of Point3d
# ---------- construct_mesh: Python ----------
from math import ceil
import ghpythonlib.components as gc

face_n = int((len(V)-2)/2)

n = [i for i in range(len(V))]
Faces = []
for i in range(face_n):
    cb = '{}'
    ch = f'Q{cb[0]}{n[0]};{n[1]};{n[-2]};{n[-1]}{cb[1]}'
    Faces.append(ch)
    n.pop(-1)
    n.pop(0)

M = gc.ConstructMesh(V, Faces)
# ---------- end construct_mesh ----------
construct_mesh_2 = Python3Script(V=shift_2)  # -> M; inputs V: list of Point3d; same code as construct_mesh
points = PointList(Points=shift_2, Size=2.35)
mjoin = MeshJoin(Meshes=[construct_mesh, construct_mesh_2])
M = ClusterOutput(mjoin)

# ==== cluster Cluster_4
L = ClusterInput()
S = ClusterInput()
shift = ShiftList(List=L, Shift=S, Wrap=True)
D = ClusterInput()
subset = SubList(List=reverse(shift), Domain=D, Wrap=True)  # -> List, Index
pline = PolyLine(Vertices=subset.List, Closed=False)  # -> flatten(Polyline)
loft_mesh = Python3Script(S=pline)  # -> M; inputs S: list of Curve
# ---------- loft_mesh: Python ----------
"""Grasshopper Script Instance"""
import System
import Rhino
import Grasshopper

import Rhino.Geometry as rg
import rhinoscriptsyntax as rs
from math import ceil, pi
import ghpythonlib.components as gc


class MyComponent(Grasshopper.Kernel.GH_ScriptInstance):
    def RunScript(self, S: System.Collections.Generic.List[Rhino.Geometry.Curve]):
        
        M = rg.Mesh()
        for k in range(len(S)-1):

            pl1 = S[k].ToNurbsCurve().Points
            pts1 = []
            for j in range(pl1.Count):
                pts1.append(rg.Point3d(pl1[j].X, pl1[j].Y, pl1[j].Z))
            pl2 = S[k+1].ToNurbsCurve().Points
            pts2 = []
            for l in range(pl2.Count):
                pts2.append(rg.Point3d(pl2[l].X, pl2[l].Y, pl2[l].Z))   
            
            pts2.reverse()
            V = pts1 + pts2

            face_n = int((len(V)-2)/2)
            
            n = [i for i in range(len(V))]
            Faces = []
            for i in range(face_n):
                cb = '{}'
                ch = f'Q{cb[0]}{n[0]};{n[1]};{n[-2]};{n[-1]}{cb[1]}'
                Faces.append(ch)
                n.pop(-1)
                n.pop(0)
            
            mesh = gc.ConstructMesh(V, Faces)
            M.Append(mesh)
        M.Weld(pi)
        return M
# ---------- end loft_mesh ----------
flipm = FlipMesh(Mesh=loft_mesh, VertexNormals=True, FaceNormals=True, FaceOrientation=True)
subdmesh = SubDFromMesh(Mesh=flipm, Creases=1, Corners=1, Interpolate=False)
ex = ClusterInput()
subd_to_nurbs = Python3Script(S=subdmesh, Ex=ex)  # -> B; inputs Ex: Int32
#   port Ex: None = 0 LocalG1 = 1 LocalG2 = 2 LocalG1x = 3 LocalG1xx = 4
# ---------- subd_to_nurbs: Python ----------
import Rhino.Geometry as rg
if Ex > 4:
    raise ValueError('This option doesn\'nt exist. (0, 4)')
opt = rg.SubDToBrepOptions()
opt.PackFaces = True
evp = rg.SubDToBrepOptions.ExtraordinaryVertexProcessOption(Ex)
opt.ExtraordinaryVertexProcess = evp
B = S.ToBrep(opt)
# ---------- end subd_to_nurbs ----------
B = ClusterOutput(subd_to_nurbs)

# ==== cluster Cluster_5
S = ClusterInput()
R = ClusterInput()
H = ClusterInput()
G = ClusterInput()
U = ClusterInput()
V = ClusterInput()
sdivide = DivideSurface(Surface=S, UCount=U, VCount=V)  # -> Points, Normals, Parameters
flip = FlipMatrix(Data=sdivide.Points)
intcrv = Interpolate(Vertices=flip, Degree=3, Periodic=False, KnotStyle=1)  # -> Curve, Length, Domain
multiplication = Multiplication(A=R, B=2)
len = Length(Curve=intcrv.Curve)
addition = Addition(A=multiplication, B=G)
division = Division(A=len, B=addition)
int = Integer(division)
divide = DivideCurve(Curve=intcrv.Curve, Count=int, Kinks=False)  # -> Points, Tangents, Parameters
srf_cp = SurfaceClosestPoint(Point=divide.Points, Surface=S)  # -> Point, UVPoint, Distance
evalsrf = EvaluateSurface(Surface=S, Point=srf_cp.UVPoint)  # -> Point, Normal, UDirection, VDirection, Frame
sph = Sphere(Base=evalsrf.Point, Radius=R)
cir = Circle(Plane=evalsrf.Frame, Radius=R)
srfsplit = SurfaceSplit(Surface=graft(sph), Curves=graft(cir))
item = ListItem(List=srfsplit, Index=0, Wrap=True)
pshift = ShiftPaths(Data=item, Offset=-2)  # -> simplify(Data)
cyl = Cylinder(Base=evalsrf.Frame, Radius=R, Length=expr("-x", H))
scale_nu = ScaleNU(Geometry=pshift, Plane=simplify(evalsrf.Frame), ScaleX=1, ScaleY=1, ScaleZ=Slider(0.2, range=0..1))  # -> Geometry, Transform
weave = Weave(Pattern=[0, 1], Stream0=graft(cyl), Stream1=graft(scale_nu.Geometry), NullGaps=False)
join = BrepJoin(Breps=weave)  # -> Breps, Closed
pshift_2 = ShiftPaths(Data=join.Breps, Offset=-2)  # -> simplify(Data)
geometry = ClusterOutput(pshift_2)
