# Grasshopper definition HU2_teardown_animation.ghx (Grasshopper 1.0.8)
# Copyright: 2024
# plug-ins: RhinoCodePluginGH, V-Ray For Grasshopper 8

trigger = Trigger(Interval=20, TimerInterval=20, Target=S)  # disabled
S = Script(reset=Button())  # -> out, a; inputs reset: Boolean
# ---------- S: Python ----------
if 't' not in globals() or reset:
    t = 0
else:
    t += 0.1
a = t
# ---------- end S ----------
block_definition = QueryModelBlockDefinitions(AutoUpdateState=True)
panel = Panel(S.a)
number_slider = Slider(15, range=0..100)
block_definition_2 = ModelBlockDefinition(BlockDefinition=block_definition)  # -> BlockDefinition, Objects, Name
panel_2 = Panel(block_definition_2.Name)
series = Series(Start=number_slider, Step=number_slider, Count=6)
series_2 = Series(Start="0", Step="0", Count=6)
multiplication = Multiplication(A=Slider(0, range=0..1), B=series)
vec = VectorXYZ(XComponent=0, YComponent=expr("-x", Slider(5, range=0..100)), ZComponent=0)  # -> reverse(Vector), Length
pt = ConstructPoint(XCoordinate=series_2, YCoordinate=multiplication, ZCoordinate=0)
item = ListItem(List=vec.Vector, Index=0, Wrap=True)  # -> Item, Item1, Item2, Item3, Item4, Item5
data = Data(item.Item3)
data_2 = Data(item.Item2)
data_3 = Data(item.Item5)
data_4 = Data(item.Item1)
data_5 = Data(item.Item4)
data_6 = Data(item.Item)

cluster = Cluster_2(T=data_4, N=flatten("RB Inner USB Port Pins"))  # -> flatten(O)
cluster_2 = Cluster_2(T=data_4, N=["RB SD Storage", "RB Metal Ports", "RB CPU"])  # -> flatten(O)
cluster_3 = Cluster_2(T=data_4, N=["RB Inside USB Port", "RB IC"])  # -> flatten(O)
cluster_4 = Cluster_2(T=data_4, N=["RB Pins", "RB Lock"])  # -> flatten(O)
cluster_5 = Cluster_2(T=data_4, N="RB Resistors")  # -> flatten(O)
cluster_6 = Cluster_2(T=data_4, N="RB Chip")  # -> flatten(O)
cluster_7 = Cluster_2(T=data_4, N="RB PCB")
cluster_8 = Cluster(B=cluster_7)  # -> A, B_2
cluster_9 = Cluster(B=cluster_6)  # -> A, B_2
mtl_name = VRayMaterialFromProject(
    "/Resistors",
    Has_Extract_Parameter=True,
    Has_Manage_Collection=False,
    OptionsLength=17,
    Version=1,
    Options=["/Aluminum_Polished", "/Battery", "/Charger_Chip", "/Copper_Polished", "/Foam_B02_Black_40cm", "/Gold_10k", "/Graphite", "/Gyroscope", "/Plane", "/Raspberry_Board", "/Raspberry_Chip", "/Resistors", "/Ribbon", "/Shield", "/Shield_Lock", "/Silver_Polished", "/UPS"])
mtl_name_2 = VRayMaterialFromProject(
    "/Raspberry_Chip",
    Has_Extract_Parameter=True,
    Has_Manage_Collection=False,
    OptionsLength=17,
    Version=1,
    Options=["/Aluminum_Polished", "/Battery", "/Charger_Chip", "/Copper_Polished", "/Foam_B02_Black_40cm", "/Gold_10k", "/Graphite", "/Gyroscope", "/Plane", "/Raspberry_Board", "/Raspberry_Chip", "/Resistors", "/Ribbon", "/Shield", "/Shield_Lock", "/Silver_Polished", "/UPS"])
mtl_name_3 = VRayMaterialFromProject(
    "/Aluminum_Polished",
    Has_Extract_Parameter=True,
    Has_Manage_Collection=False,
    OptionsLength=17,
    Version=1,
    Options=["/Aluminum_Polished", "/Battery", "/Charger_Chip", "/Copper_Polished", "/Foam_B02_Black_40cm", "/Gold_10k", "/Graphite", "/Gyroscope", "/Plane", "/Raspberry_Board", "/Raspberry_Chip", "/Resistors", "/Ribbon", "/Shield", "/Shield_Lock", "/Silver_Polished", "/UPS"])
mtl_name_4 = VRayMaterialFromProject(
    "/Raspberry_Board",
    Has_Extract_Parameter=True,
    Has_Manage_Collection=False,
    OptionsLength=17,
    Version=1,
    Options=["/Aluminum_Polished", "/Battery", "/Charger_Chip", "/Copper_Polished", "/Foam_B02_Black_40cm", "/Gold_10k", "/Graphite", "/Gyroscope", "/Plane", "/Raspberry_Board", "/Raspberry_Chip", "/Resistors", "/Ribbon", "/Shield", "/Shield_Lock", "/Silver_Polished", "/UPS"])
mtl_name_5 = VRayMaterialFromProject(
    "/Copper_Polished",
    Has_Extract_Parameter=True,
    Has_Manage_Collection=False,
    OptionsLength=17,
    Version=1,
    Options=["/Aluminum_Polished", "/Battery", "/Charger_Chip", "/Copper_Polished", "/Foam_B02_Black_40cm", "/Gold_10k", "/Graphite", "/Gyroscope", "/Plane", "/Raspberry_Board", "/Raspberry_Chip", "/Resistors", "/Ribbon", "/Shield", "/Shield_Lock", "/Silver_Polished", "/UPS"])
mtl_name_6 = VRayMaterialFromProject(
    "/Graphite",
    Has_Extract_Parameter=True,
    Has_Manage_Collection=False,
    OptionsLength=17,
    Version=1,
    Options=["/Aluminum_Polished", "/Battery", "/Charger_Chip", "/Copper_Polished", "/Foam_B02_Black_40cm", "/Gold_10k", "/Graphite", "/Gyroscope", "/Plane", "/Raspberry_Board", "/Raspberry_Chip", "/Resistors", "/Ribbon", "/Shield", "/Shield_Lock", "/Silver_Polished", "/UPS"])
mtl_name_7 = VRayMaterialFromProject(
    "/Shield_Lock",
    Has_Extract_Parameter=True,
    Has_Manage_Collection=False,
    OptionsLength=17,
    Version=1,
    Options=["/Aluminum_Polished", "/Battery", "/Charger_Chip", "/Copper_Polished", "/Foam_B02_Black_40cm", "/Gold_10k", "/Graphite", "/Gyroscope", "/Plane", "/Raspberry_Board", "/Raspberry_Chip", "/Resistors", "/Ribbon", "/Shield", "/Shield_Lock", "/Silver_Polished", "/UPS"])
vgeo = VRayGeometry(Geo=flatten(cluster_2), Material=mtl_name_3, Visible=True, quality=0)
vgeo_2 = VRayGeometry(Geo=flatten(cluster), Material=mtl_name_5, Visible=True, quality=0)
vgeo_3 = VRayGeometry(Geo=flatten(cluster_3), Material=mtl_name_6, Visible=True, quality=0)
vgeo_4 = VRayGeometry(Geo=flatten(cluster_4), Material=mtl_name_7, Visible=True, quality=0)
vgeo_5 = VRayGeometry(Geo=flatten(cluster_5), Material=mtl_name, Visible=True, quality=0)
vgeo_6 = VRayGeometry(Geo=flatten([cluster_9.A, cluster_9.B_2]), Material=mtl_name_2, Visible=True, quality=0)
mtl_preset = VRayMaterialPreset(Preset=1, MaterialBaseColorOrTexture=ColourSwatch(SwatchColor=RGB(54, 163, 112)))
vgeo_7 = VRayGeometry(Geo=flatten([cluster_8.A, cluster_8.B_2]), Material=mtl_preset, Visible=True, quality=0)
merge = Merge(Data1=vgeo, Data2=vgeo_7, Data3=vgeo_2, Data4=vgeo_3, Data5=vgeo_4, Data6=vgeo_5, Data7=vgeo_6)

cluster_10 = Cluster_2(T=data_5, N="UPS Pin Connector")  # -> flatten(O)
cluster_11 = Cluster_2(T=data_5, N="Battery Case Box")
cluster_12 = Cluster_2(T=data_5, N="Battery Case Connectors")
cluster_13 = Cluster_2(T=data_5, N="UPS Metal Parts")
cluster_14 = Cluster_2(T=data_5, N="UPS PCB")
cluster_15 = Cluster(B=cluster_14)  # -> A, B_2
sunion = SolidUnion(Breps=cluster_11)
mtl_name_8 = VRayMaterialFromProject(
    "/Aluminum_Polished",
    Has_Extract_Parameter=True,
    Has_Manage_Collection=False,
    OptionsLength=17,
    Version=1,
    Options=["/Aluminum_Polished", "/Battery", "/Charger_Chip", "/Copper_Polished", "/Foam_B02_Black_40cm", "/Gold_10k", "/Graphite", "/Gyroscope", "/Plane", "/Raspberry_Board", "/Raspberry_Chip", "/Resistors", "/Ribbon", "/Shield", "/Shield_Lock", "/Silver_Polished", "/UPS"])
mtl_name_9 = VRayMaterialFromProject(
    "/Graphite",
    Has_Extract_Parameter=True,
    Has_Manage_Collection=False,
    OptionsLength=17,
    Version=1,
    Options=["/Aluminum_Polished", "/Battery", "/Charger_Chip", "/Copper_Polished", "/Foam_B02_Black_40cm", "/Gold_10k", "/Graphite", "/Gyroscope", "/Plane", "/Raspberry_Board", "/Raspberry_Chip", "/Resistors", "/Ribbon", "/Shield", "/Shield_Lock", "/Silver_Polished", "/UPS"])
mtl_name_10 = VRayMaterialFromProject(
    "/UPS",
    Has_Extract_Parameter=True,
    Has_Manage_Collection=False,
    OptionsLength=17,
    Version=1,
    Options=["/Aluminum_Polished", "/Battery", "/Charger_Chip", "/Copper_Polished", "/Foam_B02_Black_40cm", "/Gold_10k", "/Graphite", "/Gyroscope", "/Plane", "/Raspberry_Board", "/Raspberry_Chip", "/Resistors", "/Ribbon", "/Shield", "/Shield_Lock", "/Silver_Polished", "/UPS"])
mtl_name_11 = VRayMaterialFromProject(
    "/Graphite",
    Has_Extract_Parameter=True,
    Has_Manage_Collection=False,
    OptionsLength=17,
    Version=1,
    Options=["/Aluminum_Polished", "/Battery", "/Charger_Chip", "/Copper_Polished", "/Foam_B02_Black_40cm", "/Gold_10k", "/Graphite", "/Gyroscope", "/Plane", "/Raspberry_Board", "/Raspberry_Chip", "/Resistors", "/Ribbon", "/Shield", "/Shield_Lock", "/Silver_Polished", "/UPS"])
vgeo_8 = VRayGeometry(Geo=flatten([cluster_13, cluster_12]), Material=mtl_name_8, Visible=True, quality=0)
vgeo_9 = VRayGeometry(Geo=flatten([cluster_10, sunion]), Material=mtl_name_9, Visible=True, quality=0)
vgeo_10 = VRayGeometry(Geo=flatten(cluster_15.A), Material=mtl_name_10, Visible=True, quality=0)
vgeo_11 = VRayGeometry(Geo=flatten(cluster_15.B_2), Material=mtl_name_11, Visible=True, quality=0)
merge_2 = Merge(Data1=vgeo_9, Data2=vgeo_8, Data3=vgeo_10, Data4=vgeo_11)

cluster_16 = Cluster_2(T=data, N="Gyroscope")
cluster_17 = Cluster(B=cluster_16)  # -> A, B_2
mtl_name_12 = VRayMaterialFromProject(
    "/Gyroscope",
    Has_Extract_Parameter=True,
    Has_Manage_Collection=False,
    OptionsLength=17,
    Version=1,
    Options=["/Aluminum_Polished", "/Battery", "/Charger_Chip", "/Copper_Polished", "/Foam_B02_Black_40cm", "/Gold_10k", "/Graphite", "/Gyroscope", "/Plane", "/Raspberry_Board", "/Raspberry_Chip", "/Resistors", "/Ribbon", "/Shield", "/Shield_Lock", "/Silver_Polished", "/UPS"])
vgeo_12 = VRayGeometry(Geo=flatten(cluster_17.A), Material=mtl_name_12, Visible=True, quality=0)
mtl_preset_2 = VRayMaterialPreset(Preset=1, MaterialBaseColorOrTexture=ColourSwatch(SwatchColor=RGB(1, 145, 97)))
vgeo_13 = VRayGeometry(Geo=flatten(cluster_17.B_2), Material=mtl_preset_2, Visible=True, quality=0)
merge_3 = Merge(Data1=vgeo_12, Data2=vgeo_13)

cluster_18 = Cluster_2(T=data_2, N="Battery")
item_2 = ListItem(List=cluster_18, Index=0, Wrap=True)  # -> Item, Item1, Item2, Item3
geo = Geometry([item_2.Item, item_2.Item1, item_2.Item3])
mtl_name_13 = VRayMaterialFromProject(
    "/Battery",
    Has_Extract_Parameter=True,
    Has_Manage_Collection=False,
    OptionsLength=17,
    Version=1,
    Options=["/Aluminum_Polished", "/Battery", "/Charger_Chip", "/Copper_Polished", "/Foam_B02_Black_40cm", "/Gold_10k", "/Graphite", "/Gyroscope", "/Plane", "/Raspberry_Board", "/Raspberry_Chip", "/Resistors", "/Ribbon", "/Shield", "/Shield_Lock", "/Silver_Polished", "/UPS"])
mtl_name_14 = VRayMaterialFromProject(
    "/Aluminum_Polished",
    Has_Extract_Parameter=True,
    Has_Manage_Collection=False,
    OptionsLength=17,
    Version=1,
    Options=["/Aluminum_Polished", "/Battery", "/Charger_Chip", "/Copper_Polished", "/Foam_B02_Black_40cm", "/Gold_10k", "/Graphite", "/Gyroscope", "/Plane", "/Raspberry_Board", "/Raspberry_Chip", "/Resistors", "/Ribbon", "/Shield", "/Shield_Lock", "/Silver_Polished", "/UPS"])
vgeo_14 = VRayGeometry(Geo=flatten(item_2.Item2), Material=mtl_name_13, Visible=True, quality=0)
vgeo_15 = VRayGeometry(Geo=flatten(geo), Material=mtl_name_14, Visible=True, quality=0)
merge_4 = Merge(Data1=vgeo_14, Data2=vgeo_15)

cluster_19 = Cluster_2(T=data_3, N=flatten("Coil"))  # -> flatten(O)
cluster_20 = Cluster_2(T=data_3, N="Charger Board")
cluster_21 = Cluster_2(T=data_3, N="Charger Pad")
cluster_22 = Cluster(B=cluster_20)  # -> A, B_2
mtl_name_15 = VRayMaterialFromProject(
    "/Foam_B02_Black_40cm",
    Has_Extract_Parameter=True,
    Has_Manage_Collection=False,
    OptionsLength=17,
    Version=1,
    Options=["/Aluminum_Polished", "/Battery", "/Charger_Chip", "/Copper_Polished", "/Foam_B02_Black_40cm", "/Gold_10k", "/Graphite", "/Gyroscope", "/Plane", "/Raspberry_Board", "/Raspberry_Chip", "/Resistors", "/Ribbon", "/Shield", "/Shield_Lock", "/Silver_Polished", "/UPS"])
mtl_name_16 = VRayMaterialFromProject(
    "/Copper_Polished",
    Has_Extract_Parameter=True,
    Has_Manage_Collection=False,
    OptionsLength=17,
    Version=1,
    Options=["/Aluminum_Polished", "/Battery", "/Charger_Chip", "/Copper_Polished", "/Foam_B02_Black_40cm", "/Gold_10k", "/Graphite", "/Gyroscope", "/Plane", "/Raspberry_Board", "/Raspberry_Chip", "/Resistors", "/Ribbon", "/Shield", "/Shield_Lock", "/Silver_Polished", "/UPS"])
mtl_name_17 = VRayMaterialFromProject(
    "/Charger_Chip",
    Has_Extract_Parameter=True,
    Has_Manage_Collection=False,
    OptionsLength=17,
    Version=1,
    Options=["/Aluminum_Polished", "/Battery", "/Charger_Chip", "/Copper_Polished", "/Foam_B02_Black_40cm", "/Gold_10k", "/Graphite", "/Gyroscope", "/Plane", "/Raspberry_Board", "/Raspberry_Chip", "/Resistors", "/Ribbon", "/Shield", "/Shield_Lock", "/Silver_Polished", "/UPS"])
vgeo_16 = VRayGeometry(Geo=flatten(cluster_19), Material=mtl_name_16, Visible=True, quality=0)
vgeo_17 = VRayGeometry(Geo=flatten(cluster_22.A), Material=mtl_name_17, Visible=True, quality=0)
vgeo_18 = VRayGeometry(Geo=flatten(cluster_21), Material=mtl_name_15, Visible=True, quality=0)
mtl_preset_3 = VRayMaterialPreset(Preset=1, MaterialBaseColorOrTexture=ColourSwatch(SwatchColor=RGB(1, 145, 97)))
vgeo_19 = VRayGeometry(Geo=flatten(cluster_22.B_2), Material=mtl_preset_3, Visible=True, quality=0)
merge_5 = Merge(Data1=vgeo_16, Data2=vgeo_17, Data3=vgeo_19, Data4=vgeo_18)

cluster_23 = Cluster_2(T=data_6, N="Shield PCB")
cluster_24 = Cluster_2(T=data_6, N="Ribbon")
cluster_25 = Cluster_2(T=data_6, N="Shield Lock")
cluster_26 = Cluster(B=cluster_23)  # -> A, B_2
mtl_name_18 = VRayMaterialFromProject(
    "/Shield",
    Has_Extract_Parameter=True,
    Has_Manage_Collection=False,
    OptionsLength=17,
    Version=1,
    Options=["/Aluminum_Polished", "/Battery", "/Charger_Chip", "/Copper_Polished", "/Foam_B02_Black_40cm", "/Gold_10k", "/Graphite", "/Gyroscope", "/Plane", "/Raspberry_Board", "/Raspberry_Chip", "/Resistors", "/Ribbon", "/Shield", "/Shield_Lock", "/Silver_Polished", "/UPS"])
mtl_name_19 = VRayMaterialFromProject(
    "/Ribbon",
    Has_Extract_Parameter=True,
    Has_Manage_Collection=False,
    OptionsLength=17,
    Version=1,
    Options=["/Aluminum_Polished", "/Battery", "/Charger_Chip", "/Copper_Polished", "/Foam_B02_Black_40cm", "/Gold_10k", "/Graphite", "/Gyroscope", "/Plane", "/Raspberry_Board", "/Raspberry_Chip", "/Resistors", "/Ribbon", "/Shield", "/Shield_Lock", "/Silver_Polished", "/UPS"])
mtl_name_20 = VRayMaterialFromProject(
    "/Shield_Lock",
    Has_Extract_Parameter=True,
    Has_Manage_Collection=False,
    OptionsLength=17,
    Version=1,
    Options=["/Aluminum_Polished", "/Battery", "/Charger_Chip", "/Copper_Polished", "/Foam_B02_Black_40cm", "/Gold_10k", "/Graphite", "/Gyroscope", "/Plane", "/Raspberry_Board", "/Raspberry_Chip", "/Resistors", "/Ribbon", "/Shield", "/Shield_Lock", "/Silver_Polished", "/UPS"])
vgeo_20 = VRayGeometry(Geo=flatten(cluster_26.A), Material=mtl_name_18, Visible=True, quality=0)
vgeo_21 = VRayGeometry(Geo=flatten(cluster_24), Material=mtl_name_19, Visible=True, quality=0)
vgeo_22 = VRayGeometry(Geo=flatten(cluster_25), Material=mtl_name_20, Visible=True, quality=0)
mtl_preset_4 = VRayMaterialPreset(Preset=1, MaterialBaseColorOrTexture=ColourSwatch(SwatchColor=RGB(35, 39, 46)))
vgeo_23 = VRayGeometry(Geo=flatten(cluster_26.B_2), Material=mtl_preset_4, Visible=True, quality=0)
merge_6 = Merge(Data1=vgeo_20, Data2=vgeo_23, Data3=vgeo_21, Data4=vgeo_22)

mesh = Mesh(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)
mesh_2 = Mesh(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)
mesh_3 = Mesh(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)
cluster_27 = Cluster_2(N="Body Pins")
swatch = ColourSwatch(SwatchColor=RGB(237, 237, 237))
swatch_2 = ColourSwatch(SwatchColor=RGB(115, 4, 143))
mtl_name_21 = VRayMaterialFromProject(
    "/Silver_Polished",
    Has_Extract_Parameter=True,
    Has_Manage_Collection=False,
    OptionsLength=17,
    Version=1,
    Options=["/Aluminum_Polished", "/Battery", "/Charger_Chip", "/Copper_Polished", "/Foam_B02_Black_40cm", "/Gold_10k", "/Graphite", "/Gyroscope", "/Plane", "/Raspberry_Board", "/Raspberry_Chip", "/Resistors", "/Ribbon", "/Shield", "/Shield_Lock", "/Silver_Polished", "/UPS"])
mtl_simple = VRayMaterialSimple(
    Diffuse=ColourSwatch(SwatchColor=RGB(255, 255, 255)),
    Reflection={AColor2=[0.5372549295, 0.5372549295, 0.5372549295, 1], FileName="", Float=0, State=2},
    Glossiness=Slider(0.5, range=0..1),
    IOR=1.3,
    Opacity=Slider(0.27, range=0..1),
    Emission=ColourSwatch(SwatchColor=RGB(255, 255, 255)))
mtl_simple_2 = VRayMaterialSimple(
    Diffuse=ColourSwatch(SwatchColor=RGB(38, 38, 38)),
    Reflection={AColor2=[0.5372549295, 0.5372549295, 0.5372549295, 1], FileName="", Float=0, State=2},
    Glossiness=Slider(0.34, range=0..1),
    IOR=1.3,
    Opacity={AColor2=[0, 0, 0, 0], FileName="", Float=1, State=4},
    Emission={AColor2=[0, 0, 0, 1], FileName="", Float=0, State=2})
mesh_4 = Mesh(flatten(cluster_27))
vgeo_24 = VRayGeometry(Geo=flatten(mesh_4), Material=mtl_name_21, Visible=True, quality=0)
vgeo_25 = VRayGeometry(Visible=True, quality=0)
vgeo_26 = VRayGeometry(Visible=True, quality=0)
swatch_3 = ColourSwatch(SwatchColor=RGB(38, 38, 38))
merge_7 = Merge(Data1=merge_6, Data2=merge_5, Data3=merge_2, Data4=merge_4, Data5=merge_3, Data6=merge)
mtl_simple_3 = VRayMaterialSimple(
    Diffuse=swatch_3,
    Reflection={AColor2=[0.5372549295, 0.5372549295, 0.5372549295, 1], FileName="", Float=0, State=2},
    Glossiness=Slider(0.59, range=0..1),
    IOR=1.3,
    Opacity={AColor2=[0, 0, 0, 0], FileName="", Float=1, State=4},
    Emission={AColor2=[0, 0, 0, 1], FileName="", Float=0, State=2})
pt_2 = Point(Point(-139.7767964, 278.2286827, 144.3000364))
target = Target(Point(0.7936192167, -0.3831853534, 59.82206872))
sampler = Sampler(
    0,
    Has_Extract_Parameter=False,
    Has_Manage_Collection=False,
    OptionsLength=2,
    Version=1,
    Options=["Progressive", "Bucket"])
out_img = OutputImage(
    File_Picker=1,
    File_Types="Portable Network Graphics (*.png)|*.png|Windows bitmap (*.bmp)|*.bmp|Targa Image (*.tga)|*.tga|Radiance High-Dynamyc Range (*.hdr)|*.hdr|Silicon Graphics (*.sgi; *.rgb; *.rgba)|*.sgi;*.rgb;*.rgba|JPEG image (*.jpg; *.jpeg)|*.jpg;*.jpeg|OpenEXR image (*.exr)|*.exr|SoftImage PICT (*.pic)|*.pic|Tagged image (*.tif; *.tiff)|*.tif;*.tiff|Tiled mipmapped image file (*.tx)|*.tx|V-Ray Raw Image (*.vrimg)|*.vrimg",
    Multiple_Files=False)
panel_3 = Panel("""900
900""")
quality = Quality(
    2,
    Has_Extract_Parameter=False,
    Has_Manage_Collection=False,
    OptionsLength=6,
    Version=1,
    Options=["Low", "Low+", "Medium", "Medium+", "High", "High+"])
engine = Engine(0, Has_Extract_Parameter=False, Has_Manage_Collection=False, OptionsLength=3, Version=1, Options=["CPU", "CUDA", "RTX"])
mode = Mode(
    0,
    Has_Extract_Parameter=False,
    Has_Manage_Collection=False,
    OptionsLength=2,
    Version=1,
    Options=["Interactive", "Production"])
rotate = Rotate(Geometry=pt_2, Angle=1.570796327, Plane=target)  # -> Geometry, Transform
inf_plane = VRayInfinitePlane(Mtl=mtl_simple_3, ShadowCatcherOn=False, ZOffset=0, PositionFromGeometry=True)
environment = VRayEnvironment(Background=swatch_3, GlobalIllumination=ColourSwatch(SwatchColor=RGB(255, 255, 255)))
light_dome = VRayDomeLight(
    On=True,
    Invisible=True,
    Texture={AColor2=[1, 1, 1, 1], FileName="", Float=0, State=2},
    Intensity=Slider(1.654, range=0..10),
    BasePlane=PlaneXY(0, 0, 0))
camera = VRayCamera(
    Type=0,
    Stereo=0,
    Position=rotate.Geometry,
    Target=target,
    FOV=27.1566906,
    Tilt=0,
    OrthographicZoomFactor=0,
    PhysicalExposureOn=False,
    WhiteBalance=RGB(255, 255, 255),
    FNumber=8,
    ShutterSpeed1S=100,
    FilmSensitivity=625,
    AutoExposure=False,
    AutoWhiteBalance=False,
    DepthOfFieldFocus=0)  # -> Camera, Angle, ExposureValue
render = VRayRender(
    Engine=engine,
    Mode=mode,
    Sampler=sampler,
    Quality=quality,
    OutputImage=out_img,
    OutputResolution=panel_3,
    Camera=camera.Camera,
    Light=flatten(light_dome),
    VGeometry=flatten([merge_7, inf_plane]),
    Environment=environment,
    UpdateEffectsFrequency=Slider(0, range=0..100))

# ==== cluster Cluster
B = ClusterInput()
debrep = DeconstructBrep(Brep=B)  # -> Faces, Edges, Vertices
area = Area(Geometry=debrep.Faces)  # -> Area, Centroid
sort = SortList(Keys=area.Area, ValuesA=debrep.Faces)  # -> Keys, reverse(ValuesA)
split = SplitList(List=sort.ValuesA, Index=2)  # -> ListA, ListB
A = ClusterOutput(split.ListA)
B_2 = ClusterOutput(split.ListB)

# ==== cluster Cluster_2
N = ClusterInput()
block_definition = QueryModelBlockDefinitions(Name=N, AutoUpdateState=True)
T = ClusterInput()
block_instance = ModelBlockInstance(Transform=T, BlockDefinition=block_definition)  # -> BlockInstance, Transform, BlockDefinition
explode = ExplodeObject(Object=block_instance.BlockInstance, Recursive=False)
O = ClusterOutput(explode)
