# Grasshopper definition HU3.ghx (Grasshopper 1.0.8)
# Copyright: 2024
# plug-ins: RhinoCodePluginGH, V-Ray For Grasshopper 8, SurfacePlus, Nautilus

# HU3
number_slider = Slider(30, range=0..100)

number_slider_2 = Slider(113, range=0..1000)
number_slider_3 = Slider(14, range=0..100)
number_slider_4 = Slider(0.41, range=0..1)

galapagos = Galapagos(fitness=volume, gene=number_slider_4)
num = Number([0, 11.41071135, 40.67260475, 72.0025069, 92.0063007, 111.7003255])
merge = Merge(
    Data1=number_slider,
    Data2=Slider(35, range=0..100),
    Data3=Slider(35, range=0..100),
    Data4=Slider(25, range=0..100),
    Data5=Slider(12.46, range=0..100),
    Data6=Slider(7.5, range=0..100))
range = Range(Domain=Domain(0, 1), Steps=number_slider_3)
pt = ConstructPoint(XCoordinate=merge, YCoordinate=0, ZCoordinate=num)
pt_2 = Point([Point(26.76, 0, 0), Point(31.37, 0, 11.41071135), Point(28.83118377, 0, 50.956483), Point(19.29, 0, 76.72558367), Point(10.91150555, 0, 92.0063007), Point(7.5, 0, 111.7003255)])
graph = GraphMapper(range, x0=0, x1=1, y0=0, y1=1, container_name="Bezier", cpx=[0, 0.282954812, 0.6886360645, 1], cpy=[0, 0, 1, 1])
graph_2 = GraphMapper(range, x0=0, x1=1, y0=0, y1=1, container_name="Bezier", cpx=[0, 0.25, 0.75, 1], cpy=[0, 0.25, 0.75, 1])
yz = YZPlane(Origin=Point(0, 0, 0))
nurbs = NurbsCurve(Vertices=pt, Degree=3, Periodic=False)  # -> Curve, Length, Domain

end = EndPoints(Curve=nurbs.Curve)  # -> Start, End
item = ListItem(List=end.End, Index=0, Wrap=True)
pdecon = Deconstruct(Point=item)  # -> XComponent, YComponent, ZComponent

mirror = Mirror(Geometry=nurbs.Curve, Plane=yz)  # -> Geometry, Transform
c_script = CSharpScript(y=Slider(10, range=0..100), z=pdecon.ZComponent, Mt=Slider(0.428, range=0..1), T=Slider(7.241, range=0..100), t=graph_2)  # -> A, F; inputs x: Double, y: Double, z: Double, Mt: Double, T: Double, t: list of Double
# ---------- c_script: C# ----------
// Grasshopper Script Instance
#region Usings
using System;
using System.Linq;
using System.Collections;
using System.Collections.Generic;
using System.Drawing;

using Rhino;
using Rhino.Geometry;

using Grasshopper;
using Grasshopper.Kernel;
using Grasshopper.Kernel.Data;
using Grasshopper.Kernel.Types;
#endregion

public class Script_Instance : GH_ScriptInstance
{
    #region Notes
    /* 
      Members:
        RhinoDoc RhinoDocument
        GH_Document GrasshopperDocument
        IGH_Component Component
        int Iteration

      Methods (Virtual & overridable):
        Print(string text)
        Print(string format, params object[] args)
        Reflect(object obj)
        Reflect(object obj, string method_name)
    */
    #endregion

    private void RunScript(
	double x,
	double y,
	double z,
	double Mt,
	double T,
	List<double> t,
	ref object A,
	ref object F)
    {
        Point3d pt1 = Point3d.Origin;
        Point3d pt2 = new Point3d(0, y, z);
        Line ln = new Line(pt1, pt2);
        Point3d mid = ln.PointAt(Mt);
        Vector3d vec = new Vector3d(0, -T, 0);
        mid += vec;
        Arc arc = new Arc(pt1, mid, pt2);
        A = arc;
        
        List<Plane> frame = new List<Plane>();
        Curve crv = arc.ToNurbsCurve();
        Interval intv = new Interval(0, 1);
        crv.Domain = intv;
        foreach (var item in t)
        {
            Plane pl = new Plane(crv.PointAt(item), crv.TangentAt(item));
            frame.Add(pl);
        }
        F = frame;

    }
}
# ---------- end c_script ----------
X = UnitX(Factor=1)
pframe = PerpFrame(Curve=reparameterize(c_script.A), Parameter=number_slider_4)
align = AlignPlane(Plane=c_script.F, Direction=X)  # -> Plane, Angle
pln = Plane(PlaneXY(0, 0, 0))
replace = ReplaceItems(List=align.Plane, Item=pln, Indices=0, Wrap=False)
chamfer_start = Slider(7.83, range=0..100)
chamfer_end = Slider(4.5, range=0..100)

length_width_end = Slider(15, range=0..100)
width_start = Slider(28, range=0..100)
dom = ConstructDomain(DomainStart=width_start, DomainEnd=length_width_end)
range_2 = Range(Domain=Domain(1, 0), Steps=number_slider_3)
graph_3 = GraphMapper(range_2, x0=0, x1=1, y0=0, y1=1, container_name="Bezier", cpx=[0, 0.25, 0.75, 1], cpy=[0, 0.25, 0.75, 1])
cluster = Cluster(C=nurbs.Curve, P=replace)
remap = RemapNumbers(Value=graph_3, Source=Domain(1, 0), Target=dom)  # -> Mapped, Clipped

remap_2 = RemapNumbers(Value=Slider(0, range=0..1), Source=Domain(0, 1), Target=number_slider_3)  # -> Mapped, Clipped
range_max_position = CSharpScript(steps=number_slider_3, maxPosition=remap_2.Mapped)  # -> R; inputs steps: Int32, maxPosition: Int32
# ---------- range_max_position: C# ----------
// Grasshopper Script Instance
#region Usings
using System;
using System.Linq;
using System.Collections;
using System.Collections.Generic;
using System.Drawing;

using Rhino;
using Rhino.Geometry;

using Grasshopper;
using Grasshopper.Kernel;
using Grasshopper.Kernel.Data;
using Grasshopper.Kernel.Types;
#endregion

public class Script_Instance : GH_ScriptInstance
{
    #region Notes
    /* 
      Members:
        RhinoDoc RhinoDocument
        GH_Document GrasshopperDocument
        IGH_Component Component
        int Iteration

      Methods (Virtual & overridable):
        Print(string text)
        Print(string format, params object[] args)
        Reflect(object obj)
        Reflect(object obj, string method_name)
    */
    #endregion

    private void RunScript(int steps, int maxPosition, ref object R)
    {
            
        if (maxPosition == null){
            maxPosition = steps;
        }

        float[] floatRange = GenerateFloatRange(steps, maxPosition);
        
        // Print the resulting array
        R = floatRange;


        static float[] GenerateFloatRange(int steps, int maxPosition)
        {
            steps++;
            
            if (maxPosition < 0 || maxPosition >= steps)
            {
                throw new ArgumentException("maxPosition should be between 0 and steps - 1");
            }

            // Create arrays for the two parts: before and after the maximum
            float[] rangeBeforeMax = Linspace(0, 1, maxPosition + 1);
            float[] rangeAfterMax = Linspace(1, 0, steps - maxPosition);

            // Concatenate them into a single array
            float[] result = new float[steps];
            Array.Copy(rangeBeforeMax, 0, result, 0, maxPosition);
            Array.Copy(rangeAfterMax, 0, result, maxPosition, steps - maxPosition);

            return result;
        }

        static float[] Linspace(float start, float end, int num)
        {
            float[] result = new float[num];
            float step = (end - start) / (num - 1);

            for (int i = 0; i < num; i++)
            {
                result[i] = start + step * i;
            }

            return result;
        }
    }
}
# ---------- end range_max_position ----------
graph_4 = GraphMapper(range_max_position, x0=0, x1=1, y0=0, y1=1, container_name="Bezier", cpx=[0, 0.25, 0.75, 1], cpy=[0, 0.25, 0.75, 1])

chamfer_start_2 = Slider(7.83, range=0..100)
chamfer_end_2 = Slider(4.5, range=0..100)
dom_2 = ConstructDomain(DomainStart=chamfer_start_2, DomainEnd=chamfer_end_2)
range_3 = Range(Domain=dom_2, Steps=number_slider_3)

inner_convexity = Slider(0, range=0..100)
range_4 = Range(Domain=Domain(1, 0), Steps=number_slider_3)
graph_5 = GraphMapper(range_4, x0=0, x1=1, y0=0, y1=1, container_name="Gaussian", factor=0.3271082044, mean=0.8393554688, sdev=0.1327042878)
dom_3 = ConstructDomain(DomainStart=inner_convexity, DomainEnd=0)
remap_3 = RemapNumbers(Value=graph_5, Source=Domain(1, 0), Target=dom_3)  # -> Mapped, Clipped

bend = Slider(3, range=0..100)
y_segements = Slider(2, range=1..10)
x_segements = Slider(4, range=1..100)

parabola = Python3Script(N=x_segements, D="1", Inv="1")  # -> R; inputs N: Int32, D: Int32, Inv: Boolean
#   port N: Number of steps
#   port D: 0 = (0 To 1) 1 = (-1 To 1)
# ---------- parabola: Python ----------
if not N:
    N = 10

types = [(0, 1),
         (-1, 1)]
R = []
start, end = types[D]
diff = end - start
step = diff / N
N += 1
for i in range(N):
    f = (start + i * step) ** 2
    if Inv:
        R.append(end - f)
    else:
        R.append(f)
# ---------- end parabola ----------
range_5 = Range(Domain=Domain(0, 1), Steps=x_segements)
graph_6 = GraphMapper(range_5, x0=0, x1=1, y0=0, y1=1, container_name="Gaussian", factor=0.4075372815, mean=0.472511977, sdev=0.165032953)

panel = Panel(graph_4)
entwine = Entwine(
    Branch00=replace,
    Branch01=cluster,
    Branch02=remap.Mapped,
    Branch03=x_segements,
    Branch04=y_segements,
    Branch05=bend,
    Branch06=panel,
    Branch07=range_3,
    Branch08=remap_3.Mapped,
    Branch09=graph_6,
    FlattenInputs=True)
data = Data(Tree({0;0}: [Plane(origin=(0, 0, 0), x=(1, 0, 0), y=(0, 0.9804661629, 0.1966878324)), Plane(origin=(0, -1.494997322, 8.689930715), x=(1, 0, 0), y=(0, 0.9898268505, 0.1422772153)), Plane(origin=(0, -2.515470139, 17.53302671), x=(1, 0, 0), y=(0, 0.9962163785, 0.08690757818)), Plane(origin=(0, -3.043878198, 26.49063226), x=(1, 0, 0), y=(0, 0.9995249214, 0.03082095772)), Plane(origin=(0, -3.066894892, 35.5217267), x=(1, 0, 0), y=(0, 0.9996690368, -0.02572580169)), Plane(origin=(0, -2.575778157, 44.58350494), x=(1, 0, 0), y=(0, 0.9965939876, -0.08246468285))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], {0;1}: [35.31258663, 39.59646656, 40.73826958, 39.86080129, 37.67848529, 34.77254169, 31.41420164, 27.73386515, 23.93086093, 20.20622496, 16.76983799, 13.75268433, 11.18881197, 9.059876224, 7.323962904], {0;2}: [25, 24.28571429, 23.57142857, 22.85714286, 22.14285714, 21.42857143, 20.71428571, 20, 19.28571429, 18.57142857, 17.85714286, 17.14285714, 16.42857143, 15.71428571, 15], {0;3}: [4], {0;4}: [2], {0;5}: [12], {0;6}: ["1", "0.928571", "0.857143", "0.785714", "0.714286", "0.642857", "0.571429", "0.5", "0.428571", "0.357143", "0.285714", "0.214286", "0.142857", "0.071429", "0"], {0;7}: [7.83, 7.592142857, 7.354285714, 7.116428571, 6.878571429, 6.640714286, 6.402857143, 6.165, 5.927142857, 5.689285714, 5.451428571, 5.213571429, 4.975714286, 4.737857143, 4.5], {0;8}: [1.135961398, 3.446738398, 7.827634987, 13.30547256, 16.9280735, 16.11989701, 11.4893242, 6.129205746, 2.447323669, 0.7314019523, 0.1636056564, 0.02739163831, 0.003432536759, 0.000321951075, 2.260174948e-05], {0;9}: [0.01634671329, 0.3969711107, 0.9715888693, 0.2396631872, 0.005958203078]))
bang = ExplodeTree(Data=entwine)  # -> Branch0, Branch1, Branch2, Branch3, Branch4, Branch5, Branch6, Branch7, Branch8, Branch9

crv = Curve([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])
join = JoinCurves(Curves=crv, Preserve=False)
explode = Explode(Curve=join, Recursive=True)  # -> Segments, Vertices
panel_2 = Panel("""38
39""")
end_2 = EndPoints(Curve=explode.Segments)  # -> Start, End
item_2 = ListItem(List=explode.Segments, Index=panel_2, Wrap=True)
shift = ShiftList(List=explode.Segments, Shift=1, Wrap=True)
vec2pt = Vector2Pt(PointA=end_2.Start, PointB=end_2.End, Unitize=False)  # -> Vector, Length
number_slider_5 = Slider(2, range=0..100)
item_3 = ListItem(List=item_2, Index=0, Wrap=True)  # -> Item, Item1
weave = Weave(Pattern=[0, 1], Stream0=graft(explode.Segments), Stream1=graft(shift), NullGaps=False)
end_3 = EndPoints(Curve=item_3.Item1)  # -> Start, End
shift_2 = ShiftList(List=vec2pt.Vector, Shift=1, Wrap=True)
end_4 = EndPoints(Curve=item_3.Item)  # -> Start, End
rev = Reverse(Vector=shift_2)
branch = TreeBranch(Tree=simplify(weave), Path=number_slider_5, MaintainPaths=True)
vec2pt_2 = Vector2Pt(PointA=end_4.End, PointB=end_4.Start, Unitize=False)  # -> Vector, Length
vec2pt_3 = Vector2Pt(PointA=end_3.Start, PointB=end_3.End, Unitize=False)  # -> Vector, Length
weave_2 = Weave(Pattern=[0, 1], Stream0=graft(vec2pt.Vector), Stream1=graft(shift_2), NullGaps=False)
rad = Radians(Degrees=Slider(80, range=0..360))
join_2 = JoinCurves(Curves=branch, Preserve=False)
disc = Discontinuity(Curve=join_2, Level=1)  # -> Points, Parameters
vdis = VectorDisplay(Anchor=end_4.End, Vector=vec2pt_3.Vector)
vdis_2 = VectorDisplay(Anchor=end_4.End, Vector=vec2pt_2.Vector)
branch_2 = TreeBranch(Tree=simplify(weave_2), Path=number_slider_5, MaintainPaths=True)
item_4 = ListItem(List=disc.Points, Index=1, Wrap=True)
c_script_2 = CSharpScript()  # -> angle, dotprod; inputs x: Vector3d, y: Vector3d, T: Double
# ---------- c_script_2: C# ----------
// Grasshopper Script Instance
#region Usings
using System;
using System.Linq;
using System.Collections;
using System.Collections.Generic;
using System.Drawing;

using Rhino;
using Rhino.Geometry;

using Grasshopper;
using Grasshopper.Kernel;
using Grasshopper.Kernel.Data;
using Grasshopper.Kernel.Types;
#endregion

public class Script_Instance : GH_ScriptInstance
{
    private void RunScript(
	Vector3d x,
	Vector3d y,
	double T,
	ref object angle,
	ref object dotprod)
    {
        // Write your logic here
        double vdp = Vector3d.VectorAngle(x,y);
        int isParallel = x.IsParallelTo(y, T);
        angle = vdp;
        dotprod = isParallel;
    }
}
# ---------- end c_script_2 ----------
c_script_3 = CSharpScript(x=vec2pt_2.Vector, y=vec2pt_3.Vector, T=rad)  # -> angle, Parallel, dotProd; inputs x: Vector3d, y: Vector3d, T: Double
# ---------- c_script_3: C# ----------
// Grasshopper Script Instance
#region Usings
using System;
using System.Linq;
using System.Collections;
using System.Collections.Generic;
using System.Drawing;
using System.Numerics;

using Rhino;
using Rhino.Geometry;

using Grasshopper;
using Grasshopper.Kernel;
using Grasshopper.Kernel.Data;
using Grasshopper.Kernel.Types;
#endregion

public class Script_Instance : GH_ScriptInstance
{
    private void RunScript(
	Vector3d x,
	Vector3d y,
	double T,
	ref object angle,
	ref object Parallel,
	ref object dotProd)
    {
        // Write your logic here
        double vdp = Vector3d.VectorAngle(x,y);
        int isParallel = x.IsParallelTo(y, T);
        angle = vdp;
        Parallel = isParallel;
        var vector1 = new Vector<double>(new double[] { 1.0, 2.0, 3.0, 4.0 });
        x.Unitize();
        y.Unitize();
        dotProd = (x.X * y.X) + (x.Y * y.Y) + (x.Z * y.Z);
        
    }
}
# ---------- end c_script_3 ----------
rad_2 = Radians(Degrees=Slider(90, range=0..360))
item_5 = ListItem(List=branch_2, Index=0, Wrap=True)  # -> Item, Item1
item_6 = ListItem(List=weave_2, Index=0, Wrap=True)  # -> Item, Item1
deg = Degrees(Radians=c_script_3.angle)
panel_3 = Panel(c_script_3.dotProd)
panel_4 = Panel(deg)
c_script_4 = CSharpScript(x=item_5.Item, y=item_5.Item1, T=rad_2)  # -> angle, Parallel, dotProd; inputs x: Vector3d, y: Vector3d, T: Double; same code as c_script_3
panel_5 = Panel(c_script_4.dotProd)
c_script_5 = CSharpScript(x=[item_5.Item, item_6.Item], y=[item_5.Item1, item_6.Item1], T=rad_2)  # -> flatten(angle), Parallel, flatten(dotProd); inputs x: Vector3d, y: Vector3d, T: Double; same code as c_script_3
vdis_3 = VectorDisplay(Anchor=item_4, Vector=branch_2)
deg_2 = Degrees(Radians=c_script_4.angle)
panel_6 = Panel(deg_2)
deg_3 = Degrees(Radians=c_script_5.angle)
panel_7 = Panel(deg_3)
panel_8 = Panel(c_script_5.dotProd)

number_slider_6 = Slider(1.254, range=0..10)
crv_2 = Curve([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])
end_5 = EndPoints(Curve=crv_2)  # -> Start, End
item_7 = ListItem(List=crv_2, Index=0, Wrap=True)
eval = EvaluateCurve(Curve=reparameterize(crv_2), Parameter=Slider(1, range=0..1))  # -> Point, Tangent, Angle
item_8 = ListItem(List=end_5.Start, Index=0, Wrap=True)
vec2pt_4 = Vector2Pt(PointA=eval.Point, PointB=item_8, Unitize=False)  # -> unitize(Vector), Length
ln = Line(StartPoint=item_8, EndPoint=eval.Point)
dprod = DotProduct(VectorA=item_7, VectorB=vec2pt_4.Vector, Unitize=False)
item_9 = ListItem(List=ln, Index=0, Wrap=True)  # -> Item, Item1, Item2, Item3
panel_9 = Panel(dprod)
series = Series(Start=0, Step=1, Count=Slider(3, range=0..100))
number_slider_7 = Slider(100, range=0..100)
swatch = ColourSwatch(SwatchColor=RGB(237, 237, 237))
timeline = VRayTimeline(FramesCount=number_slider_7, RangeStart=Slider(54, range=0..100), RangeEnd=expr("x-1", number_slider_7))  # -> Timeline, CurrentFrame, CurrentFraction
pi = Pi(Factor=expr("x*2", timeline.CurrentFraction))
mtl_name = VRayMaterialFromProject(Has_Extract_Parameter=True, Has_Manage_Collection=False, OptionsLength=0, Version=1)
pt_3 = Point(Point(-139.7767964, 278.2286827, 144.3000364))
pt_4 = Point(Point(-314.7917911, 119.2242372, 145.6343371))
number_slider_8 = Slider(11, range=0..100)
out_img = OutputImage(
    "G:\#Design\3D Modeling\Hugad\render\HU2\05\Graphite.png",
    File_Picker=1,
    File_Types="Portable Network Graphics (*.png)|*.png|Windows bitmap (*.bmp)|*.bmp|Targa Image (*.tga)|*.tga|Radiance High-Dynamyc Range (*.hdr)|*.hdr|Silicon Graphics (*.sgi; *.rgb; *.rgba)|*.sgi;*.rgb;*.rgba|JPEG image (*.jpg; *.jpeg)|*.jpg;*.jpeg|OpenEXR image (*.exr)|*.exr|SoftImage PICT (*.pic)|*.pic|Tagged image (*.tif; *.tiff)|*.tif;*.tiff|Tiled mipmapped image file (*.tx)|*.tx|V-Ray Raw Image (*.vrimg)|*.vrimg",
    Multiple_Files=False)
engine = Engine(
    1,
    Has_Extract_Parameter=False,
    Has_Manage_Collection=False,
    OptionsLength=3,
    Version=1,
    Options=["V-Ray Denoiser", "NVIDIA AI Denoiser", "Intel Open Image Denoiser"])
preset = Preset(
    1,
    Has_Extract_Parameter=False,
    Has_Manage_Collection=False,
    OptionsLength=3,
    Version=1,
    Options=["Mild", "Default", "Strong"])
mode = Mode(
    2,
    Has_Extract_Parameter=False,
    Has_Manage_Collection=False,
    OptionsLength=3,
    Version=1,
    Options=["Only Render Elements", "Hide Denoiser Channel", "Show Denoiser Channel"])
denoiser = VRayElementDenoiser(Engine=engine, Preset=preset, Mode=mode)

# ---- group: Body Profiles
hu_profile_polylines = CSharpScript(
    P=bang.Branch0,
    LR=bang.Branch1,
    WR=bang.Branch2,
    XS=bang.Branch3,
    YS=bang.Branch4,
    B=bang.Branch5,
    BG=bang.Branch6,
    Ch=bang.Branch7)  # -> Pln, O1, O2, S1, S2; inputs P: list of Plane, LR: list of Double, WR: list of Double, XS: Int32, YS: Int32, B: Double, BG: list of Double, Ch: list of Double
# ---------- hu_profile_polylines: C# ----------
// Grasshopper Script Instance
#region Usings
using System;
using System.Linq;
using System.Collections;
using System.Collections.Generic;
using System.Drawing;

using Rhino;
using Rhino.Geometry;

using Grasshopper;
using Grasshopper.Kernel;
using Grasshopper.Kernel.Data;
using Grasshopper.Kernel.Types;
#endregion

public class Script_Instance : GH_ScriptInstance
{
    #region Notes
    /* 
      Members:
        RhinoDoc RhinoDocument
        GH_Document GrasshopperDocument
        IGH_Component Component
        int Iteration

      Methods (Virtual & overridable):
        Print(string text)
        Print(string format, params object[] args)
        Reflect(object obj)
        Reflect(object obj, string method_name)
    */
    #endregion

    private void RunScript(
	List<Plane> P,
	List<double> LR,
	List<double> WR,
	int XS,
	int YS,
	double B,
	List<double> BG,
	List<double> Ch,
	ref object Pln,
	ref object O1,
	ref object O2,
	ref object S1,
	ref object S2)
    {
        // Generated collections
        List<Polyline> plns = new List<Polyline>();
        List<object> offset1 = new List<object>();
        List<object> offset2 = new List<object>();
        List<object> side1 = new List<object>();
        List<object> side2 = new List<object>();

        // Remap input numbers
        List<double> bgRemap = Utility.RemapList(BG, 0, B);

        // Calculate parabolic graph map --> Bend
        double[] para = Utility.Parabola(XS, true, true);
        for (int i = 0; i < para.Length; i++)
        {
            para[i] = -(1 - para[i]);
        }

        // Main loop ----------------------------------------------------------
        for (int i = 0; i < P.Count; i++)
        {
            // Calculations
            Point3d p1 = P[i].Origin + new Vector3d(-LR[i], 0, 0);
            Point3d p2 = P[i].Origin + new Vector3d(LR[i], 0, 0);
            double dist = p2.DistanceTo(p1);
            double div = dist / XS;
            
            Polyline pln = new Polyline();
            
            // Inner loop: Generate Polylines ------
            for (int j = 0; j <= XS; j++)
            {
                var pt = new Point3d(p1.X + (j * div), p1.Y, p1.Z);
                var vec = P[i].YAxis * bgRemap[i] * -para[j];
                pln.Add(pt + vec);
            } 
            // -------------------------------------


            var crv = pln.ToPolylineCurve();
            var off1 = crv.Offset(P[i], WR[i] / 2, 0.001, CurveOffsetCornerStyle.Sharp);
            var offSh1 = off1[0].Trim(CurveEnd.Both, Ch[i]); //Shrink for chamfer
            var off2 = crv.Offset(P[i], -WR[i] / 2, 0.001, CurveOffsetCornerStyle.Sharp);
            var offSh2 = off2[0].Trim(CurveEnd.Both, Ch[i]); //Shrink for chamfer
            
            var ln1 = new Line(off1[0].PointAtStart, off2[0].PointAtStart).ToNurbsCurve();
            var lnSh1 = ln1.Trim(CurveEnd.Both, Ch[i]); //Shrink for chamfer
            var ln2 = new Line(off1[0].PointAtEnd, off2[0].PointAtEnd).ToNurbsCurve();
            var lnSh2 = ln2.Trim(CurveEnd.Both, Ch[i]); //Shrink for chamfer

            



            
            // Add results
            offset1.Add(offSh1);
            offset2.Add(offSh2);
            side1.Add(lnSh1);
            side2.Add(lnSh2);
            plns.Add(pln);
            

        }
        // ---------------------------------------------------------------------
        
        Pln = plns;
        O1 = offset1;
        O2 = offset2;
        S1 = side1;
        S2 = side2;
        


        
    }


    public class Utility
    {
        public static List<double> RemapList(List<double> values, double newMin, double newMax)
        {
            if (values == null || values.Count == 0)
            {
                throw new ArgumentException("The list of values cannot be null or empty.");
            }

            // Find the original minimum and maximum values of the list
            double oldMin = values.Min();
            double oldMax = values.Max();

            // Check if the list has a constant value
            if (oldMin == oldMax)
            {
                return values.Select(_ => (newMin + newMax) / 2).ToList();
            }

            // Remap each value from the old domain [oldMin, oldMax] to the new domain [newMin, newMax]
            return values.Select(value => Remap(value, oldMin, oldMax, newMin, newMax)).ToList();
        }

        private static double Remap(double value, double oldMin, double oldMax, double newMin, double newMax)
        {
            return newMin + (value - oldMin) * (newMax - newMin) / (oldMax - oldMin);
        }

        public static double[] Parabola(int segments, bool type, bool invert)
        {
            double[] dom = {0, 1};
            if (type){
                dom[0] = -1;
                dom[1] = 1;
            }

            double step = (dom[1]-dom[0]) / segments;
            double[] result = new double[segments+1];

            for (int i = 0; i <= segments; i++)
            {
                double f = Math.Pow((dom[0] + i * step), 2);
                if (invert){
                    result[i] = (dom[1] - f);
                }
                else {
                    result[i] = f;
                }
            }
            return result;
        }


    }
}
# ---------- end hu_profile_polylines ----------
deplane = DeconstructPlane(Plane=bang.Branch0)  # -> Origin, XAxis, YAxis, ZAxis
multiplication = Multiplication(A=bang.Branch9, B=graft(bang.Branch8))
multiplication_2 = Multiplication(A=graft(deplane.YAxis), B=multiplication)
divide = DivideCurve(Curve=hu_profile_polylines.O2, Count=bang.Branch3, Kinks=False)  # -> reverse(Points), Tangents, Parameters
divide_2 = DivideCurve(Curve=hu_profile_polylines.O1, Count=bang.Branch3, Kinks=False)  # -> Points, Tangents, Parameters
divide_3 = DivideCurve(Curve=hu_profile_polylines.S2, Count=bang.Branch4, Kinks=False)  # -> Points, Tangents, Parameters
divide_4 = DivideCurve(Curve=hu_profile_polylines.S1, Count=bang.Branch4, Kinks=False)  # -> reverse(Points), Tangents, Parameters
group = Group(Objects=divide_4.Points)
group_2 = Group(Objects=divide_2.Points)
group_3 = Group(Objects=divide_3.Points)

# ---- group: Body Profiles / Inner Convexity
move = Move(Geometry=divide.Points, Motion=multiplication_2)  # -> Geometry, Transform

# ---- group: Body Profiles (continued)
group_4 = Group(Objects=move.Geometry)
weave_3 = Weave(Pattern=[0, 1, 2, 3], Stream0=group, Stream1=group_2, Stream2=group_3, Stream3=group_4, NullGaps=False)
ungroup = Ungroup(Group=weave_3)
pshift = ShiftPaths(Data=ungroup, Offset=-1)  # -> simplify(Data)

# ---- group: Profile Mesh
pline = PolyLine(Vertices=pshift, Closed=True)  # -> flatten(Polyline)
loft_mesh = Python3Script(S=pline)  # -> M; inputs S: list of Curve
# ---------- loft_mesh: Python ----------
"""Grasshopper Script Instance"""
import System
import Rhino
import Grasshopper

import Rhino.Geometry as rg
import rhinoscriptsyntax as rs
from math import ceil, pi
import ghpythonlib.components as gc


class MyComponent(Grasshopper.Kernel.GH_ScriptInstance):
    def RunScript(self, S: System.Collections.Generic.List[Rhino.Geometry.Curve]):
        
        M = rg.Mesh()
        for k in range(len(S)-1):

            pl1 = S[k].ToNurbsCurve().Points
            pts1 = []
            for j in range(pl1.Count):
                pts1.append(rg.Point3d(pl1[j].X, pl1[j].Y, pl1[j].Z))
            pl2 = S[k+1].ToNurbsCurve().Points
            pts2 = []
            for l in range(pl2.Count):
                pts2.append(rg.Point3d(pl2[l].X, pl2[l].Y, pl2[l].Z))   
            
            pts2.reverse()
            V = pts1 + pts2

            face_n = int((len(V)-2)/2)
            
            n = [i for i in range(len(V))]
            Faces = []
            for i in range(face_n):
                cb = '{}'
                ch = f'Q{cb[0]}{n[0]};{n[1]};{n[-2]};{n[-1]}{cb[1]}'
                Faces.append(ch)
                n.pop(-1)
                n.pop(0)
            
            mesh = gc.ConstructMesh(V, Faces)
            M.Append(mesh)
        M.Weld(pi)
        return M
# ---------- end loft_mesh ----------

# ----
geo = Geometry(pline)
explode_2 = Explode(Curve=geo, Recursive=True)  # -> Segments, Vertices
len = Length(Curve=explode_2.Segments)
subtraction = Subtraction(A=len, B=number_slider_6)

# ---- group: Top/Bottom Caps
tstat = TreeStatistics(Tree=weave_3)  # -> Paths, Length, Count
item_10 = ListItem(List=tstat.Paths, Index=0, Wrap=True)  # -> Item1, Item
branch_3 = TreeBranch(Tree=weave_3, Path=item_10.Item, MaintainPaths=True)
branch_4 = TreeBranch(Tree=weave_3, Path=item_10.Item1, MaintainPaths=True)
ungroup_2 = Ungroup(Group=branch_4)
ungroup_3 = Ungroup(Group=branch_3)
height = Slider(0, range=0..10)
height_2 = Slider(4, range=0..10)
cluster_2 = Cluster_4(pts=ungroup_2)
cluster_3 = Cluster_3(pts=ungroup_3)
neg = Negative(Value=height)
cluster_4 = Cluster_5(M=cluster_3, H=neg, descay=Slider(0, range=0..1))
cluster_5 = Cluster_5(M=cluster_2, H=height_2, descay=Slider(0.834, range=0..1))

# ----
dom_4 = ConstructDomain(DomainStart=number_slider_6, DomainEnd=subtraction)
subcrv = SubCurve(BaseCurve=explode_2.Segments, Domain=dom_4)

# ---- group: Body Geometry
mesh_join = CSharpScript(M=flatten([cluster_5, loft_mesh, cluster_4]))  # -> Mesh; inputs M: list of Mesh
# ---------- mesh_join: C# ----------
// Grasshopper Script Instance
#region Usings
using System;
using System.Linq;
using System.Collections;
using System.Collections.Generic;
using System.Drawing;

using Rhino;
using Rhino.Geometry;

using Grasshopper;
using Grasshopper.Kernel;
using Grasshopper.Kernel.Data;
using Grasshopper.Kernel.Types;
#endregion

public class Script_Instance : GH_ScriptInstance
{
    #region Notes
    /* 
      Members:
        RhinoDoc RhinoDocument
        GH_Document GrasshopperDocument
        IGH_Component Component
        int Iteration

      Methods (Virtual & overridable):
        Print(string text)
        Print(string format, params object[] args)
        Reflect(object obj)
        Reflect(object obj, string method_name)
    */
    #endregion

    private void RunScript(List<Mesh> M, ref object Mesh)
    {
        // Write your logic here
        Mesh m = new Mesh();
        foreach (var item in M)
        {
            m.Append(item);
        }
        m.Compact();
        m.Weld(Math.PI);
        m.UnifyNormals();
        Mesh = m;
    }
}
# ---------- end mesh_join ----------
subdmesh = SubDFromMesh(Mesh=mesh_join, Creases=1, Corners=1, Interpolate=False)
meshsubd = MeshFromSubD(SubD=subdmesh, Density=2)

# ---- group: Dimensions
bbox = BoundingBox(Content=subdmesh, Plane=pframe)  # -> Box, Box_2
edges = BrepEdges(Brep=bbox.Box)  # -> Naked, Interior, NonManifold
volume = Volume(Geometry=bbox.Box)  # -> Volume, Centroid
py3 = Python3Script(B=bbox.Box)  # -> pts, U, V, W; inputs B: Box
# ---------- py3: Python ----------
import Rhino.Geometry as rg
pts = B.GetCorners()
U = B.X[1] - B.X[0]
V = B.Y[1] - B.Y[0]
W = B.Z[1] - B.Z[0]
# ---------- end py3 ----------
item_11 = ListItem(List=py3.pts, Index=0, Wrap=True)  # -> Item, Item1, Item2, Item3, Item4
panel_10 = Panel(volume.Volume)
ln_2 = Line(StartPoint=item_11.Item, EndPoint=item_11.Item1)
ln_3 = Line(StartPoint=item_11.Item, EndPoint=item_11.Item4)
ln_4 = Line(StartPoint=item_11.Item1, EndPoint=item_11.Item2)

# ---- group: Body Pins
medges = MeshEdges(Mesh=mesh_join)  # -> NakedEdges, InteriorEdges, NonManifoldEdges
middle_polyline = Geometry(hu_profile_polylines.Pln)
cluster_6 = Cluster_11(
    offset_1=Slider(0, range=0..10),
    offset_2=Slider(0.86, range=0..10),
    profile_center=Slider(0.04, range=0..1),
    edges_pointat=Slider(0.5, range=0..1),
    middle_polyline=middle_polyline,
    edges=medges.InteriorEdges)  # -> C, L
index = ItemIndex(List=medges.InteriorEdges, Item=cluster_6.L)
item_12 = ListItem(List=index, Index=0, Wrap=True)
subdedges = SubDEdges(SubD=mesh_join, NewFormatting=False)  # -> Line, Edge, Tag, Id
mesh_edge_loop = CSharpScript(C=subdedges.Edge, indx=item_12)  # -> Pl, Ei; inputs M: Mesh, C: list of Curve, indx: Int32
# ---------- mesh_edge_loop: C# ----------
// Grasshopper Script Instance
#region Usings
using System;
using System.Linq;
using System.Collections;
using System.Collections.Generic;
using System.Drawing;

using Rhino;
using Rhino.Geometry;

using Grasshopper;
using Grasshopper.Kernel;
using Grasshopper.Kernel.Data;
using Grasshopper.Kernel.Types;
#endregion

public class Script_Instance : GH_ScriptInstance
{
    #region Notes
    /* 
      Members:
        RhinoDoc RhinoDocument
        GH_Document GrasshopperDocument
        IGH_Component Component
        int Iteration

      Methods (Virtual & overridable):
        Print(string text)
        Print(string format, params object[] args)
        Reflect(object obj)
        Reflect(object obj, string method_name)
    */
    #endregion

    private void RunScript(
	Mesh M,
	List<Curve> C,
	int indx,
	ref object Pl,
	ref object Ei)
    {
        // Write your logic here

        double t = this.RhinoDocument.ModelAbsoluteTolerance;
        if (M != null) {
            var topoEdge = M.TopologyEdges;
            List<Curve> Cb = new List<Curve>();
            for (int i = 0; i < topoEdge.Count; i++) {
                C.Add(topoEdge.EdgeLine(i).ToNurbsCurve());
            }
        }


        int n = C.Count;
        Point3d[] PS = new Point3d[n];
        Point3d[] PE = new Point3d[n];
        Vector3d[] TS = new Vector3d[n];
        Vector3d[] TE = new Vector3d[n];
        bool[] uS = new bool[n];
        bool[] uE = new bool[n];
        int[] iS = new int[n];
        int[] iE = new int[n];
        bool[] used = new bool[n];
        for(int i = 0; i < n; i++) {
            PS[i] = C[i].PointAtStart;
            PE[i] = C[i].PointAtEnd;
            TS[i] = C[i].TangentAtStart;
            TE[i] = C[i].TangentAtEnd;
            iS[i] = -1;
            iE[i] = -1;
            if(C[i].IsPeriodic){
                iS[i] = i;
                iE[i] = i;
            }
        }
        for(int i = 0;i < n;i++){
        for(int j = 0;j < n;j++){if(i != j){
            if(!uS[i] && !uS[j] && (PS[i].DistanceTo(PS[j]) < t) && (Math.Sin(Rhino.Geometry.Vector3d.VectorAngle(TS[i], TS[j])) < 0.001)){
                uS[i] = true; uS[j] = true; iS[i] = j; iS[j] = i;
            }
            if(!uS[i] && !uE[j] && (PS[i].DistanceTo(PE[j]) < t) && (Math.Sin(Rhino.Geometry.Vector3d.VectorAngle(TS[i], TE[j])) < 0.001)){
                uS[i] = true; uE[j] = true; iS[i] = j; iE[j] = i;
            }
            if(!uE[i] && !uS[j] && (PE[i].DistanceTo(PS[j]) < t) && (Math.Sin(Rhino.Geometry.Vector3d.VectorAngle(TE[i], TS[j])) < 0.001)){
                uE[i] = true; uS[j] = true; iE[i] = j; iS[j] = i;
            }
            if(!uE[i] && !uE[j] && (PE[i].DistanceTo(PE[j]) < t) && (Math.Sin(Rhino.Geometry.Vector3d.VectorAngle(TE[i], TE[j])) < 0.001)){
                uE[i] = true; uE[j] = true; iE[i] = j; iE[j] = i;
            }
            }}
        }
        Grasshopper.DataTree<int> tree = new Grasshopper.DataTree<int>();
        int loop = 0;
        int curr = 0;
        int old = -1;
        for(int i = 0;i < n;i++){
        curr = i;
        if(!used[curr]){
            tree.Add(curr, new GH_Path(loop));
            used[curr] = true;

            if(!uS[curr] && !uE[curr]){
            loop++;
            continue;
            }
            if(uE[curr]){
            for(int k = 0;k < 100;k++){
                if(uE[curr] && (iE[curr] != old) && (iE[curr] != i) && !used[iE[curr]]){
                old = curr;
                curr = iE[curr];
                tree.Add(curr, new GH_Path(loop));
                used[curr] = true;
                }else if(uS[curr] && (iS[curr] != old) && (iS[curr] != i) && !used[iS[curr]]){
                old = curr;
                curr = iS[curr];
                tree.Add(curr, new GH_Path(loop));
                used[curr] = true;
                }else{break;}
            }
            }
            old = -1;
            curr = i;
            if(uS[curr]){
            for(int k = 0;k < 100;k++){
                if(uE[curr] && (iE[curr] != old) && (iE[curr] != i) && !used[iE[curr]]){
                old = curr;
                curr = iE[curr];
                tree.Add(curr, new GH_Path(loop));
                used[curr] = true;
                }else if(uS[curr] && (iS[curr] != old) && (iS[curr] != i) && !used[iS[curr]]){
                old = curr;
                curr = iS[curr];
                tree.Add(curr, new GH_Path(loop));
                used[curr] = true;
                }else{break;}
            }
            }
            loop++;
        }
        }
        
        List<int> indexList = new List<int>();
        for(int p = 0; p < tree.BranchCount; p++){
            List<int> list = tree.Branch(p);
            foreach(int a in list){
            if(a == indx){indexList = list;break;}
        }
        }
        Ei = indexList;
        List<object> pl = new List<object>();
        foreach (var index in indexList) {
            pl.Add(C[index]);
        }
        Pl = pl;
    }
}
# ---------- end mesh_edge_loop ----------
edgesloopangle = EdgesLoopWithAngle(Mesh=mesh_join, EdgeIndex=item_12, LimitAngleDegree=90, Self=True, Number=10000)  # -> Polyline, EdgeIndexes, VertexIndexes
panel_11 = Panel(edgesloopangle.EdgeIndexes)
c_script_6 = CSharpScript(M=mesh_join, i=mesh_edge_loop.Ei)  # -> out, a; inputs M: Mesh, i: list of Int32
# ---------- c_script_6: C# ----------
// Grasshopper Script Instance
#region Usings
using System;
using System.Linq;
using System.Collections;
using System.Collections.Generic;
using System.Drawing;

using Rhino;
using Rhino.Geometry;

using Grasshopper;
using Grasshopper.Kernel;
using Grasshopper.Kernel.Data;
using Grasshopper.Kernel.Types;
#endregion

public class Script_Instance : GH_ScriptInstance
{
    #region Notes
    /* 
      Members:
        RhinoDoc RhinoDocument
        GH_Document GrasshopperDocument
        IGH_Component Component
        int Iteration

      Methods (Virtual & overridable):
        Print(string text)
        Print(string format, params object[] args)
        Reflect(object obj)
        Reflect(object obj, string method_name)
    */
    #endregion

    private void RunScript(Mesh M, List<int> i, ref object a)
    {
        // Write your logic here
        var top = M.TopologyEdges;
        M.UnweldEdge(i, false);
        var meshes = M.ExplodeAtUnweldedEdges();
        a = meshes;
    }
}
# ---------- end c_script_6 ----------
panel_12 = Panel(mesh_edge_loop.Ei)
item_13 = ListItem(List=c_script_6.a, Index=0, Wrap=True)
subdmesh_2 = SubDFromMesh(Mesh=item_13, Creases=1, Corners=1, Interpolate=False)
tip_hemisphere_scale = Slider(0.1, range=0..1)
edge_margin = Slider(7.64, range=0..10)
top_offset = Slider(0.084, range=0..100)
rows = Slider(7, range=0..10)
height_3 = Slider(2, range=0..10)
radius = Slider(1, range=0..10)
gap = Slider(1, range=0..10)
cluster_7 = Cluster_10(
    subd=subdmesh_2,
    Z=num,
    top_offset=top_offset,
    radius=radius,
    gap=gap,
    pin_length=height_3,
    tip_scale=tip_hemisphere_scale,
    edge_margin=edge_margin,
    rows=rows)

# ----
mesh_edge_loop_2 = CSharpScript(M=mesh_join, indx=Slider(405, range=0..1000))  # -> Pl, Ei; inputs M: Mesh, indx: Int32
# ---------- mesh_edge_loop_2: C# ----------
// Grasshopper Script Instance
#region Usings
using System;
using System.Linq;
using System.Collections;
using System.Collections.Generic;
using System.Drawing;

using Rhino;
using Rhino.Geometry;

using Grasshopper;
using Grasshopper.Kernel;
using Grasshopper.Kernel.Data;
using Grasshopper.Kernel.Types;
#endregion

public class Script_Instance : GH_ScriptInstance
{
    #region Notes
    /* 
      Members:
        RhinoDoc RhinoDocument
        GH_Document GrasshopperDocument
        IGH_Component Component
        int Iteration

      Methods (Virtual & overridable):
        Print(string text)
        Print(string format, params object[] args)
        Reflect(object obj)
        Reflect(object obj, string method_name)
    */
    #endregion

    private void RunScript(Mesh M, int indx, ref object Pl, ref object Ei)
    {
        // Write your logic here

        var topoEdge = M.TopologyEdges; // all edges
        var topoVertex = M.TopologyVertices; // all verices
        int ii = 0; // copy input edge index
        ii += indx;
        var baseVPair = topoEdge.GetTopologyVertices(ii);
        int end = 0;
        end += baseVPair[0];
        List<int> indices = new List<int>(); // loop edges index list
        indices.Add(indx);

        // Iterat on loop max segments number
        for (int i = 0; i < 150; i++) {
            
            int[] selectEnd = new int[2];
            var iEVPair = topoEdge.GetTopologyVertices(ii); // get edge 2 endpoints
            int ei = iEVPair.IndexOf(end);
            int si = iEVPair.IndexOf(iEVPair.Sum() - end);
            selectEnd[0] = ei;
            selectEnd[1] = si;

            Console.WriteLine(iEVPair[selectEnd[0]]);


            var eV = topoVertex[iEVPair[selectEnd[1]]] - topoVertex[iEVPair[selectEnd[0]]]; // contsruct edge tangent vector
            var edgeVector = new Vector3d(eV.X, eV.Y, eV.Z); // convert vector3f to vector3d

            var conVerIndices = topoVertex.ConnectedTopologyVertices(iEVPair[selectEnd[0]]); // get endpoint connected topo vertex indices
            var conEdgeIndices = topoVertex.ConnectedEdges(iEVPair[0]); // get endpoint connected topo edge indices

            bool state = true;            
            // Iterate on each connected vertex
            for (int j = 0; j < conVerIndices.Length; j++) {
                                
                if (state)  {
                
                    if (conVerIndices[j] == iEVPair[selectEnd[1]]) {continue;}
                    else {
                        
                        var cEV = topoVertex[iEVPair[selectEnd[0]]] - topoVertex[conVerIndices[j]];
                        var conEdgeVector = new Vector3d(cEV.X, cEV.Y, cEV.Z);
                        edgeVector.Unitize();
                        conEdgeVector.Unitize();

                        var dotProd = (edgeVector.X * conEdgeVector.X) + (edgeVector.Y * conEdgeVector.Y) + (edgeVector.Z * conEdgeVector.Z);

                        
                        if (dotProd > 0.5 ) {
                            
                            // Iterate on each connected edge vertex pair to find next edge index
                            for (int k = 0; k < conEdgeIndices.Length; k++) {
                                
                                var pair = topoEdge.GetTopologyVertices(conEdgeIndices[k]);
                                
                                if (pair.Contains(conVerIndices[j])) {
                                    
                                    ii = conEdgeIndices[k];
                                    indices.Add(ii);
                                    end = conVerIndices[j];
                                    state = false;
                                    break;
                                }
                            }
                        }
                        else {continue;}
                    }
                }
                else {break;}


            }
        }





        Pl = null;
        Ei = indices;
        // a = indices;
    }
}
# ---------- end mesh_edge_loop_2 ----------
item_14 = ListItem(List=medges.InteriorEdges, Index=mesh_edge_loop_2.Ei, Wrap=True)
panel_13 = Panel(mesh_edge_loop_2.Ei)

demesh = DeconstructMesh(Mesh=mesh_join)  # -> Vertices, Faces, Colours, Normals

# ---- group: Separate Body
join_3 = JoinCurves(Curves=mesh_edge_loop.Pl, Preserve=False)
pipe = Pipe(Curve=join_3, Radius=Slider(0.5, range=0..10), Caps=0)
mesh = Mesh(pipe)
msplit = MeshSplit(Mesh=meshsubd, Splitters=mesh)
area = Area(Geometry=msplit)  # -> Area, Centroid
pdecon_2 = Deconstruct(Point=area.Centroid)  # -> XComponent, YComponent, ZComponent
sort = SortList(Keys=pdecon_2.YComponent, ValuesA=msplit)  # -> Keys, ValuesA
offset_mesh = CSharpScript(M=sort.ValuesA, D="1", S=Toggle(True))  # -> O; inputs M: list of Mesh, D: Double, S: Boolean
# ---------- offset_mesh: C# ----------
// Grasshopper Script Instance
#region Usings
using System;
using System.Linq;
using System.Collections;
using System.Collections.Generic;
using System.Drawing;

using Rhino;
using Rhino.Geometry;

using Grasshopper;
using Grasshopper.Kernel;
using Grasshopper.Kernel.Data;
using Grasshopper.Kernel.Types;
#endregion

public class Script_Instance : GH_ScriptInstance
{
    #region Notes
    /* 
      Members:
        RhinoDoc RhinoDocument
        GH_Document GrasshopperDocument
        IGH_Component Component
        int Iteration

      Methods (Virtual & overridable):
        Print(string text)
        Print(string format, params object[] args)
        Reflect(object obj)
        Reflect(object obj, string method_name)
    */
    #endregion

    private void RunScript(List<Mesh> M, double D, bool S, ref object O)
    {
        // Write your logic here
        List<Mesh> offsetMeshes = new List<Mesh>();
        for (int i = 0; i < M.Count; i++) {
            offsetMeshes.Add(M[i].Offset(D, S));
        }
        O = offsetMeshes;
    }
}
# ---------- end offset_mesh ----------
item_15 = ListItem(List=offset_mesh, Index=0, Wrap=True)  # -> Item, Item1, Item2

# ----
points = PointList(Points=demesh.Vertices, Size=Slider(0.6, range=0..10))

# ----
# Squish Back Cap Surface
subd_to_nurbs = Python3Script(S=subdmesh, Ex=4)  # -> B; inputs S: SubD, Ex: Int32
#   port Ex: None = 0 LocalG1 = 1 LocalG2 = 2 LocalG1x = 3 LocalG1xx = 4
# ---------- subd_to_nurbs: Python ----------
import Rhino.Geometry as rg
if Ex > 4:
    raise ValueError('This option doesn\'nt exist. (0, 4)')
opt = rg.SubDToBrepOptions()
opt.PackFaces = True
evp = rg.SubDToBrepOptions.ExtraordinaryVertexProcessOption(Ex)
opt.ExtraordinaryVertexProcess = evp
B = S.ToBrep(opt)
# ---------- end subd_to_nurbs ----------
split = SplitBrep(Brep=subd_to_nurbs, Cutter=pipe)
item_16 = ListItem(List=split, Index=0, Wrap=True)  # -> Item, Item1, Item2
brep = Brep(item_16.Item)
brep_2 = Brep(item_16.Item1)
c_script_7 = CSharpScript(B=brep)  # -> S; inputs B: Brep
# ---------- c_script_7: C# ----------
// Grasshopper Script Instance
#region Usings
using System;
using System.Linq;
using System.Collections;
using System.Collections.Generic;
using System.Drawing;

using Rhino;
using Rhino.Geometry;

using Grasshopper;
using Grasshopper.Kernel;
using Grasshopper.Kernel.Data;
using Grasshopper.Kernel.Types;
#endregion

public class Script_Instance : GH_ScriptInstance
{
    #region Notes
    /* 
      Members:
        RhinoDoc RhinoDocument
        GH_Document GrasshopperDocument
        IGH_Component Component
        int Iteration

      Methods (Virtual & overridable):
        Print(string text)
        Print(string format, params object[] args)
        Reflect(object obj)
        Reflect(object obj, string method_name)
    */
    #endregion

    private void RunScript(Brep B, ref object S)
    {
        for (int i = 0; i < B.Surfaces.Count; i++) {
            bool a = B.Faces[i].ShrinkSurfaceToEdge();
            Console.WriteLine(a);
        }

        S = B;
      
    }
}
# ---------- end c_script_7 ----------
debrep = DeconstructBrep(Brep=c_script_7)  # -> Faces, Edges, Vertices
area_2 = Area(Geometry=debrep.Faces)  # -> Area, Centroid
sort_2 = SortList(Keys=area_2.Area, ValuesA=debrep.Faces)  # -> Keys, reverse(ValuesA)
item_17 = ListItem(List=sort_2.ValuesA, Index=0, Wrap=True)
pi_2 = Pi(Factor=expr("0.5", 1))
pt_5 = Point(Point(0, -80.69559358, 0))
prot = RotatePlane(Plane=pt_5, Angle=pi_2)
cluster_8 = Cluster_6(relay_2=item_17, relay=Slider(0, range=0..10), relay_3=Slider(0, range=0..10))
squish_surface = CSharpScript(S=cluster_8)  # -> Srf; inputs S: Surface
# ---------- squish_surface: C# ----------
// Grasshopper Script Instance
#region Usings
using System;
using System.Linq;
using System.Collections;
using System.Collections.Generic;
using System.Drawing;

using Rhino;
using Rhino.Geometry;

using Grasshopper;
using Grasshopper.Kernel;
using Grasshopper.Kernel.Data;
using Grasshopper.Kernel.Types;
#endregion

public class Script_Instance : GH_ScriptInstance
{
    private void RunScript(Surface S, ref object Srf)
    {

        var sqPara = new SquishParameters();
        var squish = new Squisher();
        var ss = squish.SquishSurface(sqPara, S);
        Srf = ss;

        
    }
}
# ---------- end squish_surface ----------
crv_3 = Curve(cluster_8)
orient = Orient(Geometry=squish_surface, Source=PlaneXY(0, 0, 0), Target=prot)  # -> Geometry, Transform

# ---- group: Pull Push Mesh
pt_6 = Point(Point(36.3962441, 8.965399033, 74.57749443))
pt_7 = Point(Point(36.3962441, 8.965399033, 74.57749443))
pt_8 = Point(Point(-26.98561534, 7.256085748, 73.15168578))
pt_9 = Point(Point(-0.01004993339, 29.15199374, 95.62397189))
pt_10 = Point(Point(31.14821915, 9.294656673, 82.06305256))
merge_2 = Merge(Data1=pt_10, Data2=pt_6, Data3=pt_7)
neg_2 = Negative(Value=Slider(3.743, range=0..10))
push_pull_mesh = CSharpScript(M=mesh_join, P=merge_2, N=Slider(3, range=0..10), x=neg_2)  # -> Mesh; inputs M: Mesh, P: list of Point3d, N: list of Int32, x: list of Double
# ---------- push_pull_mesh: C# ----------
// Grasshopper Script Instance
#region Usings
using System;
using System.Text.RegularExpressions;
using System.Linq;
using System.Collections;
using System.Collections.Generic;
using System.Drawing;

using Rhino;
using Rhino.Geometry;
using Rhino.Geometry.Collections;

using Grasshopper;
using Grasshopper.Kernel;
using Grasshopper.Kernel.Data;
using Grasshopper.Kernel.Types;
#endregion

public class Script_Instance : GH_ScriptInstance
{
    private void RunScript(
	Mesh M,
	List<Point3d> P,
	List<int> N,
	List<double> x,
	ref object Mesh)
    {
        Mesh patch = new();
        Mesh mm = M;
        int n1 = P.Count - N.Count;
        int n2 = P.Count - x.Count;
        
        // Longest list solution
        if (N.Count < P.Count) {
            for (int i = 0; i < n1; i++) {
                N.Add(N[N.Count-1]);
            }
        }
        if (x.Count < P.Count) {
            for (int i = 0; i < n2; i++) {
                x.Add(x[x.Count-1]);
            }
        }

        // Iterate on every point
        for (int l = 0; l < P.Count; l++)
        {
            // Get mesh vertices and faces list
            var faces = mm.Faces;
            var vertices = mm.Vertices;

            List<object> center = new(); // face centroid points

            // Calculate distances and face centroids
            List<KeyValuePair<MeshFace, double>> distList = new();
            for (int i = 0; i < faces.Count; i++)
            {
                Point3d cen = faces.GetFaceCenter(i);

                center.Add(cen);
                double dist = P[l].DistanceTo(cen);
                
                distList.Add(new KeyValuePair<MeshFace, double>(faces[i], dist));
                
            }
            distList.Sort((pair1, pair2) => pair1.Value.CompareTo(pair2.Value));
            
            
            // Get closest faces
            string[] closestFaces = new string[N[l]];
            string[] restFaces = new string[distList.Count - N[l]];
            for (int i = 0; i < distList.Count; i++) {
                if (i < N[l]) {
                    closestFaces[i] = (distList[i].Key.ToString());
                }
                else {
                    restFaces[i-N[l]] = (distList[i].Key.ToString());
                }
                
            }

            // Construct patch mesh
            Mesh patchMesh = ConstructMesh(vertices, closestFaces);
            patch = patchMesh;

            // Construct cut hole mesh
            Mesh cutHoleMesh = ConstructMesh(vertices, restFaces);


            //----------------------------------------------
            var newVertices = patchMesh.TopologyVertices;
            var movedVertices = patchMesh.Vertices;
            var newNormals = patchMesh.Normals; 
            
            float[] dists = new float[newVertices.Count];
            for (int i = 0; i < newVertices.Count; i++) {
                dists[i] = (float) P[l].DistanceTo(newVertices[i]);
            }
            
            float max = dists.Max();
            float min = dists.Min();
            float diff = max - min;

            for (int i = 0; i < newVertices.Count; i++) {
                if (newVertices.ConnectedEdgesCount(i) > 3) {
                    float t = (max - dists[i]) / diff * (float) x[l]; 
                    newVertices[i] += newNormals[i] * t;
                    movedVertices[i] = newVertices[i];
                }
            }
            //-------------------------------------------------

            cutHoleMesh.Append(patchMesh);
            cutHoleMesh.Weld(Math.PI);
            cutHoleMesh.UnifyNormals();
            mm = cutHoleMesh;
        }

        Mesh = mm;

        
    }


    static Mesh ConstructMesh(MeshVertexList V, string[] F)
    {  
        
        Mesh mesh = new Mesh();

        // Add vertices to the mesh
        foreach (var pt in V)
        {
            mesh.Vertices.Add(pt);
        }

        // Add faces to the mesh
        foreach (var faceStr in F)
        {
            string cleanFaceStr = Regex.Replace(faceStr, @"[\s\)\()]", string.Empty);
            cleanFaceStr = cleanFaceStr.Substring(1, cleanFaceStr.Length-1);
            
            string[] indices = cleanFaceStr.Split(',');
            if (indices.Length == 4) // Assuming quad faces
            {
                int v0 = int.Parse(indices[0]);
                int v1 = int.Parse(indices[1]);
                int v2 = int.Parse(indices[2]);
                int v3 = int.Parse(indices[3]);

                mesh.Faces.AddFace(v0, v1, v2, v3);
            }
            else if (indices.Length == 3) // Handle triangular faces if needed
            {
                int v0 = int.Parse(indices[0]);
                int v1 = int.Parse(indices[1]);
                int v2 = int.Parse(indices[2]);

                mesh.Faces.AddFace(v0, v1, v2);
            }
        }

        mesh.Normals.ComputeNormals();
        mesh.Compact();
        
        return mesh;
    }
}
# ---------- end push_pull_mesh ----------
dam = DataDam(DataA=push_pull_mesh, BufferDelay=10000000, BufferMode=0)
subdmesh_3 = SubDFromMesh(Mesh=push_pull_mesh, Creases=1, Corners=1, Interpolate=False)
preview = CustomPreview(
    Geometry=subdmesh_3,
    Material={diffuse=RGB(221, 160, 221), emission=RGB(66, 48, 66), shine=0.5, specular=RGB(255, 255, 255), transparency=0})

# ----
item_18 = ListItem(List=demesh.Vertices, Index=Slider(3, range=0..10), Wrap=True)
mesh_edge_loop_3 = CSharpScript(M=mesh_join, indx=Slider(11, range=0..1000))  # -> Pl, Ei, a; inputs M: Mesh, indx: Int32
# ---------- mesh_edge_loop_3: C# ----------
// Grasshopper Script Instance
#region Usings
using System;
using System.Linq;
using System.Collections;
using System.Collections.Generic;
using System.Drawing;

using Rhino;
using Rhino.Geometry;

using Grasshopper;
using Grasshopper.Kernel;
using Grasshopper.Kernel.Data;
using Grasshopper.Kernel.Types;
#endregion

public class Script_Instance : GH_ScriptInstance
{
    #region Notes
    /* 
      Members:
        RhinoDoc RhinoDocument
        GH_Document GrasshopperDocument
        IGH_Component Component
        int Iteration

      Methods (Virtual & overridable):
        Print(string text)
        Print(string format, params object[] args)
        Reflect(object obj)
        Reflect(object obj, string method_name)
    */
    #endregion

    private void RunScript(
	Mesh M,
	int indx,
	ref object Pl,
	ref object Ei,
	ref object a)
    {
        // Write your logic here

        var topoEdge = M.TopologyEdges; // all edges
        var topoVertex = M.TopologyVertices; // all verices
        int ii = 0; // copy input edge index
        ii += indx;
        var baseVPair = topoEdge.GetTopologyVertices(ii);
        int end = 0;
        end += baseVPair[1];
        List<int> indices = new List<int>(); // loop edges index list
        indices.Add(indx);

        // Iterat on loop max segments number
        for (int i = 0; i < 150; i++) {
            
            int[] selectEnd = new int[2];
            var iEVPair = topoEdge.GetTopologyVertices(ii); // get edge 2 endpoints
            int ei = iEVPair.IndexOf(end);
            int si = iEVPair.IndexOf(iEVPair.Sum() - end);
            selectEnd[0] = ei;
            selectEnd[1] = si;

            Console.WriteLine(iEVPair[selectEnd[0]]);

            var eV = topoVertex[iEVPair[selectEnd[1]]] - topoVertex[iEVPair[selectEnd[0]]]; // contsruct edge tangent vector
            var edgeVector = new Vector3d(eV.X, eV.Y, eV.Z); // convert vector3f to vector3d

            var conVerIndices = topoVertex.ConnectedTopologyVertices(iEVPair[selectEnd[0]], true); // get endpoint connected topo vertex indices
            var conEdgeIndices = topoVertex.ConnectedEdges(iEVPair[0]); // get endpoint connected topo edge indices
            
            List<double> dotProd = new List<double>();

            // Iterate on each connected vertex
            for (int j = 0; j < conVerIndices.Length; j++) {

                var cEV = topoVertex[conVerIndices[j]] - topoVertex[iEVPair[selectEnd[0]]];
                var conEdgeVector = new Vector3d(cEV.X, cEV.Y, cEV.Z);
                edgeVector.Unitize();
                conEdgeVector.Unitize();
                // edgeVector.Reverse();

                dotProd.Add((edgeVector.X * conEdgeVector.X) + (edgeVector.Y * conEdgeVector.Y) + (edgeVector.Z * conEdgeVector.Z));

            }
            a = dotProd;

            // if (dotProd > 1 ) {
                
            //     // Iterate on each connected edge vertex pair to find next edge index
            //     for (int k = 0; k < conEdgeIndices.Length; k++) {
                    
            //         var pair = topoEdge.GetTopologyVertices(conEdgeIndices[k]);
                    
            //         if (pair.Contains(conVerIndices[j])) {
                        
            //             ii = conEdgeIndices[k];
            //             indices.Add(ii);
            //             end = conVerIndices[j];
            //             state = false;
            //             break;
            //         }
            //     }
            // }
            // else {continue;}







        }
        // Pl = null;
        // Ei = indices;
        // a = dotProd;
    }
}
# ---------- end mesh_edge_loop_3 ----------
item_19 = ListItem(List=medges.InteriorEdges, Index=mesh_edge_loop_3.Ei, Wrap=True)
panel_14 = Panel(mesh_edge_loop_3.a)
preview_2 = CustomPreview(Geometry=item_19, Material=ColourSwatch(SwatchColor=RGB(255, 255, 255)))
tstat_2 = TreeStatistics(Tree=cluster_7)  # -> Paths, Length, Count

rebuild = Rebuild(Surface=orient.Geometry)
crv_4 = Curve(orient.Geometry)
crv_5 = Curve(rebuild)

cull_i = CullIndex(List=tstat_2.Paths, Indices=series, Wrap=True)
branch_5 = TreeBranch(Tree=cluster_7, Path=cull_i, MaintainPaths=True)

# ---- group: Collision Report
dispatch = Dispatch(List="Default", DispatchPattern=Toggle(True))  # -> ListA, ListB
cluster_9 = Cluster_9(L=dispatch.ListA, d1=item_15.Item, d2=item_15.Item1, d3=item_15.Item2)  # -> L_4, L_3, L_2
back = Panel(cluster_9.L_4)
panel_15 = Panel(cluster_9.L_3)
front = Panel(cluster_9.L_2)

# ----
medges_2 = MeshEdges(Mesh=mesh_join)  # -> NakedEdges, InteriorEdges, NonManifoldEdges
preview_3 = CustomPreview(Geometry=flatten(item_15.Item1), Material=ColourSwatch(SwatchColor=RGB(255, 255, 255)))

# ---- group: Geometry Hub
flatten = FlattenTree(Tree=branch_5, Path="{0}")
merge_3 = Merge(Data2=item_15.Item, Data3=item_15.Item2)

# ---- group: VRay Render
# Vray Render
number_slider_9 = Slider(0.59, range=0..1)
swatch_2 = ColourSwatch(SwatchColor=RGB(115, 4, 143))
swatch_3 = ColourSwatch(SwatchColor=RGB(38, 38, 38))
mtl_simple = VRayMaterialSimple(
    Diffuse=swatch_3,
    Reflection={AColor2=[0.5372549295, 0.5372549295, 0.5372549295, 1], FileName="", Float=0, State=2},
    Glossiness=number_slider_9,
    IOR=1.3,
    Opacity={AColor2=[0, 0, 0, 0], FileName="", Float=1, State=4},
    Emission={AColor2=[0, 0, 0, 1], FileName="", Float=0, State=2})
mtl_simple_2 = VRayMaterialSimple(
    Diffuse=ColourSwatch(SwatchColor=RGB(255, 255, 255)),
    Reflection={AColor2=[0.5372549295, 0.5372549295, 0.5372549295, 1], FileName="", Float=0, State=2},
    Glossiness=Slider(0.5, range=0..1),
    IOR=1.3,
    Opacity=Slider(0.27, range=0..1),
    Emission=ColourSwatch(SwatchColor=RGB(255, 255, 255)))
mtl_simple_3 = VRayMaterialSimple(
    Diffuse=ColourSwatch(SwatchColor=RGB(38, 38, 38)),
    Reflection={AColor2=[0.5372549295, 0.5372549295, 0.5372549295, 1], FileName="", Float=0, State=2},
    Glossiness=Slider(0.34, range=0..1),
    IOR=1.3,
    Opacity={AColor2=[0, 0, 0, 0], FileName="", Float=1, State=4},
    Emission={AColor2=[0, 0, 0, 1], FileName="", Float=0, State=2})
mesh_2 = Mesh(flatten(item_15.Item1))
inf_plane = VRayInfinitePlane(Mtl=mtl_simple, ShadowCatcherOn=False, ZOffset=0, PositionFromGeometry=True)
target = Target(Point(0.7936192167, -0.3831853534, 59.82206872))
environment = VRayEnvironment(Background=swatch_3, GlobalIllumination=ColourSwatch(SwatchColor=RGB(255, 255, 255)))
light_dome = VRayDomeLight(
    On=True,
    Invisible=True,
    Texture={AColor2=[1, 1, 1, 1], FileName="", Float=0, State=2},
    Intensity=Slider(1.654, range=0..10),
    BasePlane=PlaneXY(0, 0, 0))
sampler = Sampler(
    0,
    Has_Extract_Parameter=False,
    Has_Manage_Collection=False,
    OptionsLength=2,
    Version=1,
    Options=["Progressive", "Bucket"])
quality = Quality(
    0,
    Has_Extract_Parameter=False,
    Has_Manage_Collection=False,
    OptionsLength=6,
    Version=1,
    Options=["Low", "Low+", "Medium", "Medium+", "High", "High+"])
engine_2 = Engine(0, Has_Extract_Parameter=False, Has_Manage_Collection=False, OptionsLength=3, Version=1, Options=["CPU", "CUDA", "RTX"])
mode_2 = Mode(
    1,
    Has_Extract_Parameter=False,
    Has_Manage_Collection=False,
    OptionsLength=2,
    Version=1,
    Options=["Interactive", "Production"])
panel_16 = Panel("""1200
1200""")

# ----
rotate = Rotate(Geometry=pt_3, Angle=pi, Plane=target)  # -> Geometry, Transform
weld = WeldMesh(Mesh=mesh_2, Angle=3.141592654)
light_mesh = VRayLightMesh(
    On=True,
    Texture={AColor2=[1, 1, 1, 1], FileName="", Float=0, State=2},
    Intensity=Slider(50, range=0..100),
    Invisible=False,
    Geometry=weld)

# ---- group: Preview
number_slider_10 = Slider(100, range=0..100)
toggle = BooleanToggle(True)
preview_4 = CustomPreview(Geometry=edges.Interior, Material="white")
curve_preview = CustomCurvePreview(Curve=medges_2.InteriorEdges, Colour=RGB(0, 0, 0))
linedim = LineDimension(Line=[ln_2, ln_4, ln_3], Text="{0:0.00}", Size=Slider(2.25, range=0..10))

# ---- group: Geometry Hub (continued)
Y = UnitY(Factor=number_slider_10)
move_2 = Move(Geometry=item_15.Item2, Motion=Y)  # -> Geometry, Transform
merge_4 = Merge(Data1=item_15.Item, Data2=move_2.Geometry)
dispatch_2 = Dispatch(List=merge_4, DispatchPattern=invert(toggle))  # -> ListA, ListB
dispatch_3 = Dispatch(List=merge_3, DispatchPattern=toggle)  # -> ListA, ListB
group_5 = Group(Geometry=flatten([dispatch_2.ListA, dispatch_3.ListA]))
move_3 = Move(Geometry=flatten, Motion=Y)  # -> Geometry, Transform
dispatch_4 = Dispatch(List=move_3.Geometry, DispatchPattern=invert(toggle))  # -> ListA, ListB
dispatch_5 = Dispatch(List=flatten, DispatchPattern=toggle)  # -> ListA, ListB
ungroup_4 = Ungroup(Group=group_5)
merge_5 = Merge(Data1=dispatch_4.ListA, Data2=dispatch_5.ListA)

# ---- group: Preview (continued)
preview_5 = CustomPreview(Geometry=flatten(group_5), Material=ColourSwatch(SwatchColor=RGBA(255, 36, 36, 78)))

# ----
preview_6 = CustomPreview(Geometry=flatten(merge_5), Material=ColourSwatch(SwatchColor=RGB(176, 149, 42)))
mesh_3 = Mesh(flatten(merge_5))
vgeo = VRayGeometry(Geo=flatten(mesh_3), Material=mtl_name, Visible=True, quality=0)

# ---- group: VRay Render (continued)
mesh_4 = Mesh(flatten(ungroup_4))
vgeo_2 = VRayGeometry(Geo=flatten(weld), Material=mtl_simple_2, Visible=True, quality=0)
camera = VRayCamera(
    Type=0,
    Stereo=0,
    Position=rotate.Geometry,
    Target=target,
    FOV=27.1566906,
    Tilt=0,
    OrthographicZoomFactor=0,
    PhysicalExposureOn=False,
    WhiteBalance=RGB(255, 255, 255),
    FNumber=8,
    ShutterSpeed1S=100,
    FilmSensitivity=625,
    AutoExposure=False,
    AutoWhiteBalance=False,
    DepthOfFieldFocus=0)  # -> Camera, Angle, ExposureValue
dispatch_6 = Dispatch(List=camera.Camera, DispatchPattern=Toggle(True))  # -> ListA, ListB

# ----
weld_2 = WeldMesh(Mesh=mesh_4, Angle=3.141592654)

# ---- group: VRay Render (continued)
vgeo_3 = VRayGeometry(Geo=flatten(weld_2), Material=mtl_simple_3, Visible=True, quality=0)

# ----
merge_6 = Merge(Data1=vgeo, Data2=vgeo_3, Data3=vgeo_2)  # -> flatten(Result)

# ---- group: VRay Render (continued)
render = VRayRender(
    Engine=engine_2,
    Mode=mode_2,
    Sampler=sampler,
    Quality=quality,
    OutputImage=out_img,
    OutputResolution=panel_16,
    Camera=dispatch_6.ListA,
    Light=flatten([light_dome, light_mesh]),
    VGeometry=flatten([inf_plane, merge_6]),
    Environment=environment,
    Timeline=timeline.Timeline,
    RenderElements=denoiser,
    UpdateEffectsFrequency=Slider(0, range=0..100))

# ----
c_script_8 = CSharpScript(x=render)  # -> out, a
# ---------- c_script_8: C# ----------
// Grasshopper Script Instance
#region Usings
using System;
#r "C:\Program Files\Chaos Group\V-Ray\V-Ray for Rhinoceros\vrayappsdk\bin\VRaySDK.Net.dll"
#r "C:\Program Files\Chaos Group\V-Ray\V-Ray for Rhinoceros\V8\VRayForGrasshopper.gha"
using VRayForGrasshopper;
using System.Linq;
using System.Collections;
using System.Collections.Generic;
using System.Drawing;

using Rhino;
using Rhino.Geometry;

using Grasshopper;
using Grasshopper.Kernel;
using Grasshopper.Kernel.Data;
using Grasshopper.Kernel.Types;
#endregion

public class Script_Instance : GH_ScriptInstance
{
    #region Notes
    /* 
      Members:
        RhinoDoc RhinoDocument
        GH_Document GrasshopperDocument
        IGH_Component Component
        int Iteration

      Methods (Virtual & overridable):
        Print(string text)
        Print(string format, params object[] args)
        Reflect(object obj)
        Reflect(object obj, string method_name)
    */
    #endregion

    private void RunScript(object x, ref object a)
    {
        // Write your logic here
        VRayForGrasshopper.Scripting.VRayRenderer renderer =  x as VRayForGrasshopper.Scripting.VRayRenderer;
        
        
    }
}
# ---------- end c_script_8 ----------

# ==== cluster Cluster
P = ClusterInput()
pdecon = Deconstruct(Point=P)  # -> XComponent, YComponent, ZComponent
C = ClusterInput()
pt = ConstructPoint(XCoordinate=pdecon.XComponent, YCoordinate=0, ZCoordinate=pdecon.ZComponent)
pcx = CurvePlane(Curve=C, Plane=pt)  # -> Points, ParamsC, ParamsP
pdecon_2 = Deconstruct(Point=pcx.ParamsP)  # -> flatten(XComponent), YComponent, ZComponent
X = ClusterOutput(pdecon_2.XComponent)

# ==== cluster Cluster_3
pts = ClusterInput()
bang = ExplodeTree(Data=pts)  # -> _03000, _03001, _03002, _03003
pline = PolyLine(Vertices=flatten(pts), Closed=True)
pline_2 = PolyLine(Vertices=bang._03002, Closed=False)
lng = ListLength(List=bang._03002)
len = Length(Curve=pline_2)
group = Group(Geometry=reverse(bang._03000))  # -> flatten(Group)
group_2 = Group(Geometry=bang._03002)  # -> flatten(Group)
ln = Line(StartPoint=bang._03001, EndPoint=reverse(bang._03003))
len_2 = Length(Curve=ln)
expression = Expression(x=len_2, y=len, Expression="(x-y)/2")
py3 = Python3Script(C=ln, D=expression)  # -> Crv; inputs C: Curve, D: Double, E: Int32
# ---------- py3: Python ----------
"""Grasshopper Script Instance"""
import System
import Rhino
import Grasshopper

import rhinoscriptsyntax as rs
import Rhino.Geometry as rg

class MyComponent(Grasshopper.Kernel.GH_ScriptInstance):
    def RunScript(self, C: Rhino.Geometry.Curve, D: float, E: int):
        if not E:
            E = 3
        if not D:
            D = 0
        try:
            if D:
                Crv = C.Trim(rg.CurveEnd(E), D)
            else:
                Crv = C
        except:
            pass
        return Crv
# ---------- end py3 ----------
divide = DivideCurve(Curve=py3, Count=expr("x-1", lng), Kinks=False)  # -> Points, Tangents, Parameters
group_3 = Group(Geometry=divide.Points)  # -> flatten(Group)
ins = InsertItems(List=group_3, Item=[group, group_2], Indices=[0, -1], Wrap=True)
ungroup = Ungroup(Group=ins)
flip = FlipMatrix(Data=ungroup)
pline_3 = PolyLine(Vertices=flip, Closed=False)  # -> flatten(Polyline)
explode = Explode(Curve=pline, Recursive=True)  # -> Segments, Vertices
cluster = Cluster_2(ca=pline_3, cb=ln)
cluster_2 = Cluster_2(ca=ln, cb=pline_3)
merge = Merge(Data1=explode.Segments, Data2=cluster, Data3=cluster_2)  # -> flatten(Result)
mesh_from_lines = CSharpScript(L=merge, T="0.01")  # -> M; inputs L: list of Curve, T: Double
# ---------- mesh_from_lines: C# ----------
// Grasshopper Script Instance
#region Usings
using System;
using System.Linq;
using System.Collections;
using System.Collections.Generic;
using System.Drawing;

using Rhino;
using Rhino.Geometry;

using Grasshopper;
using Grasshopper.Kernel;
using Grasshopper.Kernel.Data;
using Grasshopper.Kernel.Types;
#endregion

public class Script_Instance : GH_ScriptInstance
{
    #region Notes
    /* 
      Members:
        RhinoDoc RhinoDocument
        GH_Document GrasshopperDocument
        IGH_Component Component
        int Iteration

      Methods (Virtual & overridable):
        Print(string text)
        Print(string format, params object[] args)
        Reflect(object obj)
        Reflect(object obj, string method_name)
    */
    #endregion

    private void RunScript(List<Curve> L, double T, ref object M)
    {

        // Convert L to an array
        Curve[] L_array = L.ToArray();

        // Pass the array to CreateFromLines
        Mesh mesh = Mesh.CreateFromLines(L_array, 4, T);

        M = mesh;
    }
}
# ---------- end mesh_from_lines ----------
mesh = ClusterOutput(mesh_from_lines)

# ==== cluster Cluster_4
pts = ClusterInput()
bang = ExplodeTree(Data=pts)  # -> _030140, _030141, _030142, _030143
pline = PolyLine(Vertices=flatten(pts), Closed=True)
pline_2 = PolyLine(Vertices=bang._030142, Closed=False)
lng = ListLength(List=bang._030142)
len = Length(Curve=pline_2)
group = Group(Geometry=reverse(bang._030140))  # -> flatten(Group)
group_2 = Group(Geometry=bang._030142)  # -> flatten(Group)
ln = Line(StartPoint=bang._030141, EndPoint=reverse(bang._030143))
len_2 = Length(Curve=ln)
expression = Expression(x=len_2, y=len, Expression="(x-y)/2")
py3 = Python3Script(C=ln, D=expression)  # -> Crv; inputs C: Curve, D: Double, E: Int32; same code as py3
divide = DivideCurve(Curve=py3, Count=expr("x-1", lng), Kinks=False)  # -> Points, Tangents, Parameters
group_3 = Group(Geometry=divide.Points)  # -> flatten(Group)
ins = InsertItems(List=group_3, Item=[group, group_2], Indices=[0, -1], Wrap=True)
ungroup = Ungroup(Group=ins)
flip = FlipMatrix(Data=ungroup)
pline_3 = PolyLine(Vertices=flip, Closed=False)  # -> flatten(Polyline)
explode = Explode(Curve=pline, Recursive=True)  # -> Segments, Vertices
cluster = Cluster_2(ca=pline_3, cb=ln)
cluster_2 = Cluster_2(ca=ln, cb=pline_3)
merge = Merge(Data1=explode.Segments, Data2=cluster, Data3=cluster_2)  # -> flatten(Result)
mesh_from_lines = CSharpScript(L=merge, T="0.01")  # -> M; inputs L: list of Curve, T: Double; same code as mesh_from_lines
mesh = ClusterOutput(mesh_from_lines)

# ==== cluster Cluster_5
M = ClusterInput()
H = ClusterInput()
nv = NakedVertices(Mesh=M)  # -> ClothedIndex, NakedIndex, ClothedPts, NakedPts
demesh = DeconstructMesh(Mesh=M)  # -> Vertices, Faces, Colours, Normals
pdecon = Deconstruct(Point=demesh.Normals)  # -> XComponent, YComponent, ZComponent
abs = Absolute(Value=pdecon.YComponent)
abs_2 = Absolute(Value=pdecon.XComponent)
abs_3 = Absolute(Value=pdecon.ZComponent)
vec = VectorXYZ(XComponent=abs_2, YComponent=abs, ZComponent=abs_3)  # -> Vector, Length
py3 = Python3Script(L=demesh.Vertices)  # -> N; inputs L: list
# ---------- py3: Python ----------
"""Grasshopper Script"""
import System
import Rhino
import Grasshopper

import rhinoscriptsyntax as rs

class MyComponent(Grasshopper.Kernel.GH_ScriptInstance):
    def RunScript(self, L: System.Collections.Generic.List[object]):
        a = int(len(L)/6)
        
        return a
# ---------- end py3 ----------
series = Series(Start=10, Step=5, Count=expr("x-2", py3))
descay = ClusterInput()
item = ListItem(List=vec.Vector, Index=nv.ClothedIndex, Wrap=True)
item_2 = ListItem(List=demesh.Vertices, Index=nv.ClothedIndex, Wrap=True)
item_3 = ListItem(List=demesh.Vertices, Index=series, Wrap=True)
pline = PolyLine(Vertices=item_3, Closed=False)
dom = ConstructDomain(DomainStart=1, DomainEnd=descay)
crv_cp = CurveClosestPoint(Point=item_2, Curve=pline)  # -> Point, Parameter, Distance
bnd = Bounds(Numbers=crv_cp.Distance)
remap = RemapNumbers(Value=crv_cp.Distance, Source=bnd, Target=dom)  # -> Mapped, Clipped
multiplication = Multiplication(A=H, B=remap.Mapped)
amp = Amplitude(Vector=item, Amplitude=multiplication)
move = Move(Geometry=item_2, Motion=amp)  # -> Geometry, Transform
replace = ReplaceItems(List=demesh.Vertices, Item=move.Geometry, Indices=nv.ClothedIndex, Wrap=False)
conmesh = ConstructMesh(Vertices=replace, Faces=demesh.Faces)
mesh = ClusterOutput(conmesh)

# ==== cluster Cluster_6
relay = ClusterInput()
relay_2 = ClusterInput()
relay_3 = ClusterInput()
domain = SurfaceDomain(Surface=relay_2)  # -> Surface, DomainU, DomainV
dedomain = DeconstructDomain(Domain=domain.DomainV)  # -> Start, End
dedomain_2 = DeconstructDomain(Domain=domain.DomainU)  # -> Start, End
addition = Addition(A=dedomain.Start, B=relay_3)
subtraction = Subtraction(A=dedomain_2.End, B=relay)
subtraction_2 = Subtraction(A=dedomain.End, B=relay_3)
subtraction_3 = Subtraction(A=dedomain_2.Start, B=relay)
dom = ConstructDomain(DomainStart=subtraction_3, DomainEnd=subtraction)
dom_2 = ConstructDomain(DomainStart=addition, DomainEnd=subtraction_2)
dom² = ConstructDomain²(DomainU=dom, DomainV=dom_2)
subsrf = Isotrim(Surface=relay_2, Domain=dom²)
S = ClusterOutput(subsrf)

# ==== cluster Cluster_9
L = ClusterInput()
d1 = ClusterInput()
d2 = ClusterInput()
d3 = ClusterInput()
objects = QueryModelObjects(Layer=L, Locked=True, Hidden=True, AutoUpdateState=True)
merge = Merge(Data1=d1, Data2=d2, Data3=d3)
cluster = Cluster_7(bi=objects)  # -> bi_2, N
item = ListItem(List=merge, Index=0, Wrap=True)  # -> Item, Item1, Item2
explode = ExplodeObject(Object=cluster.bi_2, Recursive=False)
cluster_2 = Cluster_8(C=item.Item2, O=explode, L=cluster.N)
cluster_3 = Cluster_8(C=item.Item1, O=explode, L=cluster.N)
cluster_4 = Cluster_8(C=item.Item, O=explode, L=cluster.N)
L_2 = ClusterOutput(cluster_2)
L_3 = ClusterOutput(cluster_3)
L_4 = ClusterOutput(cluster_4)

# ==== cluster Cluster_10
Z = ClusterInput()
edge_margin = ClusterInput()
pin_length = ClusterInput()
top_offset = ClusterInput()
tip_scale = ClusterInput()
radius = ClusterInput()
rows = ClusterInput()
gap = ClusterInput()
subd = ClusterInput()
item = ListItem(List=reverse(Z), Index=0, Wrap=True)
addition = Addition(A=top_offset, B=item)
expression = Expression(x=radius, y=gap, Expression="(x*2)+y")
pt = ConstructPoint(XCoordinate=0, YCoordinate=0, ZCoordinate=addition)
contour = Contour(Shape=subd, Point=pt, Direction=Vector(0, 0, 1), Distance=expression)  # -> flatten(Contours)
subset = SubList(List=reverse(flatten(contour)), Domain=rows, Wrap=True)  # -> List, Index
len = Length(Curve=subset.List)
subtraction = Subtraction(A=len, B=edge_margin)
dom = ConstructDomain(DomainStart=edge_margin, DomainEnd=subtraction)
subcrv = SubCurve(BaseCurve=subset.List, Domain=dom)
len_2 = Length(Curve=subcrv)
division = Division(A=len_2, B=expression)
expression_2 = Expression(x=division, Expression="floor(x)")
divide = DivideCurve(Curve=subcrv, Count=expression_2, Kinks=False)  # -> simplify(graft(Points)), Tangents, Parameters
brep_cp = BrepClosestPoint(Point=divide.Points, Brep=subd)  # -> Point, Normal, Distance
rev = Reverse(Vector=brep_cp.Normal)
pl = PlaneNormal(Origin=brep_cp.Point, ZAxis=rev)  # -> simplify(Plane)
cir = Circle(Plane=pl, Radius=radius)
height = Slider(2, range=0..10)
sph = Sphere(Base=pl, Radius=radius)
cyl = Cylinder(Base=pl, Radius=radius, Length=pin_length)  # -> simplify(Cylinder)
scale_nu = ScaleNU(Geometry=sph, Plane=pl, ScaleX=1, ScaleY=1, ScaleZ=tip_scale)  # -> simplify(Geometry), Transform
clean = CleanTree(RemoveNulls=True, RemoveInvalid=True, RemoveEmpty=True, Tree=cyl)
clean_2 = CleanTree(RemoveNulls=True, RemoveInvalid=True, RemoveEmpty=True, Tree=scale_nu.Geometry)
merge = Merge(Data1=clean, Data2=clean_2)
R = ClusterOutput(merge)

# ==== cluster Cluster_11
middle_polyline = ClusterInput()
profile_center = ClusterInput()
edges_pointat = ClusterInput()
offset_1 = ClusterInput()
offset_2 = ClusterInput()
yz = YZPlane(Origin=Point(0, 0, 0))
eval = EvaluateCurve(Curve=reparameterize(middle_polyline), Parameter=profile_center)  # -> Point, Tangent, Angle
project = Project(Geometry=eval.Point, Plane=yz)  # -> Geometry, Transform
pline = PolyLine(Vertices=project.Geometry, Closed=False)
edges = ClusterInput()
ext = ExtendCurve(Curve=pline, Type=0, Start=20, End=20)
offset = OffsetCurve(Curve=ext, Distance=expr("-x", offset_2), Corners=1)
offset_3 = OffsetCurve(Curve=ext, Distance=offset_1, Corners=1)
project_2 = Project(Geometry=edges, Plane=yz)  # -> Geometry, Transform
flip = FlipCurve(Curve=offset_3)  # -> Curve, Flag
eval_2 = EvaluateCurve(Curve=reparameterize(project_2.Geometry), Parameter=edges_pointat)  # -> Point, Tangent, Angle
connect = ConnectCurves(Curves=[offset, flip.Curve], Continuity=0, Close=True, Bulge=1)
incurve = PointInCurve(Point=eval_2.Point, Curve=connect)  # -> Relationship, Point
larger = LargerThan(FirstNumber=incurve.Relationship, SecondNumber=1)  # -> LargerThan, OrEqualTo
C = ClusterOutput(connect)
cull = CullPattern(List=edges, CullPattern=larger.LargerThan)
L = ClusterOutput(cull)

# ==== cluster Cluster_2
ca = ClusterInput()
cb = ClusterInput()
ccx = CurveCurve(CurveA=graft(ca), CurveB=cb)  # -> Points, ParamsA, ParamsB
pshift = ShiftPaths(Data=ccx.ParamsA, Offset=-1)
shatter = Shatter(Curve=graft(ca), Parameters=pshift)
curve = ClusterOutput(shatter)

# ==== cluster Cluster_7
T = ClusterInput()
bi = ClusterInput()
block_instance = ModelBlockInstance(BlockInstance=bi, Transform=T)  # -> BlockInstance, Transform, BlockDefinition
block_definition = ModelBlockDefinition(BlockDefinition=block_instance.BlockDefinition)  # -> BlockDefinition, Objects, Name
N = ClusterOutput(block_definition.Name)
bi_2 = ClusterOutput(block_instance.BlockInstance)

# ==== cluster Cluster_8
C = ClusterInput()
O = ClusterInput()
colom = CollisionOneMany(Collider=C, Obstacles=O)  # -> Collision, Index
mm = MassMultiplication(Input=colom.Collision)  # -> flatten(Result), PartialResults
L = ClusterInput()
cull = CullPattern(List=L, CullPattern=mm.Result)
L_2 = ClusterOutput(cull)
