# Grasshopper definition HU3_teardown_animation.ghx (Grasshopper 1.0.8)
# Copyright: 2024
# plug-ins: RhinoCodePluginGH, V-Ray For Grasshopper 8

block_definition = QueryModelBlockDefinitions(AutoUpdateState=True)
trigger = Trigger(Interval=20, TimerInterval=20, Target=S)  # disabled
block_definition_2 = ModelBlockDefinition(BlockDefinition=block_definition)  # -> BlockDefinition, Objects, Name
S = Script(reset=Button())  # -> out, a; inputs reset: Boolean
# ---------- S: Python ----------
if 't' not in globals() or reset:
    t = 0
else:
    t += 0.1
a = t
# ---------- end S ----------
panel = Panel(block_definition_2.Name)
panel_2 = Panel(S.a)
number_slider = Slider(15, range=0..100)
series = Series(Start=number_slider, Step=number_slider, Count=6)
objects = QueryModelObjects(Layer="Default", Locked=True, Hidden=True, AutoUpdateState=True)
series_2 = Series(Start="0", Step="0", Count=6)
multiplication = Multiplication(A=Slider(0, range=0..1), B=series)
cluster = Cluster_3(bi=objects)  # -> bi_2, N
panel_3 = Panel(cluster.N)
vec = VectorXYZ(XComponent=multiplication, YComponent=0, ZComponent=0)  # -> reverse(Vector), Length; disabled
pt = ConstructPoint(XCoordinate=series_2, YCoordinate=multiplication, ZCoordinate=0)

data = Data()
cluster_2 = Cluster_4(list=objects, i=["RB Pins", "RB Lock"], T=data)
cluster_3 = Cluster_4(list=objects, i="RB Inner USB Port Pins", T=data)
cluster_4 = Cluster_4(list=objects, i=["RB Inside USB Port", "RB IC"], T=data)
cluster_5 = Cluster_4(list=objects, i="RB PCB", T=data)
cluster_6 = Cluster_4(list=objects, i=["RB SD Storage", "RB Metal Ports", "RB CPU"], T=data)
cluster_7 = Cluster_4(list=objects, i="RB Chip", T=data)
cluster_8 = Cluster_4(list=objects, i="RB Resistors", T=data)
explode = ExplodeObject(Object=cluster_2, Recursive=False)  # -> flatten(Objects)
explode_2 = ExplodeObject(Object=cluster_3, Recursive=False)
explode_3 = ExplodeObject(Object=cluster_4, Recursive=False)  # -> flatten(Objects)
explode_4 = ExplodeObject(Object=cluster_5, Recursive=False)
explode_5 = ExplodeObject(Object=cluster_6, Recursive=False)  # -> flatten(Objects)
explode_6 = ExplodeObject(Object=cluster_7, Recursive=False)
explode_7 = ExplodeObject(Object=cluster_8, Recursive=False)
cluster_9 = Cluster(B=explode_4)  # -> A, B_2
cluster_10 = Cluster(B=explode_6)  # -> A, B_2
mtl_name = VRayMaterialFromProject(
    "/Raspberry_Chip",
    Has_Extract_Parameter=True,
    Has_Manage_Collection=False,
    OptionsLength=17,
    Version=1,
    Options=["/Aluminum_Polished", "/Battery", "/Charger_Chip", "/Copper_Polished", "/Foam_B02_Black_40cm", "/Gold_10k", "/Graphite", "/Gyroscope", "/Plane", "/Raspberry_Board", "/Raspberry_Chip", "/Resistors", "/Ribbon", "/Shield", "/Shield_Lock", "/Silver_Polished", "/UPS"])
mtl_name_2 = VRayMaterialFromProject(
    "/Aluminum_Polished",
    Has_Extract_Parameter=True,
    Has_Manage_Collection=False,
    OptionsLength=17,
    Version=1,
    Options=["/Aluminum_Polished", "/Battery", "/Charger_Chip", "/Copper_Polished", "/Foam_B02_Black_40cm", "/Gold_10k", "/Graphite", "/Gyroscope", "/Plane", "/Raspberry_Board", "/Raspberry_Chip", "/Resistors", "/Ribbon", "/Shield", "/Shield_Lock", "/Silver_Polished", "/UPS"])
mtl_name_3 = VRayMaterialFromProject(
    "/Raspberry_Board",
    Has_Extract_Parameter=True,
    Has_Manage_Collection=False,
    OptionsLength=17,
    Version=1,
    Options=["/Aluminum_Polished", "/Battery", "/Charger_Chip", "/Copper_Polished", "/Foam_B02_Black_40cm", "/Gold_10k", "/Graphite", "/Gyroscope", "/Plane", "/Raspberry_Board", "/Raspberry_Chip", "/Resistors", "/Ribbon", "/Shield", "/Shield_Lock", "/Silver_Polished", "/UPS"])
mtl_name_4 = VRayMaterialFromProject(
    "/Copper_Polished",
    Has_Extract_Parameter=True,
    Has_Manage_Collection=False,
    OptionsLength=17,
    Version=1,
    Options=["/Aluminum_Polished", "/Battery", "/Charger_Chip", "/Copper_Polished", "/Foam_B02_Black_40cm", "/Gold_10k", "/Graphite", "/Gyroscope", "/Plane", "/Raspberry_Board", "/Raspberry_Chip", "/Resistors", "/Ribbon", "/Shield", "/Shield_Lock", "/Silver_Polished", "/UPS"])
mtl_name_5 = VRayMaterialFromProject(
    "/Graphite",
    Has_Extract_Parameter=True,
    Has_Manage_Collection=False,
    OptionsLength=17,
    Version=1,
    Options=["/Aluminum_Polished", "/Battery", "/Charger_Chip", "/Copper_Polished", "/Foam_B02_Black_40cm", "/Gold_10k", "/Graphite", "/Gyroscope", "/Plane", "/Raspberry_Board", "/Raspberry_Chip", "/Resistors", "/Ribbon", "/Shield", "/Shield_Lock", "/Silver_Polished", "/UPS"])
mtl_name_6 = VRayMaterialFromProject(
    "/Shield_Lock",
    Has_Extract_Parameter=True,
    Has_Manage_Collection=False,
    OptionsLength=17,
    Version=1,
    Options=["/Aluminum_Polished", "/Battery", "/Charger_Chip", "/Copper_Polished", "/Foam_B02_Black_40cm", "/Gold_10k", "/Graphite", "/Gyroscope", "/Plane", "/Raspberry_Board", "/Raspberry_Chip", "/Resistors", "/Ribbon", "/Shield", "/Shield_Lock", "/Silver_Polished", "/UPS"])
mtl_name_7 = VRayMaterialFromProject(
    "/Resistors",
    Has_Extract_Parameter=True,
    Has_Manage_Collection=False,
    OptionsLength=17,
    Version=1,
    Options=["/Aluminum_Polished", "/Battery", "/Charger_Chip", "/Copper_Polished", "/Foam_B02_Black_40cm", "/Gold_10k", "/Graphite", "/Gyroscope", "/Plane", "/Raspberry_Board", "/Raspberry_Chip", "/Resistors", "/Ribbon", "/Shield", "/Shield_Lock", "/Silver_Polished", "/UPS"])
vgeo = VRayGeometry(Geo=flatten(explode_5), Material=mtl_name_2, Visible=True, quality=0)
vgeo_2 = VRayGeometry(Geo=flatten(explode_2), Material=mtl_name_4, Visible=True, quality=0)
vgeo_3 = VRayGeometry(Geo=flatten(explode_3), Material=mtl_name_5, Visible=True, quality=0)
vgeo_4 = VRayGeometry(Geo=flatten(explode), Material=mtl_name_6, Visible=True, quality=0)
vgeo_5 = VRayGeometry(Geo=flatten(explode_7), Material=mtl_name_7, Visible=True, quality=0)
vgeo_6 = VRayGeometry(Geo=flatten([cluster_10.A, cluster_10.B_2]), Material=mtl_name, Visible=True, quality=0)
mtl_preset = VRayMaterialPreset(Preset=1, MaterialBaseColorOrTexture=ColourSwatch(SwatchColor=RGB(54, 163, 112)))
vgeo_7 = VRayGeometry(Geo=flatten([cluster_9.A, cluster_9.B_2]), Material=mtl_preset, Visible=True, quality=0)
merge = Merge(Data1=vgeo, Data2=vgeo_7, Data3=vgeo_2, Data4=vgeo_3, Data5=vgeo_4, Data6=vgeo_5, Data7=vgeo_6)

data_2 = Data()
cluster_11 = Cluster_4(list=objects, i="Shield PCB", T=data_2)
cluster_12 = Cluster_4(list=objects, i="Ribbon", T=data_2)
cluster_13 = Cluster_4(list=objects, i="Shield Lock", T=data_2)
explode_8 = ExplodeObject(Object=cluster_11, Recursive=False)
explode_9 = ExplodeObject(Object=cluster_12, Recursive=False)
explode_10 = ExplodeObject(Object=cluster_13, Recursive=False)
cluster_14 = Cluster(B=explode_8)  # -> A, B_2
mtl_name_8 = VRayMaterialFromProject(
    "/Shield",
    Has_Extract_Parameter=True,
    Has_Manage_Collection=False,
    OptionsLength=17,
    Version=1,
    Options=["/Aluminum_Polished", "/Battery", "/Charger_Chip", "/Copper_Polished", "/Foam_B02_Black_40cm", "/Gold_10k", "/Graphite", "/Gyroscope", "/Plane", "/Raspberry_Board", "/Raspberry_Chip", "/Resistors", "/Ribbon", "/Shield", "/Shield_Lock", "/Silver_Polished", "/UPS"])
mtl_name_9 = VRayMaterialFromProject(
    "/Ribbon",
    Has_Extract_Parameter=True,
    Has_Manage_Collection=False,
    OptionsLength=17,
    Version=1,
    Options=["/Aluminum_Polished", "/Battery", "/Charger_Chip", "/Copper_Polished", "/Foam_B02_Black_40cm", "/Gold_10k", "/Graphite", "/Gyroscope", "/Plane", "/Raspberry_Board", "/Raspberry_Chip", "/Resistors", "/Ribbon", "/Shield", "/Shield_Lock", "/Silver_Polished", "/UPS"])
mtl_name_10 = VRayMaterialFromProject(
    "/Shield_Lock",
    Has_Extract_Parameter=True,
    Has_Manage_Collection=False,
    OptionsLength=17,
    Version=1,
    Options=["/Aluminum_Polished", "/Battery", "/Charger_Chip", "/Copper_Polished", "/Foam_B02_Black_40cm", "/Gold_10k", "/Graphite", "/Gyroscope", "/Plane", "/Raspberry_Board", "/Raspberry_Chip", "/Resistors", "/Ribbon", "/Shield", "/Shield_Lock", "/Silver_Polished", "/UPS"])
vgeo_8 = VRayGeometry(Geo=flatten(cluster_14.A), Material=mtl_name_8, Visible=True, quality=0)
vgeo_9 = VRayGeometry(Geo=flatten(explode_9), Material=mtl_name_9, Visible=True, quality=0)
vgeo_10 = VRayGeometry(Geo=flatten(explode_10), Material=mtl_name_10, Visible=True, quality=0)
mtl_preset_2 = VRayMaterialPreset(Preset=1, MaterialBaseColorOrTexture=ColourSwatch(SwatchColor=RGB(35, 39, 46)))
vgeo_11 = VRayGeometry(Geo=flatten(cluster_14.B_2), Material=mtl_preset_2, Visible=True, quality=0)
merge_2 = Merge(Data1=vgeo_8, Data2=vgeo_11, Data3=vgeo_9, Data4=vgeo_10)

data_3 = Data()
cluster_15 = Cluster_4(list=objects, i="Battery", T=data_3)
explode_11 = ExplodeObject(Object=cluster_15, Recursive=False)
item = ListItem(List=explode_11, Index=0, Wrap=True)  # -> Item, Item1, Item2, Item3
geo = Geometry([item.Item, item.Item1, item.Item3])
mtl_name_11 = VRayMaterialFromProject(
    "/Battery",
    Has_Extract_Parameter=True,
    Has_Manage_Collection=False,
    OptionsLength=17,
    Version=1,
    Options=["/Aluminum_Polished", "/Battery", "/Charger_Chip", "/Copper_Polished", "/Foam_B02_Black_40cm", "/Gold_10k", "/Graphite", "/Gyroscope", "/Plane", "/Raspberry_Board", "/Raspberry_Chip", "/Resistors", "/Ribbon", "/Shield", "/Shield_Lock", "/Silver_Polished", "/UPS"])
mtl_name_12 = VRayMaterialFromProject(
    "/Aluminum_Polished",
    Has_Extract_Parameter=True,
    Has_Manage_Collection=False,
    OptionsLength=17,
    Version=1,
    Options=["/Aluminum_Polished", "/Battery", "/Charger_Chip", "/Copper_Polished", "/Foam_B02_Black_40cm", "/Gold_10k", "/Graphite", "/Gyroscope", "/Plane", "/Raspberry_Board", "/Raspberry_Chip", "/Resistors", "/Ribbon", "/Shield", "/Shield_Lock", "/Silver_Polished", "/UPS"])
vgeo_12 = VRayGeometry(Geo=flatten(item.Item2), Material=mtl_name_11, Visible=True, quality=0)
vgeo_13 = VRayGeometry(Geo=flatten(geo), Material=mtl_name_12, Visible=True, quality=0)
merge_3 = Merge(Data1=vgeo_12, Data2=vgeo_13)

data_4 = Data()
cluster_16 = Cluster_4(list=objects, i="Gyroscope", T=data_4)
explode_12 = ExplodeObject(Object=cluster_16, Recursive=False)
cluster_17 = Cluster(B=explode_12)  # -> A, B_2
mtl_name_13 = VRayMaterialFromProject(
    "/Gyroscope",
    Has_Extract_Parameter=True,
    Has_Manage_Collection=False,
    OptionsLength=17,
    Version=1,
    Options=["/Aluminum_Polished", "/Battery", "/Charger_Chip", "/Copper_Polished", "/Foam_B02_Black_40cm", "/Gold_10k", "/Graphite", "/Gyroscope", "/Plane", "/Raspberry_Board", "/Raspberry_Chip", "/Resistors", "/Ribbon", "/Shield", "/Shield_Lock", "/Silver_Polished", "/UPS"])
vgeo_14 = VRayGeometry(Geo=flatten(cluster_17.A), Material=mtl_name_13, Visible=True, quality=0)
mtl_preset_3 = VRayMaterialPreset(Preset=1, MaterialBaseColorOrTexture=ColourSwatch(SwatchColor=RGB(1, 145, 97)))
vgeo_15 = VRayGeometry(Geo=flatten(cluster_17.B_2), Material=mtl_preset_3, Visible=True, quality=0)
merge_4 = Merge(Data1=vgeo_14, Data2=vgeo_15)

data_5 = Data()
cluster_18 = Cluster_4(list=objects, i="UPS Pin Connector", T=data_5)
cluster_19 = Cluster_4(list=objects, i="UPS Metal Parts", T=data_5)
cluster_20 = Cluster_4(list=objects, i="UPS PCB", T=data_5)
explode_13 = ExplodeObject(Object=cluster_18, Recursive=False)
explode_14 = ExplodeObject(Object=cluster_19, Recursive=False)
explode_15 = ExplodeObject(Object=cluster_20, Recursive=False)
cluster_21 = Cluster(B=explode_15)  # -> A, B_2
mtl_name_14 = VRayMaterialFromProject(
    "/Aluminum_Polished",
    Has_Extract_Parameter=True,
    Has_Manage_Collection=False,
    OptionsLength=17,
    Version=1,
    Options=["/Aluminum_Polished", "/Battery", "/Charger_Chip", "/Copper_Polished", "/Foam_B02_Black_40cm", "/Gold_10k", "/Graphite", "/Gyroscope", "/Plane", "/Raspberry_Board", "/Raspberry_Chip", "/Resistors", "/Ribbon", "/Shield", "/Shield_Lock", "/Silver_Polished", "/UPS"])
mtl_name_15 = VRayMaterialFromProject(
    "/Graphite",
    Has_Extract_Parameter=True,
    Has_Manage_Collection=False,
    OptionsLength=17,
    Version=1,
    Options=["/Aluminum_Polished", "/Battery", "/Charger_Chip", "/Copper_Polished", "/Foam_B02_Black_40cm", "/Gold_10k", "/Graphite", "/Gyroscope", "/Plane", "/Raspberry_Board", "/Raspberry_Chip", "/Resistors", "/Ribbon", "/Shield", "/Shield_Lock", "/Silver_Polished", "/UPS"])
mtl_name_16 = VRayMaterialFromProject(
    "/UPS",
    Has_Extract_Parameter=True,
    Has_Manage_Collection=False,
    OptionsLength=17,
    Version=1,
    Options=["/Aluminum_Polished", "/Battery", "/Charger_Chip", "/Copper_Polished", "/Foam_B02_Black_40cm", "/Gold_10k", "/Graphite", "/Gyroscope", "/Plane", "/Raspberry_Board", "/Raspberry_Chip", "/Resistors", "/Ribbon", "/Shield", "/Shield_Lock", "/Silver_Polished", "/UPS"])
mtl_name_17 = VRayMaterialFromProject(
    "/Graphite",
    Has_Extract_Parameter=True,
    Has_Manage_Collection=False,
    OptionsLength=17,
    Version=1,
    Options=["/Aluminum_Polished", "/Battery", "/Charger_Chip", "/Copper_Polished", "/Foam_B02_Black_40cm", "/Gold_10k", "/Graphite", "/Gyroscope", "/Plane", "/Raspberry_Board", "/Raspberry_Chip", "/Resistors", "/Ribbon", "/Shield", "/Shield_Lock", "/Silver_Polished", "/UPS"])
vgeo_16 = VRayGeometry(Geo=flatten(explode_14), Material=mtl_name_14, Visible=True, quality=0)
vgeo_17 = VRayGeometry(Geo=flatten(explode_13), Material=mtl_name_15, Visible=True, quality=0)
vgeo_18 = VRayGeometry(Geo=flatten(cluster_21.A), Material=mtl_name_16, Visible=True, quality=0)
vgeo_19 = VRayGeometry(Geo=flatten(cluster_21.B_2), Material=mtl_name_17, Visible=True, quality=0)
merge_5 = Merge(Data1=vgeo_17, Data2=vgeo_16, Data3=vgeo_18, Data4=vgeo_19)

mesh = Mesh(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)
mesh_2 = Mesh(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)
mesh_3 = Mesh(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)
cluster_22 = Cluster_2(N="Body Pins")
swatch = ColourSwatch(SwatchColor=RGB(237, 237, 237))
swatch_2 = ColourSwatch(SwatchColor=RGB(115, 4, 143))
mtl_name_18 = VRayMaterialFromProject(
    "/Silver_Polished",
    Has_Extract_Parameter=True,
    Has_Manage_Collection=False,
    OptionsLength=17,
    Version=1,
    Options=["/Aluminum_Polished", "/Battery", "/Charger_Chip", "/Copper_Polished", "/Foam_B02_Black_40cm", "/Gold_10k", "/Graphite", "/Gyroscope", "/Plane", "/Raspberry_Board", "/Raspberry_Chip", "/Resistors", "/Ribbon", "/Shield", "/Shield_Lock", "/Silver_Polished", "/UPS"])
mtl_simple = VRayMaterialSimple(
    Diffuse=ColourSwatch(SwatchColor=RGB(255, 255, 255)),
    Reflection={AColor2=[0.5372549295, 0.5372549295, 0.5372549295, 1], FileName="", Float=0, State=2},
    Glossiness=Slider(0.5, range=0..1),
    IOR=1.3,
    Opacity=Slider(0.27, range=0..1),
    Emission=ColourSwatch(SwatchColor=RGB(255, 255, 255)))
mtl_simple_2 = VRayMaterialSimple(
    Diffuse=ColourSwatch(SwatchColor=RGB(38, 38, 38)),
    Reflection={AColor2=[0.5372549295, 0.5372549295, 0.5372549295, 1], FileName="", Float=0, State=2},
    Glossiness=Slider(0.34, range=0..1),
    IOR=1.3,
    Opacity={AColor2=[0, 0, 0, 0], FileName="", Float=1, State=4},
    Emission={AColor2=[0, 0, 0, 1], FileName="", Float=0, State=2})
mesh_4 = Mesh(flatten(cluster_22))
vgeo_20 = VRayGeometry(Geo=flatten(mesh_4), Material=mtl_name_18, Visible=True, quality=0)
vgeo_21 = VRayGeometry(Visible=True, quality=0)
vgeo_22 = VRayGeometry(Visible=True, quality=0)
swatch_3 = ColourSwatch(SwatchColor=RGB(38, 38, 38))
number_slider_2 = Slider(4, range=0..100)
mtl_simple_3 = VRayMaterialSimple(
    Diffuse=swatch_3,
    Reflection={AColor2=[0.5372549295, 0.5372549295, 0.5372549295, 1], FileName="", Float=0, State=2},
    Glossiness=Slider(0.59, range=0..1),
    IOR=1.3,
    Opacity={AColor2=[0, 0, 0, 0], FileName="", Float=1, State=4},
    Emission={AColor2=[0, 0, 0, 1], FileName="", Float=0, State=2})
pt_2 = Point(Point(-139.7767964, 278.2286827, 144.3000364))
target = Target(Point(0.7936192167, -0.3831853534, 59.82206872))
sampler = Sampler(
    0,
    Has_Extract_Parameter=False,
    Has_Manage_Collection=False,
    OptionsLength=2,
    Version=1,
    Options=["Progressive", "Bucket"])
out_img = OutputImage(
    File_Picker=1,
    File_Types="Portable Network Graphics (*.png)|*.png|Windows bitmap (*.bmp)|*.bmp|Targa Image (*.tga)|*.tga|Radiance High-Dynamyc Range (*.hdr)|*.hdr|Silicon Graphics (*.sgi; *.rgb; *.rgba)|*.sgi;*.rgb;*.rgba|JPEG image (*.jpg; *.jpeg)|*.jpg;*.jpeg|OpenEXR image (*.exr)|*.exr|SoftImage PICT (*.pic)|*.pic|Tagged image (*.tif; *.tiff)|*.tif;*.tiff|Tiled mipmapped image file (*.tx)|*.tx|V-Ray Raw Image (*.vrimg)|*.vrimg",
    Multiple_Files=False)
panel_4 = Panel("""900
900""")
quality = Quality(
    2,
    Has_Extract_Parameter=False,
    Has_Manage_Collection=False,
    OptionsLength=6,
    Version=1,
    Options=["Low", "Low+", "Medium", "Medium+", "High", "High+"])
engine = Engine(0, Has_Extract_Parameter=False, Has_Manage_Collection=False, OptionsLength=3, Version=1, Options=["CPU", "CUDA", "RTX"])
mode = Mode(
    0,
    Has_Extract_Parameter=False,
    Has_Manage_Collection=False,
    OptionsLength=2,
    Version=1,
    Options=["Interactive", "Production"])
rotate = Rotate(Geometry=pt_2, Angle=degrees(Slider(250, range=0..1000)), Plane=target)  # -> Geometry, Transform
inf_plane = VRayInfinitePlane(Mtl=mtl_simple_3, ShadowCatcherOn=False, ZOffset=0, PositionFromGeometry=True)
environment = VRayEnvironment(Background=swatch_3, GlobalIllumination=ColourSwatch(SwatchColor=RGB(255, 255, 255)))
light_dome = VRayDomeLight(
    On=True,
    Invisible=True,
    Texture={AColor2=[1, 1, 1, 1], FileName="", Float=0, State=2},
    Intensity=Slider(1.654, range=0..10),
    BasePlane=PlaneXY(0, 0, 0))
camera = VRayCamera(
    Type=0,
    Stereo=0,
    Position=rotate.Geometry,
    Target=target,
    FOV=27.1566906,
    Tilt=0,
    OrthographicZoomFactor=0,
    PhysicalExposureOn=False,
    WhiteBalance=RGB(255, 255, 255),
    FNumber=8,
    ShutterSpeed1S=100,
    FilmSensitivity=625,
    AutoExposure=False,
    AutoWhiteBalance=False,
    DepthOfFieldFocus=0)  # -> Camera, Angle, ExposureValue

data_6 = Data()
mtl_name_19 = VRayMaterialFromProject(
    "/Copper_Polished",
    Has_Extract_Parameter=True,
    Has_Manage_Collection=False,
    OptionsLength=17,
    Version=1,
    Options=["/Aluminum_Polished", "/Battery", "/Charger_Chip", "/Copper_Polished", "/Foam_B02_Black_40cm", "/Gold_10k", "/Graphite", "/Gyroscope", "/Plane", "/Raspberry_Board", "/Raspberry_Chip", "/Resistors", "/Ribbon", "/Shield", "/Shield_Lock", "/Silver_Polished", "/UPS"])
mtl_name_20 = VRayMaterialFromProject(
    "/Charger_Chip",
    Has_Extract_Parameter=True,
    Has_Manage_Collection=False,
    OptionsLength=17,
    Version=1,
    Options=["/Aluminum_Polished", "/Battery", "/Charger_Chip", "/Copper_Polished", "/Foam_B02_Black_40cm", "/Gold_10k", "/Graphite", "/Gyroscope", "/Plane", "/Raspberry_Board", "/Raspberry_Chip", "/Resistors", "/Ribbon", "/Shield", "/Shield_Lock", "/Silver_Polished", "/UPS"])
mtl_name_21 = VRayMaterialFromProject(
    "/Foam_B02_Black_40cm",
    Has_Extract_Parameter=True,
    Has_Manage_Collection=False,
    OptionsLength=17,
    Version=1,
    Options=["/Aluminum_Polished", "/Battery", "/Charger_Chip", "/Copper_Polished", "/Foam_B02_Black_40cm", "/Gold_10k", "/Graphite", "/Gyroscope", "/Plane", "/Raspberry_Board", "/Raspberry_Chip", "/Resistors", "/Ribbon", "/Shield", "/Shield_Lock", "/Silver_Polished", "/UPS"])
mtl_preset_4 = VRayMaterialPreset(Preset=1, MaterialBaseColorOrTexture=ColourSwatch(SwatchColor=RGB(1, 145, 97)))

cluster_23 = Cluster_4(list=objects, i="Charger Board", T=data_6)
cluster_24 = Cluster_4(list=objects, i="Coil", T=data_6)
cluster_25 = Cluster_4(list=objects, i="Charger Pad", T=data_6)
explode_16 = ExplodeObject(Object=cluster_23, Recursive=False)
explode_17 = ExplodeObject(Object=cluster_24, Recursive=False)
explode_18 = ExplodeObject(Object=cluster_25, Recursive=False)

cluster_26 = Cluster(B=explode_16)  # -> A, B_2
vgeo_23 = VRayGeometry(Geo=flatten(explode_17), Material=mtl_name_19, Visible=True, quality=0)
vgeo_24 = VRayGeometry(Geo=flatten(cluster_26.A), Material=mtl_name_20, Visible=True, quality=0)
vgeo_25 = VRayGeometry(Geo=flatten(cluster_26.B_2), Material=mtl_preset_4, Visible=True, quality=0)
vgeo_26 = VRayGeometry(Geo=flatten(explode_18), Material=mtl_name_21, Visible=True, quality=0)
merge_6 = Merge(Data1=vgeo_23, Data2=vgeo_24, Data3=vgeo_25, Data4=vgeo_26)

merge_7 = Merge(Data1=merge_2, Data2=merge_6, Data3=merge_5, Data4=merge_3, Data5=merge_4, Data6=merge)
render = VRayRender(
    Engine=engine,
    Mode=mode,
    Sampler=sampler,
    Quality=quality,
    OutputImage=out_img,
    OutputResolution=panel_4,
    Camera=camera.Camera,
    Light=flatten(light_dome),
    VGeometry=flatten([merge_7, inf_plane]),
    Environment=environment,
    UpdateEffectsFrequency=Slider(0, range=0..100))

# ==== cluster Cluster
B = ClusterInput()
debrep = DeconstructBrep(Brep=B)  # -> Faces, Edges, Vertices
area = Area(Geometry=debrep.Faces)  # -> Area, Centroid
sort = SortList(Keys=area.Area, ValuesA=debrep.Faces)  # -> Keys, reverse(ValuesA)
split = SplitList(List=sort.ValuesA, Index=2)  # -> ListA, ListB
A = ClusterOutput(split.ListA)
B_2 = ClusterOutput(split.ListB)

# ==== cluster Cluster_2
N = ClusterInput()
block_definition = QueryModelBlockDefinitions(Name=N, AutoUpdateState=True)
T = ClusterInput()
block_instance = ModelBlockInstance(Transform=T, BlockDefinition=block_definition)  # -> BlockInstance, Transform, BlockDefinition
explode = ExplodeObject(Object=block_instance.BlockInstance, Recursive=False)
O = ClusterOutput(explode)

# ==== cluster Cluster_3
T = ClusterInput()
bi = ClusterInput()
block_instance = ModelBlockInstance(BlockInstance=bi, Transform=T)  # -> BlockInstance, Transform, BlockDefinition
block_definition = ModelBlockDefinition(BlockDefinition=block_instance.BlockDefinition)  # -> BlockDefinition, Objects, Name
N = ClusterOutput(block_definition.Name)
bi_2 = ClusterOutput(block_instance.BlockInstance)

# ==== cluster Cluster_4
i = ClusterInput()
list = ClusterInput()
cluster = Cluster_3(bi=list)  # -> bi_2, N
T = ClusterInput()
py3 = Python3Script(L=cluster.N, i=i)  # -> a; inputs L: list of String, i: String
# ---------- py3: Python ----------
a = L.index(i)
# ---------- end py3 ----------
item = ListItem(List=list, Index=py3, Wrap=True)
block_instance = ModelBlockInstance(BlockInstance=item, Transform=T)  # -> BlockInstance, Transform, BlockDefinition
bi = ClusterOutput(block_instance.BlockInstance)
