# Grasshopper definition hugad_device_v0.0.ghx (Grasshopper 1.0.8)
# Copyright: 2024
# plug-ins: RhinoCodePluginGH, MeshEdit Components, Pufferfish, SurfacePlus

number_slider = Slider(7, range=0..100)
number_slider_2 = Slider(0.48, range=0..1)

galapagos = Galapagos(fitness=volume, gene=number_slider_2)
number_slider_3 = Slider(7, range=0..100)
number_slider_4 = Slider(7, range=0..100)
number_slider_5 = Slider(0.5, range=0..1)
# HU2
number_slider_6 = Slider(101, range=0..1000)
number_slider_7 = Slider(0.5, range=0..1)
galapagos_2 = Galapagos(fitness=volume_2, gene=number_slider_5)
galapagos_3 = Galapagos(fitness=volume_3, gene=number_slider_7)
# HU2-1
neg = Negative(Value=Slider(101, range=0..1000))
# HU1
pt = ConstructPoint(XCoordinate=0, YCoordinate=0, ZCoordinate=0)
pt_2 = ConstructPoint(XCoordinate=neg, YCoordinate=0, ZCoordinate=0)
pt_3 = ConstructPoint(XCoordinate=number_slider_6, YCoordinate=0, ZCoordinate=0)
Y = UnitY(Factor=Slider(7.117, range=0..100))
Y_2 = UnitY(Factor=Slider(12.117, range=0..100))
Y_3 = UnitY(Factor=Slider(12.117, range=0..100))
range = Range(Domain=Domain(0, 1), Steps=number_slider)
range_2 = Range(Domain=Domain(0, 1), Steps=number_slider_3)
graph = GraphMapper(range, x0=0, x1=1, y0=0, y1=1, container_name="Bezier", cpx=[0, 0.282954812, 0.6886360645, 1], cpy=[0, 0, 1, 1])
range_3 = Range(Domain=Domain(0, 1), Steps=number_slider_4)
graph_2 = GraphMapper(range_2, x0=0, x1=1, y0=0, y1=1, container_name="Bezier", cpx=[0, 0.282954812, 0.6886360645, 1], cpy=[0, 0, 1, 1])
graph_3 = GraphMapper(range_3, x0=0, x1=1, y0=0, y1=1, container_name="Bezier", cpx=[0, 0.282954812, 0.6886360645, 1], cpy=[0, 0, 1, 1])

crv = Curve(<curve referenced from the Rhino model>)
end = EndPoints(Curve=crv)  # -> Start, End
item = ListItem(List=end.End, Index=0, Wrap=True)
pdecon = Deconstruct(Point=item)  # -> XComponent, YComponent, ZComponent

X = UnitX(Factor=1)

crv_2 = Curve(<curve referenced from the Rhino model>)
end_2 = EndPoints(Curve=crv_2)  # -> Start, End
item_2 = ListItem(List=end_2.End, Index=0, Wrap=True)
pdecon_2 = Deconstruct(Point=item_2)  # -> XComponent, YComponent, ZComponent

crv_3 = Curve(<curve referenced from the Rhino model>)
end_3 = EndPoints(Curve=crv_3)  # -> Start, End
item_3 = ListItem(List=end_3.End, Index=0, Wrap=True)
pdecon_3 = Deconstruct(Point=item_3)  # -> XComponent, YComponent, ZComponent

X_2 = UnitX(Factor=1)
X_3 = UnitX(Factor=1)

length_start = Slider(85, range=0..100)
length_width_end = Slider(15, range=0..100)
width_start = Slider(25, range=0..100)
dom = ConstructDomain(DomainStart=length_start, DomainEnd=length_width_end)
dom_2 = ConstructDomain(DomainStart=width_start, DomainEnd=length_width_end)
range_4 = Range(Domain=Domain(1, 0), Steps=number_slider)
range_5 = Range(Domain=Domain(1, 0), Steps=number_slider)
graph_4 = GraphMapper(range_4, x0=0, x1=1, y0=0, y1=1, container_name="Bezier", cpx=[0, 0.25, 0.75, 1], cpy=[0, 0.25, 0.75, 1])
graph_5 = GraphMapper(range_5, x0=0, x1=1, y0=0, y1=1, container_name="Bezier", cpx=[0, 0.25, 0.75, 1], cpy=[0, 0.25, 0.75, 1])
remap = RemapNumbers(Value=graph_4, Source=Domain(1, 0), Target=dom)  # -> expr("x/2", Mapped), Clipped
remap_2 = RemapNumbers(Value=graph_5, Source=Domain(1, 0), Target=dom_2)  # -> Mapped, Clipped

length_start_2 = Slider(85, range=0..100)
length_width_end_2 = Slider(15, range=0..100)
width_start_2 = Slider(25, range=0..100)
dom_3 = ConstructDomain(DomainStart=length_start_2, DomainEnd=length_width_end_2)
dom_4 = ConstructDomain(DomainStart=width_start_2, DomainEnd=length_width_end_2)
range_6 = Range(Domain=Domain(1, 0), Steps=number_slider_3)
range_7 = Range(Domain=Domain(1, 0), Steps=number_slider_3)
graph_6 = GraphMapper(range_6, x0=0, x1=1, y0=0, y1=1, container_name="Bezier", cpx=[0, 0.25, 0.75, 1], cpy=[0, 0.25, 0.75, 1])
graph_7 = GraphMapper(range_7, x0=0, x1=1, y0=0, y1=1, container_name="Bezier", cpx=[0, 0.25, 0.75, 1], cpy=[0, 0.25, 0.75, 1])
remap_3 = RemapNumbers(Value=graph_6, Source=Domain(1, 0), Target=dom_3)  # -> expr("x/2", Mapped), Clipped
remap_4 = RemapNumbers(Value=graph_7, Source=Domain(1, 0), Target=dom_4)  # -> Mapped, Clipped

length_start_3 = Slider(85, range=0..100)
length_width_end_3 = Slider(15, range=0..100)
width_start_3 = Slider(25, range=0..100)
dom_5 = ConstructDomain(DomainStart=length_start_3, DomainEnd=length_width_end_3)
dom_6 = ConstructDomain(DomainStart=width_start_3, DomainEnd=length_width_end_3)
range_8 = Range(Domain=Domain(1, 0), Steps=number_slider_4)
range_9 = Range(Domain=Domain(1, 0), Steps=number_slider_4)
graph_8 = GraphMapper(range_8, x0=0, x1=1, y0=0, y1=1, container_name="Bezier", cpx=[0, 0.25, 0.75, 1], cpy=[0, 0.25, 0.75, 1])
graph_9 = GraphMapper(range_9, x0=0, x1=1, y0=0, y1=1, container_name="Bezier", cpx=[0, 0.25, 0.75, 1], cpy=[0, 0.25, 0.75, 1])
remap_5 = RemapNumbers(Value=graph_8, Source=Domain(1, 0), Target=dom_5)  # -> expr("x/2", Mapped), Clipped
remap_6 = RemapNumbers(Value=graph_9, Source=Domain(1, 0), Target=dom_6)  # -> Mapped, Clipped

chamfer_start = Slider(5.04, range=0..100)
chamfer_end = Slider(4, range=0..100)
dom_7 = ConstructDomain(DomainStart=chamfer_start, DomainEnd=chamfer_end)
range_10 = Range(Domain=dom_7, Steps=number_slider)  # -> graft(Range)

remap_7 = RemapNumbers(Value=Slider(0, range=0..1), Source=Domain(0, 1), Target=number_slider_3)  # -> Mapped, Clipped
py3 = Python3Script(steps=number_slider_3, max_position=remap_7.Mapped)  # -> a; inputs steps: Int32, max_position: Int32
# ---------- py3: Python ----------
import numpy as np

def generate_float_range(steps, max_position):
    if not (0 <= max_position < steps):
        raise ValueError("max_position should be between 0 and steps-1")

    # Create a range of numbers from 0 to 1 with the defined number of steps
    range_before_max = np.linspace(0, 1, max_position + 1)  # From 0 to 1 (for max_position)
    range_after_max = np.linspace(1, 0, steps - max_position)  # From 1 down to 0
    
    # Combine them to create the full sequence
    float_range = np.concatenate([range_before_max[:-1], range_after_max])
    
    return float_range

# Example usage:
steps +=1
float_range = generate_float_range(steps, max_position)
a = [i for i in float_range]
# ---------- end py3 ----------
c_script = CSharpScript(steps=number_slider_3, maxPosition=remap_7.Mapped)  # -> a; inputs steps: Int32, maxPosition: Int32
# ---------- c_script: C# ----------
// Grasshopper Script Instance
#region Usings
using System;
using System.Linq;
using System.Collections;
using System.Collections.Generic;
using System.Drawing;

using Rhino;
using Rhino.Geometry;

using Grasshopper;
using Grasshopper.Kernel;
using Grasshopper.Kernel.Data;
using Grasshopper.Kernel.Types;
#endregion

public class Script_Instance : GH_ScriptInstance
{
    #region Notes
    /* 
      Members:
        RhinoDoc RhinoDocument
        GH_Document GrasshopperDocument
        IGH_Component Component
        int Iteration

      Methods (Virtual & overridable):
        Print(string text)
        Print(string format, params object[] args)
        Reflect(object obj)
        Reflect(object obj, string method_name)
    */
    #endregion

    private void RunScript(int steps, int maxPosition, ref object a)
    {
            
        float[] floatRange = GenerateFloatRange(steps, maxPosition);
        
        // Print the resulting array
        a = floatRange;


        static float[] GenerateFloatRange(int steps, int maxPosition)
        {
            steps++;
            
            if (maxPosition < 0 || maxPosition >= steps)
            {
                throw new ArgumentException("maxPosition should be between 0 and steps - 1");
            }

            // Create arrays for the two parts: before and after the maximum
            float[] rangeBeforeMax = Linspace(0, 1, maxPosition + 1);
            float[] rangeAfterMax = Linspace(1, 0, steps - maxPosition);

            // Concatenate them into a single array
            float[] result = new float[steps];
            Array.Copy(rangeBeforeMax, 0, result, 0, maxPosition);
            Array.Copy(rangeAfterMax, 0, result, maxPosition, steps - maxPosition);

            return result;
        }

        static float[] Linspace(float start, float end, int num)
        {
            float[] result = new float[num];
            float step = (end - start) / (num - 1);

            for (int i = 0; i < num; i++)
            {
                result[i] = start + step * i;
            }

            return result;
        }
    }
}
# ---------- end c_script ----------
graph_10 = GraphMapper(py3, x0=0, x1=1, y0=0, y1=1, container_name="Bezier", cpx=[0, 0.25, 0.75, 1], cpy=[0, 0.25, 0.75, 1])

remap_8 = RemapNumbers(Value=Slider(0, range=0..1), Source=Domain(0, 1), Target=number_slider_4)  # -> Mapped, Clipped
py3_2 = Python3Script(steps=number_slider_4, max_position=remap_8.Mapped)  # -> a; inputs steps: Int32, max_position: Int32; same code as py3
c_script_2 = CSharpScript(steps=number_slider_4, maxPosition=remap_8.Mapped)  # -> a; inputs steps: Int32, maxPosition: Int32; same code as c_script
graph_11 = GraphMapper(py3_2, x0=0, x1=1, y0=0, y1=1, container_name="Bezier", cpx=[0, 0.25, 0.75, 1], cpy=[0, 0.25, 0.75, 1])

inner_convexity = Slider(7.41, range=0..100)
range_11 = Range(Domain=Domain(1, 0), Steps=number_slider)
graph_12 = GraphMapper(range_11, x0=0, x1=1, y0=0, y1=1, container_name="Gaussian", factor=0.3271082044, mean=0.542044878, sdev=0.1327042878)
dom_8 = ConstructDomain(DomainStart=inner_convexity, DomainEnd=0)
remap_9 = RemapNumbers(Value=graph_12, Source=Domain(1, 0), Target=dom_8)  # -> Mapped, Clipped

chamfer_start_2 = Slider(5.04, range=0..100)
chamfer_end_2 = Slider(4, range=0..100)
dom_9 = ConstructDomain(DomainStart=chamfer_start_2, DomainEnd=chamfer_end_2)
range_12 = Range(Domain=dom_9, Steps=number_slider_3)  # -> graft(Range)

chamfer_start_3 = Slider(5.04, range=0..100)
chamfer_end_3 = Slider(4, range=0..100)
dom_10 = ConstructDomain(DomainStart=chamfer_start_3, DomainEnd=chamfer_end_3)
range_13 = Range(Domain=dom_10, Steps=number_slider_4)  # -> graft(Range)

toggle = BooleanToggle(True)

inner_convexity_2 = Slider(15.4, range=0..100)
range_14 = Range(Domain=Domain(1, 0), Steps=number_slider_3)
graph_13 = GraphMapper(range_14, x0=0, x1=1, y0=0, y1=1, container_name="Gaussian", factor=0.3271082044, mean=0.5666919947, sdev=0.1327042878)
dom_11 = ConstructDomain(DomainStart=inner_convexity_2, DomainEnd=0)
remap_10 = RemapNumbers(Value=graph_13, Source=Domain(1, 0), Target=dom_11)  # -> Mapped, Clipped

inner_convexity_3 = Slider(15.4, range=0..100)
range_15 = Range(Domain=Domain(1, 0), Steps=number_slider_4)
graph_14 = GraphMapper(range_15, x0=0, x1=1, y0=0, y1=1, container_name="Gaussian", factor=0.3271082044, mean=0.5666919947, sdev=0.1327042878)
dom_12 = ConstructDomain(DomainStart=inner_convexity_3, DomainEnd=0)
remap_11 = RemapNumbers(Value=graph_14, Source=Domain(1, 0), Target=dom_12)  # -> Mapped, Clipped

toggle_2 = BooleanToggle(True)

bend = Slider(7.53, range=0..100)
y_segements = Slider(2, range=1..10)
x_segements = Slider(9, range=1..100)

parabola = Python3Script(N=x_segements, D="1", Inv="1")  # -> R; inputs N: Int32, D: Int32, Inv: Boolean; same code as parabola
range_16 = Range(Domain=Domain(0, 1), Steps=x_segements)
graph_15 = GraphMapper(range_16, x0=0, x1=1, y0=0, y1=1, container_name="Gaussian", factor=0.5744156837, mean=0.5025906563, sdev=0.2324495912)

toggle_3 = BooleanToggle(True)

bend_2 = Slider(10.52, range=0..100)
x_segements_2 = Slider(3, range=1..100)
y_segements_2 = Slider(2, range=1..10)

parabola_2 = Python3Script(N=x_segements_2, D="1", Inv="1")  # -> R; inputs N: Int32, D: Int32, Inv: Boolean; same code as parabola
range_17 = Range(Domain=Domain(0, 1), Steps=x_segements_2)
graph_16 = GraphMapper(range_17, x0=0, x1=1, y0=0, y1=1, container_name="Gaussian", factor=0.4075372815, mean=0.5025906563, sdev=0.165032953)

bend_3 = Slider(10.52, range=0..100)
y_segements_3 = Slider(2, range=1..10)
x_segements_3 = Slider(3, range=1..100)

parabola_3 = Python3Script(N=x_segements_3, D="1", Inv="1")  # -> R; inputs N: Int32, D: Int32, Inv: Boolean; same code as parabola
range_18 = Range(Domain=Domain(0, 1), Steps=x_segements_3)
graph_17 = GraphMapper(range_18, x0=0, x1=1, y0=0, y1=1, container_name="Gaussian", factor=0.4075372815, mean=0.5025906563, sdev=0.165032953)

panel = Panel(graph_10)
panel_2 = Panel(graph_11)

# ---- group: HU1
data = Data(Tree({0;0}: [Plane(origin=(0, 0, 0), x=(1, 0, 0), y=(0, 0.9966294872, 0.08203453653)), Plane(origin=(0, -0.339914296, 5.902904158), x=(1, 0, 0), y=(0, 0.9994583627, 0.03290868094)), Plane(origin=(0, -0.02858052688, 19.36073806), x=(1, 0, 0), y=(0, 0.9968673435, -0.07909171537)), Plane(origin=(0, 2.495487357, 36.09883), x=(1, 0, 0), y=(0, 0.9758612436, -0.2183914678)), Plane(origin=(0, 7.629634038, 53.05795904), x=(1, 0, 0), y=(0, 0.9331332335, -0.3595307615)), Plane(origin=(0, 14.48353381, 67.79082178), x=(1, 0, 0), y=(0, 0.8760928884, -0.4821423554)), Plane(origin=(0, 20.98189549, 78.28412372), x=(1, 0, 0), y=(0, 0.8220114449, -0.5694709689)), Plane(origin=(0, 24, 82.44743776), x=(1, 0, 0), y=(0, 0.7968938143, -0.6041193994))], {0;1}: [30.4853217, 37.54921365, 43.54331852, 41.83526203, 34.28185864, 24.44632601, 15.97808264, 12.3239629], {0;2}: [25, 23.57142857, 22.14285714, 20.71428571, 19.28571429, 17.85714286, 16.42857143, 15], {0;3}: [9], {0;4}: [2], {0;5}: [7.53], {0;6}: ["1", "0.857143", "0.714286", "0.571429", "0.428571", "0.285714", "0.142857", "0"], {0;7}: [5.04, 4.891428571, 4.742857143, 4.594285714, 4.445714286, 4.297142857, 4.148571429, 4], {0;8}: [0.01890272777, 0.4347796142, 3.138512364, 7.110309296, 5.055488418, 1.128100326, 0.07900276796, 0.00173638837], {0;9}: [0.09520690597, 0.2387266587, 0.4763253312, 0.7562697464, 0.955476626, 0.9605803491, 0.7684535464, 0.4891835352, 0.2477971653, 0.09988289636]))

# ---- group: HU2
data_2 = Data(Tree({0;0}: [Plane(origin=(101, 0, 0), x=(1, 0, 0), y=(0, 0.9804661629, 0.1966878324)), Plane(origin=(101, -1.447780466, 8.363830626), x=(1, 0, 0), y=(0, 0.9895312097, 0.144319039)), Plane(origin=(101, -3.074681583, 27.61901513), x=(1, 0, 0), y=(0, 0.9997177919, 0.02375576809)), Plane(origin=(101, -1.802444844, 51.88351619), x=(1, 0, 0), y=(0, 0.9917518842, -0.1281725406)), Plane(origin=(101, 3.455695827, 76.76827431), x=(1, 0, 0), y=(0, 0.9588288739, -0.2839844901)), Plane(origin=(101, 11.6948858, 98.58912421), x=(1, 0, 0), y=(0, 0.9072404981, -0.4206122663)), Plane(origin=(101, 20.02738753, 114.2253652), x=(1, 0, 0), y=(0, 0.8550678657, -0.5185160991)), Plane(origin=(101, 24, 120.4474378), x=(1, 0, 0), y=(0, 0.8301939855, -0.5574746151))], {0;1}: [27.4853217, 39.40552541, 42.98121591, 32.54782695, 21.67760053, 13.26796705, 8.752987241, 7.323962904], {0;2}: [25, 23.57142857, 22.14285714, 20.71428571, 19.28571429, 17.85714286, 16.42857143, 15], {0;3}: [3], {0;4}: [2], {0;5}: [10.52], {0;6}: ["1", "0.857143", "0.714286", "0.571429", "0.428571", "0.285714", "0.142857", "0"], {0;7}: [5.04, 4.891428571, 4.742857143, 4.594285714, 4.445714286, 4.297142857, 4.148571429, 4], {0;8}: [0.07329835393, 1.380404542, 8.158841859, 15.13424043, 8.810543928, 1.609736496, 0.09230321716, 0.001661073554], {0;9}: [0.009540885584, 0.5822379757, 0.6009944359, 0.01049297062]))

# ---- group: Construct Mesh
py3_3 = Python3Script()  # -> a; inputs cen: Point3d, pts: list of Point3d
# ---------- py3_3: Python ----------
import Rhino.Geometry as rg 

a = rg.Mesh()
pts.append(pts[0])
for i in range(len(pts) - 1):
    pl = rg.Polyline()
    pl.Add(cen)
    pl.Add(pts[i])
    pl.Add(pts[i + 1])
    pl.Add(cen)
    mesh = rg.Mesh.CreateFromClosedPolyline(pl)
    a.Append(mesh)
a.Weld(0.01)
# ---------- end py3_3 ----------
construct_mesh = Python3Script()  # -> M; inputs V: list of Point3d; same code as construct_mesh

# ----
py3_4 = Python3Script()  # -> a; inputs cen: Point3d, pts: list of Point3d; same code as py3_3
construct_mesh_2 = Python3Script()  # -> M; inputs V: list of Point3d; same code as construct_mesh
py3_5 = Python3Script()  # -> a; inputs cen: Point3d, pts: list of Point3d; same code as py3_3
construct_mesh_3 = Python3Script()  # -> M; inputs V: list of Point3d; same code as construct_mesh
subtraction = Subtraction(A=1, B=Slider(0.24, range=0..1))
height = Slider(3, range=0..10)
radius = Slider(5, range=0..10)
gap = Slider(2.1, range=0..10)
height_2 = Slider(3, range=0..10)
radius_2 = Slider(5, range=0..10)
gap_2 = Slider(2.1, range=0..10)
height_3 = Slider(3, range=0..10)
radius_3 = Slider(5, range=0..10)
gap_3 = Slider(2.1, range=0..10)

remap_12 = RemapNumbers(Value=Slider(0, range=0..1), Source=Domain(0, 1), Target=number_slider)  # -> Mapped, Clipped

py3_6 = Python3Script(steps=number_slider, max_position=remap_12.Mapped)  # -> a; inputs steps: Int32, max_position: Int32; same code as py3
c_script_3 = CSharpScript(steps=number_slider, maxPosition=remap_12.Mapped)  # -> a; inputs steps: Int32, maxPosition: Int32; same code as c_script

graph_18 = GraphMapper(py3_6, x0=0, x1=1, y0=0, y1=1, container_name="Bezier", cpx=[0, 0.25, 0.75, 1], cpy=[0, 0.25, 0.75, 1])

panel_3 = Panel(graph_18)

# ---- group: Switch input type
dispatch = Dispatch(List=Slider(113, range=0..1000), DispatchPattern=invert(toggle))  # -> ListA, ListB
dispatch_2 = Dispatch(List=remap.Mapped, DispatchPattern=invert(toggle))  # -> ListA, ListB
dispatch_3 = Dispatch(List=pdecon.ZComponent, DispatchPattern=toggle)  # -> ListA, ListB
# Plane
# Length range
# Width range
# Steps
# X segments
# Y Segments
# Bend
# Bend Graph
# Chamfer
# Inner convexity
# Convexity graph
merge = Merge(Data1=dispatch_3.ListA, Data2=dispatch.ListA)

# ----
vec = VectorXYZ(XComponent=0, YComponent=Slider(24, range=0..100), ZComponent=merge)  # -> Vector, Length
move = Move(Geometry=pt, Motion=vec.Vector)  # -> Geometry, Transform
ln = Line(StartPoint=pt, EndPoint=move.Geometry)
eval = EvaluateCurve(Curve=reparameterize(ln), Parameter=Slider(0.712, range=0..1))  # -> Point, Tangent, Angle
move_2 = Move(Geometry=eval.Point, Motion=expr("-x", Y))  # -> Geometry, Transform
arc = Arc3Pt(PointA=pt, PointB=move_2.Geometry, PointC=move.Geometry)  # -> Arc, Plane, Radius
pframe = PerpFrame(Curve=reparameterize(arc.Arc), Parameter=graph)
pframe_2 = PerpFrame(Curve=reparameterize(arc.Arc), Parameter=number_slider_2)
align = AlignPlane(Plane=pframe, Direction=X)  # -> Plane, Angle
cluster = Cluster_2(C=crv, P=align.Plane)

# ---- group: Switch input type (continued)
dispatch_4 = Dispatch(List=cluster, DispatchPattern=toggle)  # -> ListA, ListB
entwine = Entwine(Branch00=dispatch_4.ListA, Branch01=dispatch_2.ListA, FlattenInputs=True)
clean = CleanTree(RemoveNulls=True, RemoveInvalid=True, RemoveEmpty=True, Tree=entwine)

# ----
entwine_2 = Entwine(
    Branch00=align.Plane,
    Branch01=clean,
    Branch02=remap_2.Mapped,
    Branch03=x_segements,
    Branch04=y_segements,
    Branch05=bend,
    Branch06=panel_3,
    Branch07=range_10,
    Branch08=remap_9.Mapped,
    Branch09=graph_15,
    FlattenInputs=True)
data_3 = Data(entwine_2)
bang = ExplodeTree(Data=entwine_2)  # -> Branch0, Branch1, Branch2, Branch3, Branch4, Branch5, Branch6, graft(Branch7), Branch8, Branch9
cluster_2 = Cluster(
    plane=bang.Branch0,
    length_range=bang.Branch1,
    width_range=bang.Branch2,
    x_segements=bang.Branch3,
    y_segements=bang.Branch4,
    bend=bang.Branch5,
    bend_graph=bang.Branch6,
    chamfer=bang.Branch7,
    inner_convexity=bang.Branch8,
    convexity_graph=bang.Branch9)  # -> simplify(segment_pt_group), simplify(segment_points), middle_polyline
deplane = DeconstructPlane(Plane=bang.Branch0)  # -> Origin, XAxis, YAxis, ZAxis
points = PointList(Points=cluster_2.segment_points, Size=2.35)
pline = PolyLine(Vertices=cluster_2.segment_points, Closed=True)  # -> flatten(Polyline)
tstat = TreeStatistics(Tree=cluster_2.segment_pt_group)  # -> Paths, Length, Count
paramloftmsh = ParameterLoftMesh(
    Sections=pline,
    ParametersU=[0, 0.1, 0.2, 0.3, 0.4, 0.5, 0.6, 0.7, 0.8, 0.9, 1],
    ParametersV=[0, 1],
    Weighted=False,
    Lengths=True,
    Angle=0,
    Closed=False,
    Triangulate=False)
item_4 = ListItem(List=tstat.Paths, Index=0, Wrap=True)  # -> Item1, Item
branch = TreeBranch(Tree=cluster_2.segment_pt_group, Path=item_4.Item, MaintainPaths=True)
branch_2 = TreeBranch(Tree=cluster_2.segment_pt_group, Path=item_4.Item1, MaintainPaths=True)
item_5 = ListItem(List=deplane.ZAxis, Index=0, Wrap=True)  # -> Item1, Item
ungroup = Ungroup(Group=branch_2)
ungroup_2 = Ungroup(Group=branch)
cluster_3 = Cluster_3(D=ungroup_2, V=item_5.Item, A=expr("-x", Slider(5.88, range=0..10)))
cluster_4 = Cluster_3(D=ungroup, V=item_5.Item1, A=Slider(3.8, range=0..10))
mjoin = MeshJoin(Meshes=flatten([paramloftmsh, cluster_4, cluster_3]))
weldvertices = MeshWeldVertices(Mesh=mjoin, Tolerance=0.01)  # -> RuntimeMessage, Mesh
unim = UnifyMesh(Mesh=weldvertices.Mesh)  # -> Result, Count
subdmesh = SubDFromMesh(Mesh=unim.Result, Creases=1, Corners=1, Interpolate=False)

subdpoly = SubDControlPolygon(SubD=subdmesh)
medges = MeshEdges(Mesh=subdpoly)  # -> NakedEdges, InteriorEdges, NonManifoldEdges

cluster_5 = Cluster_4(L=cluster_2.segment_points, S=Slider(1, range=0..10), D=Slider(11, range=0..30), ex=Slider(4, range=0..10))
shrink = ShrinkSurface(Brep=cluster_5)  # -> Brep, Surface

number_slider_8 = Slider(0.29, range=0..1)
subtraction_2 = Subtraction(A=1, B=number_slider_8)
dom_13 = ConstructDomain(DomainStart=number_slider_8, DomainEnd=subtraction_2)
dom_14 = ConstructDomain(DomainStart=Slider(0.35, range=0..1), DomainEnd=subtraction)
dom² = ConstructDomain²(DomainU=dom_13, DomainV=dom_14)
subsrf = Isotrim(Surface=reparameterize(shrink.Surface), Domain=dom²)
rebuild = Rebuild(Surface=subsrf, DegreeU=3, DegreeV=3, CountU="10", CountV="10")

# ----
# Inside surface
offmsh = OffsetMesh(Mesh=unim.Result, Distance=expr("-x", 1), BothSides=0, CreateSolid=False)

# ---- group: Calculate Dimensions
bbox = BoundingBox(Content=subdmesh, Plane=pframe_2)  # -> Box, Box_2
edges = BrepEdges(Brep=bbox.Box)  # -> Naked, Interior, NonManifold
py3_7 = Python3Script(B=bbox.Box)  # -> pts, U, V, W; inputs B: Box
# ---------- py3_7: Python ----------
import Rhino.Geometry as rg
pts = B.GetCorners()
U = B.X[1] - B.X[0]
V = B.Y[1] - B.Y[0]
W = B.Z[1] - B.Z[0]
# ---------- end py3_7 ----------
item_6 = ListItem(List=py3_7.pts, Index=0, Wrap=True)  # -> Item, Item1, Item2, Item3, Item4
ln_2 = Line(StartPoint=item_6.Item, EndPoint=item_6.Item1)
ln_3 = Line(StartPoint=item_6.Item, EndPoint=item_6.Item4)
ln_4 = Line(StartPoint=item_6.Item1, EndPoint=item_6.Item2)

# ----
subdmesh_2 = SubDFromMesh(Mesh=offmsh, Creases=1, Corners=1, Interpolate=False)
volume = Volume(Geometry=bbox.Box)  # -> Volume, Centroid
panel_4 = Panel(volume.Volume)
dim = Dimensions(Surface=subsrf)  # -> UDimension, VDimension
panel_5 = Panel(dim.VDimension)
panel_6 = Panel(dim.UDimension)
cluster_6 = Cluster_5(S=rebuild, U=Slider(3, range=0..100), V=Slider(4, range=0..100), R=radius, H=height, G=gap)

preview = CustomPreview(Geometry=flatten([subdmesh, subdmesh_2, cluster_6]), Material=ColourSwatch(SwatchColor=RGB(186, 52, 139)))
preview_2 = CustomPreview(Geometry=edges.Interior, Material="white")
curve_preview = CustomCurvePreview(Curve=medges.InteriorEdges, Colour=RGB(0, 0, 0))
linedim = LineDimension(Line=[ln_2, ln_4, ln_3], Text="{0:0.00}", Size=Slider(2.25, range=0..10))
preview_3 = CustomPreview(Material=ColourSwatch(SwatchColor=RGBA(255, 255, 255, 32)))

dispatch_5 = Dispatch(List=Slider(113, range=0..1000), DispatchPattern=invert(toggle_2))  # -> ListA, ListB
dispatch_6 = Dispatch(List=remap_3.Mapped, DispatchPattern=invert(toggle_2))  # -> ListA, ListB
dispatch_7 = Dispatch(List=pdecon_2.ZComponent, DispatchPattern=toggle_2)  # -> ListA, ListB
# Plane
# Length range
# Width range
# Steps
# X segments
# Y Segments
# Bend
# Bend Graph
# Chamfer
# Inner convexity
# Convexity graph
merge_2 = Merge(Data1=dispatch_7.ListA, Data2=dispatch_5.ListA)

vec_2 = VectorXYZ(XComponent=0, YComponent=Slider(24, range=0..100), ZComponent=merge_2)  # -> Vector, Length
move_3 = Move(Geometry=pt_2, Motion=vec_2.Vector)  # -> Geometry, Transform
ln_5 = Line(StartPoint=pt_2, EndPoint=move_3.Geometry)
eval_2 = EvaluateCurve(Curve=reparameterize(ln_5), Parameter=Slider(0.428, range=0..1))  # -> Point, Tangent, Angle
move_4 = Move(Geometry=eval_2.Point, Motion=expr("-x", Y_2))  # -> Geometry, Transform
arc_2 = Arc3Pt(PointA=pt_2, PointB=move_4.Geometry, PointC=move_3.Geometry)  # -> Arc, Plane, Radius
pframe_3 = PerpFrame(Curve=reparameterize(arc_2.Arc), Parameter=graph_2)
pframe_4 = PerpFrame(Curve=reparameterize(arc_2.Arc), Parameter=number_slider_5)
align_2 = AlignPlane(Plane=pframe_3, Direction=X_2)  # -> Plane, Angle
cluster_7 = Cluster_2(C=crv_2, P=align_2.Plane)

dispatch_8 = Dispatch(List=cluster_7, DispatchPattern=toggle_2)  # -> ListA, ListB
entwine_3 = Entwine(Branch00=dispatch_8.ListA, Branch01=dispatch_6.ListA, FlattenInputs=True)
clean_2 = CleanTree(RemoveNulls=True, RemoveInvalid=True, RemoveEmpty=True, Tree=entwine_3)

entwine_4 = Entwine(
    Branch00=align_2.Plane,
    Branch01=clean_2,
    Branch02=remap_4.Mapped,
    Branch03=x_segements_2,
    Branch04=y_segements_2,
    Branch05=bend_2,
    Branch06=panel,
    Branch07=range_12,
    Branch08=remap_10.Mapped,
    Branch09=graph_16,
    FlattenInputs=True)
data_4 = Data(entwine_4)
bang_2 = ExplodeTree(Data=entwine_4)  # -> Branch0, Branch1, Branch2, Branch3, Branch4, Branch5, Branch6, graft(Branch7), Branch8, Branch9
cluster_8 = Cluster(
    plane=bang_2.Branch0,
    length_range=bang_2.Branch1,
    width_range=bang_2.Branch2,
    x_segements=bang_2.Branch3,
    y_segements=bang_2.Branch4,
    bend=bang_2.Branch5,
    bend_graph=bang_2.Branch6,
    chamfer=bang_2.Branch7,
    inner_convexity=bang_2.Branch8,
    convexity_graph=bang_2.Branch9)  # -> simplify(segment_pt_group), simplify(segment_points), middle_polyline
deplane_2 = DeconstructPlane(Plane=bang_2.Branch0)  # -> Origin, XAxis, YAxis, ZAxis
points_2 = PointList(Points=cluster_8.segment_points, Size=2.35)
pline_2 = PolyLine(Vertices=cluster_8.segment_points, Closed=True)  # -> flatten(Polyline)
tstat_2 = TreeStatistics(Tree=cluster_8.segment_pt_group)  # -> Paths, Length, Count
paramloftmsh_2 = ParameterLoftMesh(
    Sections=pline_2,
    ParametersU=[0, 0.1, 0.2, 0.3, 0.4, 0.5, 0.6, 0.7, 0.8, 0.9, 1],
    ParametersV=[0, 1],
    Weighted=False,
    Lengths=True,
    Angle=0,
    Closed=False,
    Triangulate=False)
item_7 = ListItem(List=tstat_2.Paths, Index=0, Wrap=True)  # -> Item1, Item
branch_3 = TreeBranch(Tree=cluster_8.segment_pt_group, Path=item_7.Item, MaintainPaths=True)
branch_4 = TreeBranch(Tree=cluster_8.segment_pt_group, Path=item_7.Item1, MaintainPaths=True)
item_8 = ListItem(List=deplane_2.ZAxis, Index=0, Wrap=True)  # -> Item1, Item
ungroup_3 = Ungroup(Group=branch_4)
ungroup_4 = Ungroup(Group=branch_3)
cluster_9 = Cluster_3(D=ungroup_4, V=item_8.Item, A=expr("-x", Slider(5.88, range=0..10)))
cluster_10 = Cluster_3(D=ungroup_3, V=item_8.Item1, A=Slider(3.8, range=0..10))
mjoin_2 = MeshJoin(Meshes=flatten([paramloftmsh_2, cluster_10, cluster_9]))
weldvertices_2 = MeshWeldVertices(Mesh=mjoin_2, Tolerance=0.01)  # -> RuntimeMessage, Mesh
unim_2 = UnifyMesh(Mesh=weldvertices_2.Mesh)  # -> Result, Count
subdmesh_3 = SubDFromMesh(Mesh=unim_2.Result, Creases=1, Corners=1, Interpolate=False)

subdpoly_2 = SubDControlPolygon(SubD=subdmesh_3)
medges_2 = MeshEdges(Mesh=subdpoly_2)  # -> NakedEdges, InteriorEdges, NonManifoldEdges

number_slider_9 = Slider(0.3, range=0..1)
subtraction_3 = Subtraction(A=1, B=number_slider_9)
subtraction_4 = Subtraction(A=1, B=Slider(0.24, range=0..1))
cluster_11 = Cluster_4(L=cluster_8.segment_points, S=Slider(1, range=0..10), D=Slider(5, range=0..30), ex=Slider(4, range=0..10))
dom_15 = ConstructDomain(DomainStart=number_slider_9, DomainEnd=subtraction_3)
dom_16 = ConstructDomain(DomainStart=Slider(0.37, range=0..1), DomainEnd=subtraction_4)
dom²_2 = ConstructDomain²(DomainU=dom_15, DomainV=dom_16)
shrink_2 = ShrinkSurface(Brep=cluster_11)  # -> Brep, Surface
subsrf_2 = Isotrim(Surface=reparameterize(shrink_2.Surface), Domain=dom²_2)
rebuild_2 = Rebuild(Surface=subsrf_2, DegreeU=3, DegreeV=3, CountU="10", CountV="10")

offmsh_2 = OffsetMesh(Mesh=unim_2.Result, Distance=expr("-x", 1), BothSides=0, CreateSolid=False)

bbox_2 = BoundingBox(Content=subdmesh_3, Plane=pframe_4)  # -> Box, Box_2
edges_2 = BrepEdges(Brep=bbox_2.Box)  # -> Naked, Interior, NonManifold
py3_8 = Python3Script(B=bbox_2.Box)  # -> pts, U, V, W; inputs B: Box; same code as py3_7
item_9 = ListItem(List=py3_8.pts, Index=0, Wrap=True)  # -> Item, Item1, Item2, Item3, Item4
ln_6 = Line(StartPoint=item_9.Item, EndPoint=item_9.Item1)
ln_7 = Line(StartPoint=item_9.Item, EndPoint=item_9.Item4)
ln_8 = Line(StartPoint=item_9.Item1, EndPoint=item_9.Item2)

subdmesh_4 = SubDFromMesh(Mesh=offmsh_2, Creases=1, Corners=1, Interpolate=False)
volume_2 = Volume(Geometry=bbox_2.Box)  # -> Volume, Centroid
panel_7 = Panel(volume_2.Volume)
dim_2 = Dimensions(Surface=subsrf_2)  # -> UDimension, VDimension
panel_8 = Panel(dim_2.VDimension)
panel_9 = Panel(dim_2.UDimension)
cluster_12 = Cluster_5(S=rebuild_2, U=Slider(3, range=0..100), V=Slider(5, range=0..100), R=radius_2, H=height_2, G=gap_2)

preview_4 = CustomPreview(Geometry=flatten([subdmesh_3, subdmesh_4, cluster_12]), Material=ColourSwatch(SwatchColor=RGB(119, 52, 186)))
preview_5 = CustomPreview(Geometry=edges_2.Interior, Material="white")
curve_preview_2 = CustomCurvePreview(Curve=medges_2.InteriorEdges, Colour=RGB(0, 0, 0))
linedim_2 = LineDimension(Line=[ln_6, ln_8, ln_7], Text="{0:0.00}", Size=Slider(2.25, range=0..10))
preview_6 = CustomPreview(Material=ColourSwatch(SwatchColor=RGBA(255, 255, 255, 32)))

# ---- group: Switch input type
dispatch_9 = Dispatch(List=Slider(113, range=0..1000), DispatchPattern=invert(toggle_3))  # -> ListA, ListB
dispatch_10 = Dispatch(List=remap_5.Mapped, DispatchPattern=invert(toggle_3))  # -> ListA, ListB
dispatch_11 = Dispatch(List=pdecon_3.ZComponent, DispatchPattern=toggle_3)  # -> ListA, ListB
# Plane
# Length range
# Width range
# Steps
# X segments
# Y Segments
# Bend
# Bend Graph
# Chamfer
# Inner convexity
# Convexity graph
merge_3 = Merge(Data1=dispatch_11.ListA, Data2=dispatch_9.ListA)

# ----
vec_3 = VectorXYZ(XComponent=0, YComponent=Slider(24, range=0..100), ZComponent=merge_3)  # -> Vector, Length
move_5 = Move(Geometry=pt_3, Motion=vec_3.Vector)  # -> Geometry, Transform
ln_9 = Line(StartPoint=pt_3, EndPoint=move_5.Geometry)
eval_3 = EvaluateCurve(Curve=reparameterize(ln_9), Parameter=Slider(0.428, range=0..1))  # -> Point, Tangent, Angle
move_6 = Move(Geometry=eval_3.Point, Motion=expr("-x", Y_3))  # -> Geometry, Transform
arc_3 = Arc3Pt(PointA=pt_3, PointB=move_6.Geometry, PointC=move_5.Geometry)  # -> Arc, Plane, Radius
pframe_5 = PerpFrame(Curve=reparameterize(arc_3.Arc), Parameter=graph_3)
pframe_6 = PerpFrame(Curve=reparameterize(arc_3.Arc), Parameter=number_slider_7)
align_3 = AlignPlane(Plane=pframe_5, Direction=X_3)  # -> Plane, Angle
cluster_13 = Cluster_2(C=crv_3, P=align_3.Plane)

# ---- group: Switch input type (continued)
dispatch_12 = Dispatch(List=cluster_13, DispatchPattern=toggle_3)  # -> ListA, ListB
entwine_5 = Entwine(Branch00=dispatch_12.ListA, Branch01=dispatch_10.ListA, FlattenInputs=True)
clean_3 = CleanTree(RemoveNulls=True, RemoveInvalid=True, RemoveEmpty=True, Tree=entwine_5)

# ----
entwine_6 = Entwine(
    Branch00=align_3.Plane,
    Branch01=clean_3,
    Branch02=remap_6.Mapped,
    Branch03=x_segements_3,
    Branch04=y_segements_3,
    Branch05=bend_3,
    Branch06=panel_2,
    Branch07=range_13,
    Branch08=remap_11.Mapped,
    Branch09=graph_17,
    FlattenInputs=True)
data_5 = Data(entwine_6)
bang_3 = ExplodeTree(Data=entwine_6)  # -> Branch0, Branch1, Branch2, Branch3, Branch4, Branch5, Branch6, graft(Branch7), Branch8, Branch9
cluster_14 = Cluster(
    plane=bang_3.Branch0,
    length_range=bang_3.Branch1,
    width_range=bang_3.Branch2,
    x_segements=bang_3.Branch3,
    y_segements=bang_3.Branch4,
    bend=bang_3.Branch5,
    bend_graph=bang_3.Branch6,
    chamfer=bang_3.Branch7,
    inner_convexity=bang_3.Branch8,
    convexity_graph=bang_3.Branch9)  # -> simplify(segment_pt_group), simplify(segment_points), middle_polyline
deplane_3 = DeconstructPlane(Plane=bang_3.Branch0)  # -> Origin, XAxis, YAxis, ZAxis
points_3 = PointList(Points=cluster_14.segment_points, Size=2.35)
pline_3 = PolyLine(Vertices=cluster_14.segment_points, Closed=True)  # -> flatten(Polyline)
tstat_3 = TreeStatistics(Tree=cluster_14.segment_pt_group)  # -> Paths, Length, Count
paramloftmsh_3 = ParameterLoftMesh(
    Sections=pline_3,
    ParametersU=[0, 0.1, 0.2, 0.3, 0.4, 0.5, 0.6, 0.7, 0.8, 0.9, 1],
    ParametersV=[0, 1],
    Weighted=False,
    Lengths=True,
    Angle=0,
    Closed=False,
    Triangulate=False)
item_10 = ListItem(List=tstat_3.Paths, Index=0, Wrap=True)  # -> Item1, Item
branch_5 = TreeBranch(Tree=cluster_14.segment_pt_group, Path=item_10.Item, MaintainPaths=True)
branch_6 = TreeBranch(Tree=cluster_14.segment_pt_group, Path=item_10.Item1, MaintainPaths=True)
item_11 = ListItem(List=deplane_3.ZAxis, Index=0, Wrap=True)  # -> Item1, Item
ungroup_5 = Ungroup(Group=branch_6)
ungroup_6 = Ungroup(Group=branch_5)
cluster_15 = Cluster_3(D=ungroup_6, V=item_11.Item, A=expr("-x", Slider(5.88, range=0..10)))
cluster_16 = Cluster_3(D=ungroup_5, V=item_11.Item1, A=Slider(3.8, range=0..10))
mjoin_3 = MeshJoin(Meshes=flatten([paramloftmsh_3, cluster_16, cluster_15]))
weldvertices_3 = MeshWeldVertices(Mesh=mjoin_3, Tolerance=0.01)  # -> RuntimeMessage, Mesh
unim_3 = UnifyMesh(Mesh=weldvertices_3.Mesh)  # -> Result, Count
subdmesh_5 = SubDFromMesh(Mesh=unim_3.Result, Creases=1, Corners=1, Interpolate=False)

subdpoly_3 = SubDControlPolygon(SubD=subdmesh_5)
medges_3 = MeshEdges(Mesh=subdpoly_3)  # -> NakedEdges, InteriorEdges, NonManifoldEdges

cluster_17 = Cluster_4(L=cluster_14.segment_points, S=Slider(1, range=0..10), D=Slider(5, range=0..30), ex=Slider(4, range=0..10))
shrink_3 = ShrinkSurface(Brep=cluster_17)  # -> Brep, Surface

number_slider_10 = Slider(0.3, range=0..1)
subtraction_5 = Subtraction(A=1, B=number_slider_10)
subtraction_6 = Subtraction(A=1, B=Slider(0.24, range=0..1))
dom_17 = ConstructDomain(DomainStart=number_slider_10, DomainEnd=subtraction_5)
dom_18 = ConstructDomain(DomainStart=Slider(0.37, range=0..1), DomainEnd=subtraction_6)
dom²_3 = ConstructDomain²(DomainU=dom_17, DomainV=dom_18)
subsrf_3 = Isotrim(Surface=reparameterize(shrink_3.Surface), Domain=dom²_3)
rebuild_3 = Rebuild(Surface=subsrf_3, DegreeU=3, DegreeV=3, CountU="10", CountV="10")

# ----
# Inside surface
offmsh_3 = OffsetMesh(Mesh=unim_3.Result, Distance=expr("-x", 1), BothSides=0, CreateSolid=False)

bbox_3 = BoundingBox(Content=subdmesh_5, Plane=pframe_6)  # -> Box, Box_2
edges_3 = BrepEdges(Brep=bbox_3.Box)  # -> Naked, Interior, NonManifold
py3_9 = Python3Script(B=bbox_3.Box)  # -> pts, U, V, W; inputs B: Box; same code as py3_7
item_12 = ListItem(List=py3_9.pts, Index=0, Wrap=True)  # -> Item, Item1, Item2, Item3, Item4
ln_10 = Line(StartPoint=item_12.Item, EndPoint=item_12.Item1)
ln_11 = Line(StartPoint=item_12.Item, EndPoint=item_12.Item4)
ln_12 = Line(StartPoint=item_12.Item1, EndPoint=item_12.Item2)

subdmesh_6 = SubDFromMesh(Mesh=offmsh_3, Creases=1, Corners=1, Interpolate=False)
volume_3 = Volume(Geometry=bbox_3.Box)  # -> Volume, Centroid
panel_10 = Panel(volume_3.Volume)
dim_3 = Dimensions(Surface=subsrf_3)  # -> UDimension, VDimension
panel_11 = Panel(dim_3.VDimension)
panel_12 = Panel(dim_3.UDimension)
cluster_18 = Cluster_5(S=rebuild_3, U=Slider(3, range=0..100), V=Slider(5, range=0..100), R=radius_3, H=height_3, G=gap_3)

preview_7 = CustomPreview(Geometry=flatten([subdmesh_5, subdmesh_6, cluster_18]), Material=ColourSwatch(SwatchColor=RGB(194, 29, 29)))
preview_8 = CustomPreview(Geometry=edges_3.Interior, Material="white")
curve_preview_3 = CustomCurvePreview(Curve=medges_3.InteriorEdges, Colour=RGB(0, 0, 0))
linedim_3 = LineDimension(Line=[ln_10, ln_12, ln_11], Text="{0:0.00}", Size=Slider(2.25, range=0..10))
preview_9 = CustomPreview(Material=ColourSwatch(SwatchColor=RGBA(255, 255, 255, 32)))

# ==== cluster Cluster
inner_convexity = ClusterInput()
length_range = ClusterInput()
width_range = ClusterInput()
x_segements = ClusterInput()
y_segements = ClusterInput()
convexity_graph = ClusterInput()
bend_graph = ClusterInput()
chamfer = ClusterInput()
plane = ClusterInput()
bend = ClusterInput()
multiplication = Multiplication(A=convexity_graph, B=graft(inner_convexity))
dom = ConstructDomain(DomainStart=bend, DomainEnd=0)
deplane = DeconstructPlane(Plane=plane)  # -> Origin, XAxis, YAxis, ZAxis
X = UnitX(Factor=length_range)
remap = RemapNumbers(Value=bend_graph, Source=Domain(1, 0), Target=dom)  # -> Mapped, Clipped
parabola = Python3Script(N=x_segements, D="1", Inv="1")  # -> R; inputs N: Int32, D: Int32, Inv: Boolean
#   port N: Number of steps
#   port D: 0 = (0 To 1) 1 = (-1 To 1)
# ---------- parabola: Python ----------
if not N:
    N = 10

types = [(0, 1),
         (-1, 1)]
R = []
start, end = types[D]
diff = end - start
step = diff / N
N += 1
for i in range(N):
    f = (start + i * step) ** 2
    if Inv:
        R.append(end - f)
    else:
        R.append(f)
# ---------- end parabola ----------
multiplication_2 = Multiplication(A=parabola, B=graft(remap.Mapped))
move = Move(Geometry=plane, Motion=expr("-x", X))  # -> Geometry, Transform
move_2 = Move(Geometry=plane, Motion=X)  # -> Geometry, Transform
multiplication_3 = Multiplication(A=graft(deplane.YAxis), B=multiplication_2)
ln = Line(StartPoint=move.Geometry, EndPoint=move_2.Geometry)
neg = Negative(Value=multiplication_3)
divide = DivideCurve(Curve=ln, Count=x_segements, Kinks=False)  # -> Points, Tangents, Parameters
move_3 = Move(Geometry=divide.Points, Motion=neg)  # -> Geometry, Transform
pline = PolyLine(Vertices=move_3.Geometry, Closed=False)
multiplication_4 = Multiplication(A=graft(deplane.YAxis), B=multiplication)
middle_polyline = ClusterOutput(pline)
offset = OffsetCurve(Curve=pline, Distance=expr("x/2", graft(width_range)), Plane=graft(plane), Corners=1)
offset_2 = OffsetCurve(Curve=pline, Distance=expr("-x/2", graft(width_range)), Plane=graft(plane), Corners=1)
end = EndPoints(Curve=offset)  # -> Start, End
end_2 = EndPoints(Curve=offset_2)  # -> Start, End
ln_2 = Line(StartPoint=end.Start, EndPoint=end_2.Start)
ln_3 = Line(StartPoint=end.End, EndPoint=end_2.End)
trim_curve = TrimCurve(C=offset, D=chamfer)  # -> Crv; inputs C: Curve, D: Double, E: Int32
#   port E: None = 0 Start = 1 End = 2 Both = 3
# ---------- trim_curve: Python ----------
import Rhino.Geometry as rg
if not E:
    E = 3
if not D:
    D = 0
try:
    if D:
        Crv = C.Trim(rg.CurveEnd(E), D)
    else:
        Crv = C
except:
    pass
# ---------- end trim_curve ----------
trim_curve_2 = TrimCurve(C=offset_2, D=chamfer)  # -> Crv; inputs C: Curve, D: Double, E: Int32; same code as trim_curve
trim_curve_3 = TrimCurve(C=ln_2, D=chamfer)  # -> Crv; inputs C: Curve, D: Double, E: Int32; same code as trim_curve
trim_curve_4 = TrimCurve(C=ln_3, D=chamfer)  # -> Crv; inputs C: Curve, D: Double, E: Int32; same code as trim_curve
divide_2 = DivideCurve(Curve=trim_curve_2, Count=x_segements, Kinks=False)  # -> reverse(Points), Tangents, Parameters
divide_3 = DivideCurve(Curve=trim_curve, Count=x_segements, Kinks=False)  # -> Points, Tangents, Parameters
divide_4 = DivideCurve(Curve=trim_curve_4, Count=y_segements, Kinks=False)  # -> Points, Tangents, Parameters
divide_5 = DivideCurve(Curve=trim_curve_3, Count=y_segements, Kinks=False)  # -> reverse(Points), Tangents, Parameters

# ---- group: Inner Convexity
move_4 = Move(Geometry=divide_2.Points, Motion=multiplication_4)  # -> Geometry, Transform

# ----
group = Group(Objects=divide_5.Points)
group_2 = Group(Objects=divide_3.Points)
group_3 = Group(Objects=move_4.Geometry)
group_4 = Group(Objects=divide_4.Points)
weave = Weave(Pattern=[0, 1, 2, 3], Stream0=group, Stream1=group_2, Stream2=group_4, Stream3=group_3, NullGaps=False)
ungroup = Ungroup(Group=weave)
pshift = ShiftPaths(Data=ungroup, Offset=-1)  # -> simplify(Data)
segment_pt_group = ClusterOutput(weave)
segment_points = ClusterOutput(pshift)

# ==== cluster Cluster_2
P = ClusterInput()
pdecon = Deconstruct(Point=P)  # -> XComponent, YComponent, ZComponent
C = ClusterInput()
pt = ConstructPoint(XCoordinate=pdecon.XComponent, YCoordinate=0, ZCoordinate=pdecon.ZComponent)
pcx = CurvePlane(Curve=C, Plane=pt)  # -> Points, ParamsC, ParamsP
pdecon_2 = Deconstruct(Point=pcx.ParamsP)  # -> flatten(XComponent), YComponent, ZComponent
X = ClusterOutput(pdecon_2.XComponent)

# ==== cluster Cluster_3
D = ClusterInput()
V = ClusterInput()
A = ClusterInput()
bang = ExplodeTree(Data=D)  # -> Branch0, reverse(Branch1), Branch2, Branch3
amp = Amplitude(Vector=V, Amplitude=A)
ln = Line(StartPoint=bang.Branch1, EndPoint=bang.Branch3)
subset = SubList(List=reverse(bang.Branch0), Domain=Domain(0, 1), Wrap=True)  # -> reverse(List), Index
subset_2 = SubList(List=reverse(bang.Branch2), Domain=Domain(0, 1), Wrap=True)  # -> reverse(List), Index
subset_3 = SubList(List=bang.Branch0, Domain=Domain(0, 1), Wrap=True)  # -> List, Index
subset_4 = SubList(List=bang.Branch2, Domain=Domain(0, 1), Wrap=True)  # -> List, Index
midpt = CurveMiddle(Curve=ln)
move = Move(Geometry=midpt, Motion=amp)  # -> Geometry, Transform
entwine = Entwine(
    Branch00=subset_3.List,
    Branch01=reverse(move.Geometry),
    Branch02=subset_2.List,
    Branch03=bang.Branch3,
    FlattenInputs=True)  # -> flatten(Result)
entwine_2 = Entwine(Branch00=subset.List, Branch01=reverse(bang.Branch1), Branch02=subset_4.List, Branch03=move.Geometry, FlattenInputs=True)  # -> flatten(Result)
shift = ShiftList(List=entwine, Shift=1, Wrap=True)
shift_2 = ShiftList(List=entwine_2, Shift=1, Wrap=True)
construct_mesh = Python3Script(V=shift)  # -> M; inputs V: list of Point3d
# ---------- construct_mesh: Python ----------
from math import ceil
import ghpythonlib.components as gc

face_n = int((len(V)-2)/2)

n = [i for i in range(len(V))]
Faces = []
for i in range(face_n):
    cb = '{}'
    ch = f'Q{cb[0]}{n[0]};{n[1]};{n[-2]};{n[-1]}{cb[1]}'
    Faces.append(ch)
    n.pop(-1)
    n.pop(0)

M = gc.ConstructMesh(V, Faces)
# ---------- end construct_mesh ----------
construct_mesh_2 = Python3Script(V=shift_2)  # -> M; inputs V: list of Point3d; same code as construct_mesh
points = PointList(Points=shift_2, Size=2.35)
mjoin = MeshJoin(Meshes=[construct_mesh, construct_mesh_2])
M = ClusterOutput(mjoin)

# ==== cluster Cluster_4
L = ClusterInput()
S = ClusterInput()
shift = ShiftList(List=L, Shift=S, Wrap=True)
D = ClusterInput()
subset = SubList(List=reverse(shift), Domain=D, Wrap=True)  # -> List, Index
pline = PolyLine(Vertices=subset.List, Closed=False)  # -> flatten(Polyline)
paramloftmsh = ParameterLoftMesh(
    Sections=pline,
    ParametersU=[0, 0.1, 0.2, 0.3, 0.4, 0.5, 0.6, 0.7, 0.8, 0.9, 1],
    ParametersV=[0, 1],
    Weighted=False,
    Lengths=True,
    Angle=0,
    Closed=False,
    Triangulate=False)
flipm = FlipMesh(Mesh=paramloftmsh, VertexNormals=True, FaceNormals=True, FaceOrientation=True)
subdmesh = SubDFromMesh(Mesh=flipm, Creases=1, Corners=1, Interpolate=False)
ex = ClusterInput()
subd_to_nurbs = Python3Script(S=subdmesh, Ex=ex)  # -> B; inputs Ex: Int32
#   port Ex: None = 0 LocalG1 = 1 LocalG2 = 2 LocalG1x = 3 LocalG1xx = 4
# ---------- subd_to_nurbs: Python ----------
import Rhino.Geometry as rg
if Ex > 4:
    raise ValueError('This option doesn\'nt exist. (0, 4)')
opt = rg.SubDToBrepOptions()
opt.PackFaces = True
evp = rg.SubDToBrepOptions.ExtraordinaryVertexProcessOption(Ex)
opt.ExtraordinaryVertexProcess = evp
B = S.ToBrep(opt)
# ---------- end subd_to_nurbs ----------
B = ClusterOutput(subd_to_nurbs)

# ==== cluster Cluster_5
S = ClusterInput()
R = ClusterInput()
H = ClusterInput()
G = ClusterInput()
U = ClusterInput()
V = ClusterInput()
sdivide = DivideSurface(Surface=S, UCount=U, VCount=V)  # -> Points, Normals, Parameters
flip = FlipMatrix(Data=sdivide.Points)
intcrv = Interpolate(Vertices=flip, Degree=3, Periodic=False, KnotStyle=1)  # -> Curve, Length, Domain
multiplication = Multiplication(A=R, B=2)
len = Length(Curve=intcrv.Curve)
addition = Addition(A=multiplication, B=G)
division = Division(A=len, B=addition)
int = Integer(division)
divide = DivideCurve(Curve=intcrv.Curve, Count=int, Kinks=False)  # -> Points, Tangents, Parameters
srf_cp = SurfaceClosestPoint(Point=divide.Points, Surface=S)  # -> Point, UVPoint, Distance
evalsrf = EvaluateSurface(Surface=S, Point=srf_cp.UVPoint)  # -> Point, Normal, UDirection, VDirection, Frame
sph = Sphere(Base=evalsrf.Point, Radius=R)
cir = Circle(Plane=evalsrf.Frame, Radius=R)
srfsplit = SurfaceSplit(Surface=graft(sph), Curves=graft(cir))
item = ListItem(List=srfsplit, Index=0, Wrap=True)
pshift = ShiftPaths(Data=item, Offset=-2)  # -> simplify(Data)
cyl = Cylinder(Base=evalsrf.Frame, Radius=R, Length=expr("-x", H))
scale_nu = ScaleNU(Geometry=pshift, Plane=simplify(evalsrf.Frame), ScaleX=1, ScaleY=1, ScaleZ=Slider(0.2, range=0..1))  # -> Geometry, Transform
weave = Weave(Pattern=[0, 1], Stream0=graft(cyl), Stream1=graft(scale_nu.Geometry), NullGaps=False)
join = BrepJoin(Breps=weave)  # -> Breps, Closed
pshift_2 = ShiftPaths(Data=join.Breps, Offset=-2)  # -> simplify(Data)
geometry = ClusterOutput(pshift_2)
